# Grasshopper definition Iteration_1_Grashopper.gh (Grasshopper 1.0.8)
# plug-ins: GSA

lenght = Slider(300, range=0..1000)
width = Slider(130, range=0..1000)
distance_between_edge_and_columns = Slider(10, range=0..100)
number_of_columns = Slider(10, range=0..20)
height_of_columns = Slider(10, range=0..100)
hole_radius = Slider(3, range=0..10)
merge = Merge(
    Data1=lenght,
    Data2=width,
    Data3=distance_between_edge_and_columns,
    Data4=number_of_columns,
    Data5=height_of_columns,
    Data6=hole_radius)

prestress_xdir_n_m = Slider(5, range=0..100)
prestress_ydir_n_m = Slider(5, range=0..100)
prestress_cables_n = Slider(10, range=0..100)
merge_2 = Merge(Data1=prestress_xdir_n_m, Data2=prestress_ydir_n_m, Data3=prestress_cables_n)

analysis_number = Panel("101")
material_number = Panel("11")
fabric_name = Panel("Fabric x")
warp_strenght_kn_m = Panel("1000")
weave_strenght_kn_m = Panel("500")
poisson_s_ratio = Panel("0.3")
shear_modulus_kn_m = Panel("40")
density_tonnes_m_2 = Panel("0.01")
limit_strain = Panel("1000")
merge_3 = Merge(
    Data1=analysis_number,
    Data2=material_number,
    Data3=fabric_name,
    Data4=warp_strenght_kn_m,
    Data5=weave_strenght_kn_m,
    Data6=poisson_s_ratio,
    Data7=shear_modulus_kn_m,
    Data8=density_tonnes_m_2,
    Data9=limit_strain)

diameter_cable_bar = Slider(15, range=0..100)
diameter_column = Slider(50, range=0..100)
top_colum_z_offset = Slider(10, range=0..50)
top_colum_y_offset = Slider(15, range=0..50)
bottom_colum_y_offset = Slider(10, range=0..50)
bottom_cable_y_offset = Slider(15, range=0..50)

analysis_number_2 = Panel("101")
material_number_2 = Panel("11")
fabric_name_2 = Panel("Fabric x")
warp_strenght_kn_m_2 = Panel("1000")
weave_strenght_kn_m_2 = Panel("500")
poisson_s_ratio_2 = Panel("0.3")
shear_modulus_kn_m_2 = Panel("40")
density_tonnes_m_2_2 = Panel("0.01")
limit_strain_2 = Panel("1000")
merge_4 = Merge(
    Data1=analysis_number_2,
    Data2=material_number_2,
    Data3=fabric_name_2,
    Data4=warp_strenght_kn_m_2,
    Data5=weave_strenght_kn_m_2,
    Data6=poisson_s_ratio_2,
    Data7=shear_modulus_kn_m_2,
    Data8=density_tonnes_m_2_2,
    Data9=limit_strain_2)

base_connection = ValueList({"Pinned": 0, "Cable - FREE": 1, "Cable - CABLE": 2}, selected="Pinned")
column_connection = ValueList({"Pinned": 0, "Column-ALL RIGID": 1, "Column-ALL CABLES": 2, "Column-BOUNDARY CABLE, REST RIGID": 3, "Column-BOUNDARY RIGID, REST CABLE": 4, "Slanted-RIGID": 5, "Slanted-CABLE": 6}, selected="Pinned")
merge_5 = Merge(
    Data1=column_connection,
    Data2=base_connection,
    Data3=diameter_cable_bar,
    Data4=diameter_column,
    Data5=top_colum_z_offset,
    Data6=top_colum_y_offset,
    Data7=bottom_colum_y_offset,
    Data8=bottom_cable_y_offset)

# ---- group: Material Creation
txt = Text(merge_4)  # disabled
analysis_properties = Python3Script(fabric_data=txt)  # -> out, mat_anal; inputs fabric_data: list
# ---------- analysis_properties: Python ----------
Id,num,name,Ex,Ey,nu,G,rho,eps=fabric_data[0],fabric_data[1],fabric_data[2],fabric_data[3],fabric_data[2],fabric_data[5],fabric_data[6],fabric_data[7],fabric_data[8]
mat_anal="MAT_ANAL, {Id} , MAT_FABRIC , {name} , NO_RGB , 4 , {Ex} , {Ey} , {nu} , {G} , 1 , ".format(Id=Id,num=num,name=name, Ex=Ex, Ey=Ey,nu=nu,G=G,rho=rho,eps=eps)
print(mat_anal)
# ---------- end analysis_properties ----------
creating_material = Python3Script(fabric_data=txt)  # -> out, mat; inputs fabric_data: list
# ---------- creating_material: Python ----------
Id,num,name,Ex,Ey,nu,G,rho,eps=fabric_data[0],fabric_data[1],fabric_data[2],fabric_data[3],fabric_data[2],fabric_data[5],fabric_data[6],fabric_data[7],fabric_data[8]
mat="MAT.11 , {num} , {name} , {Ex} , {Ex} , {nu} , {G} , {rho} , 0 , {Id} , 0 (,  ,  ,  ,) 0 (,  ,  ,  ,) 0 (,  ,  ,  ,)  (,  ,  ,  ,) {eps} ,  ,  , 0 , FABRIC , FALSE , ".format(Id=Id,num=num,name=name, Ex=Ex, Ey=Ey,nu=nu,G=G,rho=rho,eps=eps)
print(mat)
# ---------- end creating_material ----------
gwa = GWACommand(GWAString=analysis_properties.mat_anal)  # -> Model, ReturnedResult
creating_material_2 = Python3Script(fabric_data=txt)  # -> out, mat_fabric; inputs fabric_data: list
# ---------- creating_material_2: Python ----------
Id,num,name,Ex,Ey,nu,G,rho,eps=fabric_data[0],fabric_data[1],fabric_data[2],fabric_data[3],fabric_data[2],fabric_data[5],fabric_data[6],fabric_data[7],fabric_data[8]
mat_fabric="SET, MAT_FABRIC , 1 , {num}".format(Id=Id,num=num,name=name, Ex=Ex, Ey=Ey,nu=nu,G=G,rho=rho,eps=eps)
print(mat_fabric)
# ---------- end creating_material_2 ----------
gwa_2 = GWACommand(GSAModel=gwa.Model, GWAString=creating_material.mat)  # -> Model, ReturnedResult
gwa_3 = GWACommand(GSAModel=gwa_2.Model, GWAString=creating_material_2.mat_fabric)  # -> Model, ReturnedResult
getmats = GetModelMaterials(GSAModel=gwa_3.Model)  # -> Steel, Concrete, PMat, Aluminium, Timber, Glass, Fabric, Custom

# ----
material = CreateCustomMaterial(
    AnalysisPropertyNumber=material_number_2,
    MaterialName=fabric_name_2,
    ElasticModulus_MPa=warp_strenght_kn_m_2,
    PoissonsRatio=poisson_s_ratio_2,
    Density_kg_m³=density_tonnes_m_2_2,
    Material_Type="Fabric",
    Stress_Unit="MPa",
    Density_Unit="kg/m³",
    Temperature_Unit="°C")

int = Integer(merge)
py3 = Python3Script(Geometric_Data=int)  # -> out, X, Y, x, y, Radius, Danger_zone, a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; inputs Geometric_Data: list
# ---------- py3: Python ----------
lenght,width,distance_col,number_col,height_col,Radius=int(Geometric_Data[0]),int(Geometric_Data[1]),Geometric_Data[2],Geometric_Data[3],Geometric_Data[4],Geometric_Data[5]+0.01
Danger_zone=Radius+0.5
nodes_side=number_col*2
Y=lenght
X=width
x,y=[],[]
for i in range(nodes_side+1):
    if i%2 ==0:
        print("nada")
    else:
        x.append(distance_col)
        y_point=(lenght/nodes_side)*i
        y.append(y_point)
for i in range(nodes_side+1):
    
    if i%2 ==0:
        print("nada")
    else:
        x.append(width-distance_col)
        y_point=(lenght/nodes_side)*i
        y.append(y_point)
a,b,c=[],[],[]
for i in range(nodes_side+1):
    if i%2 ==0:
        a.append(0)
        y_point=(lenght/nodes_side)*i
        b.append(y_point)
        c.append(0)
for i in range(nodes_side+1):
    if i%2 ==0:
        a.append(width)
        y_point=(lenght/nodes_side)*i
        b.append(y_point)
        c.append(0)
height=height_col
# ---------- end py3 ----------
py3_2 = Python3Script(x=py3.x, y=py3.y, R=py3.Radius)  # -> out, X, Y; inputs x: list, y: list
# ---------- py3_2: Python ----------
X,Y=[],[]
for i in range(len(x)):
    X.append("{} to {}".format(x[i]-R,x[i]+R))
    Y.append("{} to {}".format(y[i]-R,y[i]+R))
print(X)
# ---------- end py3_2 ----------
pt = ConstructPoint(XCoordinate=py3.a, YCoordinate=py3.b, ZCoordinate=py3.c)
planesrf = PlaneSurface(Plane=PlaneXY(0, 0, 0), XSize=py3.X, YSize=py3.Y)
rectangle = Rectangle(Plane=PlaneXY(0, 0, 0), XSize=py3_2.X, YSize=py3_2.Y, Radius=0)  # -> Rectangle, Length
sdiff = SolidDifference(BrepsA=planesrf, BrepsB=flatten(rectangle.Rectangle))
multiplication = Multiplication(A=py3.X, B="1")
multiplication_2 = Multiplication(A="1", B=py3.Y)
py3_3 = Python3Script(x=py3.x, y=py3.y, R=py3.Danger_zone)  # -> out, X, Y; inputs x: list, y: list; same code as py3_2
mesh_uv = MeshSurface(Surface=sdiff, UCount=multiplication, VCount=multiplication_2, Overhang=True, Equalize=False)
pt_2 = ConstructPoint(XCoordinate=py3.x, YCoordinate=py3.y, ZCoordinate=0)
vec = VectorXYZ(XComponent=0, YComponent=0, ZComponent=py3.height)  # -> Vector, Length
demesh = DeconstructMesh(Mesh=mesh_uv)  # -> Vertices, Faces, Colours, Normals
circle = CircleCNR(Center=pt_2, Normal=Vector(0, 0, 1), Radius=py3.Radius)
rectangle_2 = Rectangle(Plane=PlaneXY(0, 0, 0), XSize=py3_3.X, YSize=py3_3.Y, Radius=0)  # -> Rectangle, Length
incurve = PointInCurve(Point=demesh.Vertices, Curve=graft(rectangle_2.Rectangle))  # -> Relationship, Point
py3_4 = Python3Script(R=incurve.Relationship)  # -> out, a; inputs R: tree
# ---------- py3_4: Python ----------
from Grasshopper import DataTree
from Grasshopper.Kernel.Data import GH_Path

# R = input tree
# Collect all branches
branches = [list(R.Branch(i)) for i in range(R.BranchCount)]

# Transpose: element-wise grouping across branches
transposed = zip(*branches)

result = []
for group in transposed:
    vals = set(group)
    if vals == {0}:
        result.append(0)
    elif 2 in vals:
        result.append(2)
    else:
        result.append(1)

a = result  # flat list output
print(a)
# ---------- end py3_4 ----------
py3_5 = Python3Script(R=py3_4.a, P=demesh.Vertices, C=circle)  # -> out, Pt, Seg; inputs R: list, P: list, C: list
# ---------- py3_5: Python ----------
Pt =[]
for i in range(len(R)):
    if R[i] in [1,2]:
        Pt.append(P[i])
print(Pt)
Seg=len(Pt)/len(C)
# ---------- end py3_5 ----------
divide = DivideCurve(Curve=circle, Count=py3_5.Seg, Kinks=False)  # -> flatten(Points), Tangents, Parameters
py3_6 = Python3Script(A=py3_5.Pt, B=divide.Points)  # -> out, ClosestB; inputs A: list of Point3d, B: list of Point3d
# ---------- py3_6: Python ----------
# requirements: numpy
# requirements: scipy

import Rhino.Geometry as rg
import numpy as np
from scipy.optimize import linear_sum_assignment

# Convert input points to Point3d
A_pts = [pt.Location if hasattr(pt, "Location") else pt for pt in A]
B_pts = [pt.Location if hasattr(pt, "Location") else pt for pt in B]

# Make distance matrix
dist_matrix = np.zeros((len(A_pts), len(B_pts)))
for i, a in enumerate(A_pts):
    for j, b in enumerate(B_pts):
        dist_matrix[i, j] = a.DistanceTo(b)

# Solve assignment problem
row_ind, col_ind = linear_sum_assignment(dist_matrix)

# Output corresponding B points
ClosestB = [B_pts[j] for j in col_ind]
# ---------- end py3_6 ----------
move = Move(Geometry=py3_6.ClosestB, Motion=vec.Vector)  # -> Geometry, Transform
py3_7 = Python3Script(R1=py3_4.a, P=demesh.Vertices, G1=move.Geometry)  # -> out, V; inputs R1: list, P: list, G1: list
# ---------- py3_7: Python ----------
V=[]
c=0

for i in range(len(P)):
    if R1[i] in [2,1]:
        V.append(G1[c])
        c=c+1
    else:
        V.append(P[i])

print(c)
# ---------- end py3_7 ----------
conmesh = ConstructMesh(Vertices=py3_7.V, Faces=demesh.Faces)
msmooth = SmoothMesh(Mesh=conmesh, Strength=0.5, SkipNaked=True, Iterations="10000")
mat = CreateMaterial(Material_type="Fabric", Grade="Taconic Solus 1410")
demesh_2 = DeconstructMesh(Mesh=msmooth)  # -> Vertices, Faces, Colours, Normals
prop2d = Create2DProperty(Material=mat, Type="Fabric")
support = CreateSupport(Point=demesh_2.Vertices, Plane=PlaneXY(0, 0, 0), x=False, xx=False, y=False, yy=False, z=False, zz=False)
elem2d = Create2DElement(Geometry=msmooth, Property2D=prop2d, Preview3dSection=False)

crv = Curve(circle)
pt_3 = Point(move.Geometry)
pt_4 = Point(pt)
int_2 = Integer(merge_5)
py3_8 = Python3Script(Circle=crv, nodes_column=pt_3, nodes_base=pt_4, Connection_info=int_2)  # -> out, pinned_column, pinned_base, column_colum, column_colum_circle, column_colum_material, column_colum_bar_D, column_colum_col_D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; inputs Circle: list, nodes_column: list, nodes_base: list, Connection_info: list
# ---------- py3_8: Python ----------
if Connection_info[0] ==0:
    pinned_column=nodes_column
elif Connection_info[0] in [1,2,3,4]:
    column_colum=nodes_column
    column_colum_circle=Circle
    column_colum_material=Connection_info[0]
    column_colum_bar_D=Connection_info[2]
    column_colum_col_D=Connection_info[3]
elif Connection_info[0] in [5,6]:
    slanted_column=nodes_column
    slanted_column_circle=Circle
    slanted_column_material=Connection_info[0]
    slanted_column_z=Connection_info[4]
    slanted_column_y1=Connection_info[5]*-1
    slanted_column_y2=Connection_info[5]
    slanted_column_y3=Connection_info[6]*-1
    slanted_column_y4=Connection_info[6]
    slanted_column_cablebase=nodes_base
    slanted_colum_y5=Connection_info[7]*-1
    slanted_colum_y6=Connection_info[7]
    slanted_colum_bar_D=Connection_info[2]
    slanted_colum_col_D=Connection_info[3]
if Connection_info[1] ==0:
    pinned_base=nodes_base
elif Connection_info[1] in [1,2]:
    cable_base=nodes_base
    cable_base_y1=Connection_info[7]*-1
    cable_base_y2=Connection_info[7]
    cable_base_bar_D=Connection_info[2]
# ---------- end py3_8 ----------
model = CreateModel(GSAGeometryIn_m=flatten([elem2d, support]), ReMesh=False, Tolerance=0.01, Unit="m")
profile = CreateProfile(
    Diameter_cm=py3_8.cable_base_bar_D,
    catalogueIndex=-1,
    inclSS=False,
    lengthUnit="Centimeter",
    mode="Other",
    Profile_type="Circle",
    Measure="cm",
    typeIndex=-1)
support_2 = CreateSupport(Point=py3_8.pinned_column, Plane=PlaneXY(0, 0, 0), x=True, xx=False, y=True, yy=False, z=True, zz=False)
support_3 = CreateSupport(Point=py3_8.pinned_base, Plane=PlaneXY(0, 0, 0), x=True, xx=False, y=True, yy=False, z=True, zz=False)
py3_9 = Python3Script(x=py3_8.cable_base)  # -> out, a1, a2; inputs x: list
# ---------- py3_9: Python ----------
a1,a2=[],[]

for i in range(len(x)):
    if i < len(x)/2:
        a1.append(x[i])
    else:
        a2.append(x[i])
# ---------- end py3_9 ----------

no = Node(support)
mesh = Mesh(msmooth)
pt_5 = Point(move.Geometry)
demesh_3 = DeconstructMesh(Mesh=mesh)  # -> Vertices, Faces, Colours, Normals
cp = ClosestPoint(Point=pt_5, Cloud=demesh_3.Vertices)  # -> ClosestPoint, CPIndex, Distance
deface = DeconstructFace(Face=demesh_3.Faces)  # -> CornerA, CornerB, CornerC, CornerD
creata_points_for_polylines = Python3Script(V=demesh_3.Vertices, A=deface.CornerA, B=deface.CornerB, C=deface.CornerC, D=deface.CornerD, P=cp.CPIndex)  # -> out, u_count, v_count, V; inputs V: list, A: list, B: list, C: list, D: list, P: list
# ---------- creata_points_for_polylines: Python ----------
from Grasshopper import DataTree
from Grasshopper.Kernel.Data import GH_Path
from System import Object

def unique_preserve_order_iter(iterable):
    """Yield unique items from an iterable, preserving order."""
    seen = set()
    for item in iterable:
        if item not in seen:
            seen.add(item)
            yield item

def build_layer_paths(V, index_sets, P):
    """
    V: list of node values
    index_sets: list of tuples [(start_a, end_a, start_b, end_b), ...] for each layer
    P: list of indices -> segments where both start and end indices are in P will be removed
    
    Returns:
        all_paths: combined paths from all layers
        layer_counts: list of counts per layer
    """
    all_paths = []
    layer_counts = []

    for layer_num, (start_a, end_a, start_b, end_b) in enumerate(index_sets):
        # Merge start and end indices
        start_indices = start_a + start_b
        end_indices   = end_a + end_b

        # Build segments (indices) and filter out those where both ends are in P
        raw_segments = list(zip(start_indices, end_indices))
        segments = [(s, e) for s, e in raw_segments if not (s in P and e in P)]
        removed_segments = [seg for seg in raw_segments if seg not in segments]

        if removed_segments:
            print(f"Layer {layer_num+1} - removed segments (both ends in P): {removed_segments}")

        # Convert remaining segments to actual node values
        start = [V[i] for i, _ in segments]
        end   = [V[j] for _, j in segments]

        start_to_segment = {s: (s, e) for s, e in zip(start, end)}
        unvisited = set(start_to_segment.keys())
        layer_paths = []

        # Root nodes: start nodes not appearing as ends
        end_set = set(end)
        root_nodes = [s for s in start if s not in end_set]

        def traverse(root):
            path = []
            current = root
            while current in unvisited:
                if current not in start_to_segment:  # Segment removed → stop path
                    path.append(current)
                    break
                s, e = start_to_segment[current]
                path.append(s)
                unvisited.remove(current)
                current = e
                if current in path:  # Avoid cycles
                    path.append(current)
                    break
            if path and current not in path:
                path.append(current)
            return path

        # Traverse paths from roots
        for root in root_nodes:
            path = traverse(root)
            if path:
                layer_paths.append(path)

        # Traverse any remaining unvisited segments
        while unvisited:
            root = next(iter(unvisited))
            path = traverse(root)
            if path:
                layer_paths.append(path)

        all_paths.extend(layer_paths)
        layer_counts.append(len(layer_paths))  # Count for this layer

    return all_paths, layer_counts


# ----------------------------------------------------
# MAIN EXECUTION (Grasshopper inputs expected: V, A, B, C, D, P)
# ----------------------------------------------------

# Explicit segment assignments (indices)
# L1: C->B, D->A
# L2: D->C, A->B
layers = [
    (C, B, D, A),  # L1
    (D, C, A, B)   # L2
]

all_paths, layer_counts = build_layer_paths(V, layers, P)
u_count, v_count = layer_counts  # counts per layer

# Create Grasshopper DataTree
data_tree = DataTree[Object]()
for i, sublist in enumerate(all_paths):
    path = GH_Path(i)
    for item in sublist:
        data_tree.Add(item, path)

V = data_tree
# ---------- end creata_points_for_polylines ----------
pline = PolyLine(Vertices=creata_points_for_polylines.V, Closed=False)  # -> flatten(Polyline)
py3_10 = Python3Script(M_in=mesh, PL=pline)  # -> out, A, B, V, c; inputs PL: list
# ---------- py3_10: Python ----------
import Rhino
import Rhino.Geometry as rg
import scriptcontext as sc
from Grasshopper import DataTree
from Grasshopper.Kernel.Data import GH_Path

# Inputs
# M_in : Mesh object or GUID
# PL   : List of polylines

# --- Step 1: Ensure we have a Mesh object ---
if isinstance(M_in, rg.Mesh):
    M = M_in
else:
    obj = sc.doc.Objects.Find(M_in)
    if obj is not None:
        M = obj.Geometry
    else:
        M = None

# --- Step 2: Convert PL inputs to actual Polylines ---
polylines = []
for pl in PL:
    if isinstance(pl, rg.Polyline):
        polylines.append(pl)
    elif isinstance(pl, rg.PolylineCurve):
        polylines.append(pl.ToPolyline())
    else:
        obj = sc.doc.Objects.Find(pl)
        if obj is not None:
            geo = obj.Geometry
            if isinstance(geo, rg.Polyline):
                polylines.append(geo)
            elif isinstance(geo, rg.PolylineCurve):
                polylines.append(geo.ToPolyline())

# --- Step 3: Get naked edges of the mesh ---
naked_edges = []
if M:
    naked_edges = M.GetNakedEdges()

# --- Step 4: Filter polylines by checking all vertices ---
kept = []
removed = []
tolerance = 1e-6

for pl in polylines:
    all_on_boundary = True
    for i in range(pl.Count):
        pt = pl[i]
        if not any(pt.DistanceTo(naked_pt) < tolerance for edge in naked_edges for naked_pt in edge):
            all_on_boundary = False
            break
    if all_on_boundary:
        removed.append(pl)
    else:
        kept.append(pl)

# --- Step 5: Create the DataTree V ---
V = DataTree[object]()
for i, pl in enumerate(kept):
    path = GH_Path(i)
    for pt in pl:
        V.Add(pt, path)

Vr = DataTree[object]()
for i, pl in enumerate(removed):
    path = GH_Path(i)
    for pt in pl:
        Vr.Add(pt, path)
# --- Outputs ---
A = kept      # Interior polylines
B = removed   # Boundary polylines
# ---------- end py3_10 ----------
mem1d = Create1DMember(
    Curve=py3_10.A,
    Preview3dSection=False,
    x1=False,
    x2=False,
    xx1=False,
    xx2=False,
    y1=False,
    y2=False,
    yy1=False,
    yy2=False,
    z1=False,
    z2=False,
    zz1=False,
    zz2=False)
elemfrommem = CreateElementsFromMembers(Nodes_m=no, _1DMembers_m=mem1d, Tolerance=0.001, Unit="m")  # -> Nodes, _1DElements, _2DElements, _3DElements, GSAModel
obtaining_id_for_each_of_the_sublines = Python3Script(F=demesh_3.Faces, E1D=elemfrommem._1DElements)  # -> out, ID, eT; inputs F: list, E1D: list
# ---------- obtaining_id_for_each_of_the_sublines: Python ----------
##ID
ID=[]
for i in range(len(E1D)):
    ID.append(i+1+len(F))
print(ID)
## eT from documentation
eT=19
print(eT)
# ---------- end obtaining_id_for_each_of_the_sublines ----------
elem1dedit = Edit1DElement(
    Element1D=elemfrommem._1DElements,
    Number=obtaining_id_for_each_of_the_sublines.ID,
    Type=obtaining_id_for_each_of_the_sublines.eT,
    Preview3dSection=False)  # -> Element1D, Number, Line, Property, Group, Type, Offset, StartRelease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
spacer_properties = Python3Script(
    u_count=creata_points_for_polylines.u_count,
    v_count=creata_points_for_polylines.v_count,
    V=py3_10.V,
    ID=elem1dedit.Number,
    Tp=elem1dedit.Topology)  # -> out, spacer_main, spacer_formatted; inputs V: tree, ID: list, Tp: tree
# ---------- spacer_properties: Python ----------
import math as math
from Grasshopper import DataTree
from Grasshopper.Kernel.Data import GH_Path

#spacer main
spacer_main=[]
u_count=int(u_count)
v_count=int(v_count)
series=list(range(1,u_count+v_count+1-4))
for i in series:
    text="PROP_SPACER.2,{series},Spacer prop.{series},NO_RGB,0,GEODESIC,RATIO,1,1".format(series=i)
    spacer_main.append(text)
print(spacer_main)



#spacer formatted
## Getting the unique id for each line
property_number=[]
branch_length=[]
for i in range(V.BranchCount):
    branch_length.append(len(V.Branch(i)))

for i in range(1,u_count+1+v_count-4):
    j=1
    while j <(branch_length[i-1]):
        property_number.append(i)
        j=j+1
print(property_number)

## Geting the start and end node for each subline 
node_start = []
node_end = []
for i in range(Tp.BranchCount):
    path = Tp.Paths[i]
    branch = Tp.Branches[i]
    node_start.append(branch[0])
    node_end.append(branch[1])

## Formating Text for GSA
spacer_formatted=[]

for i in range(len(ID)):
    text="SET,EL.4,{id},,NO_RGB,SPACER,{no},1,{st},{en},0,0,NO_RLS,0,0,0,0,,3".format(id=ID[i],no=property_number[i],st=node_start[i],en=node_end[i])
    spacer_formatted.append(text)
print(len(spacer_formatted))
print(len(ID))
# ---------- end spacer_properties ----------

darc = DeconstructArc(Arc=py3_8.slanted_column_circle)  # -> BasePlane, Radius, Angle
vec_2 = VectorXYZ(XComponent=py3_8.slanted_column_y1, YComponent=0, ZComponent=py3_8.slanted_column_z)  # -> Vector, Length
vec_3 = VectorXYZ(XComponent=py3_8.slanted_column_y2, YComponent=0, ZComponent=py3_8.slanted_column_z)  # -> Vector, Length
vec_4 = VectorXYZ(XComponent=py3_8.slanted_column_y3, YComponent=0, ZComponent=0)  # -> Vector, Length
vec_5 = VectorXYZ(XComponent=py3_8.slanted_column_y4, YComponent=0, ZComponent=0)  # -> Vector, Length
vec_6 = VectorXYZ(XComponent=py3_8.cable_base_y1, YComponent=0, ZComponent=0)  # -> Vector, Length
vec_7 = VectorXYZ(XComponent=py3_8.cable_base_y2, YComponent=0, ZComponent=0)  # -> Vector, Length
mat_2 = CreateMaterial(Material_type="Steel", Design_Code="EN 1993-1-1:2005", Grade="S355")
py3_11 = Python3Script(N=py3_8.slanted_column, C=py3_8.slanted_column_circle, x="8", B=darc.BasePlane)  # -> out, a, b, c1, c2, d, e1, e2; inputs N: list, C: list, B: list
# ---------- py3_11: Python ----------
Seg=int(len(N)/len(C))
a,b,c1,c2,d,e1,e2=[],[],[],[],[],[],[]
Lin=Seg/8
for i in range(len(C)):
    for j in range(Seg-1):
        a.append(N[j+i*Seg])
        b.append(N[j+1+i*Seg])
        if j % Lin ==0:
            if i < len(C)/2:
                c1.append(B[i])
            else:
                c2.append(B[i])
            d.append(N[j+i*Seg])
    a.append(N[Seg-1+i*Seg])
    b.append(N[i*Seg])
    if (Seg-1) % Lin == 0:
        if i < C/2:
            c1.append(B[i])
        else:
            c2.append(B[i])
        d.append(N[Seg-1+i*Seg])
for i in range(len(B)):
    if i < len(B)/2:
        e1.append(B[i])
    else:
        e2.append(B[i])
B=B
# ---------- end py3_11 ----------
py3_12 = Python3Script(x=py3_8.slanted_column_cablebase)  # -> out, a1, a2; inputs x: list; same code as py3_9
vec_8 = VectorXYZ(XComponent=py3_8.slanted_colum_y5, YComponent=0, ZComponent=0)  # -> Vector, Length
vec_9 = VectorXYZ(XComponent=py3_8.slanted_colum_y6, YComponent=0, ZComponent=0)  # -> Vector, Length
move_2 = Move(Geometry=py3_9.a1, Motion=vec_6.Vector)  # -> Geometry, Transform
move_3 = Move(Geometry=py3_9.a2, Motion=vec_7.Vector)  # -> Geometry, Transform
darc_2 = DeconstructArc(Arc=py3_8.column_colum_circle)  # -> BasePlane, Radius, Angle
mat_3 = CreateMaterial(Material_type="Steel", Design_Code="EN 1993-1-1:2005", Grade="S355")
profile_2 = CreateProfile(
    Diameter_cm=py3_8.column_colum_bar_D,
    catalogueIndex=-1,
    inclSS=False,
    lengthUnit="Centimeter",
    mode="Other",
    Profile_type="Circle",
    Measure="cm",
    typeIndex=-1)
section = CreateSection(Profile=profile, Material=mat_2, Basic_Offset="Centroid")
support_4 = CreateSupport(Point=[move_2.Geometry, move_3.Geometry], Plane=PlaneXY(0, 0, 0), x=True, xx=False, y=True, yy=False, z=True, zz=False)
move_4 = Move(Geometry=py3_11.c1, Motion=vec_2.Vector)  # -> Geometry, Transform
move_5 = Move(Geometry=py3_11.c2, Motion=vec_3.Vector)  # -> Geometry, Transform
move_6 = Move(Geometry=py3_11.e1, Motion=vec_2.Vector)  # -> Geometry, Transform
move_7 = Move(Geometry=py3_11.e2, Motion=vec_3.Vector)  # -> Geometry, Transform
move_8 = Move(Geometry=py3_12.a1, Motion=vec_8.Vector)  # -> Geometry, Transform
move_9 = Move(Geometry=py3_12.a2, Motion=vec_9.Vector)  # -> Geometry, Transform
ln = Line(StartPoint=py3_11.a, EndPoint=py3_11.b)
ln_2 = Line(StartPoint=py3_8.cable_base, EndPoint=[move_2.Geometry, move_3.Geometry])
py3_13 = Python3Script(B=darc_2.BasePlane, C=py3_8.column_colum_circle, x="8", N=py3_8.column_colum)  # -> out, a, b, c, d, B; inputs B: list, C: list, N: list
# ---------- py3_13: Python ----------
Seg=int(len(N)/len(C))
a,b,c,d=[],[],[],[]
Lin=Seg/8
for i in range(len(C)):
    for j in range(Seg-1):
        a.append(N[j+i*Seg])
        b.append(N[j+1+i*Seg])
        if j % Lin ==0:
            c.append(B[i])
            d.append(N[j+i*Seg])
    a.append(N[Seg-1+i*Seg])
    b.append(N[i*Seg])
    if (Seg-1) % Lin == 0:
        c.append(B[i])
        d.append(N[Seg-1+i*Seg]) 
B=B
# ---------- end py3_13 ----------
mat_4 = CreateMaterial(Material_type="Steel", Design_Code="EN 1993-1-1:2005", Grade="S355")
profile_3 = CreateProfile(
    Diameter_cm=py3_8.slanted_colum_bar_D,
    catalogueIndex=-1,
    inclSS=False,
    lengthUnit="Centimeter",
    mode="Other",
    Profile_type="Circle",
    Measure="cm",
    typeIndex=-1)
section_2 = CreateSection(Profile=profile_2, Material=mat_3, Basic_Offset="Centroid")
elem1d = Create1DElement(Line=ln_2, Property=section, Preview3dSection=False)
move_10 = Move(Geometry=move_6.Geometry, Motion=vec_4.Vector)  # -> Geometry, Transform
move_11 = Move(Geometry=move_7.Geometry, Motion=vec_5.Vector)  # -> Geometry, Transform
ln_3 = Line(StartPoint=py3_13.a, EndPoint=py3_13.b)
ln_4 = Line(StartPoint=py3_13.c, EndPoint=py3_13.d)
pdecon = Deconstruct(Point=py3_13.B)  # -> XComponent, YComponent, ZComponent
ln_5 = Line(StartPoint=[move_4.Geometry, move_5.Geometry], EndPoint=py3_11.d)
pdecon_2 = Deconstruct(Point=[move_11.Geometry, move_10.Geometry])  # -> XComponent, YComponent, ZComponent
mat_5 = CreateMaterial(Material_type="Steel", Design_Code="EN 1993-1-1:2005", Grade="S355")
py3_14 = Python3Script(material_data=py3_8.column_colum_material)  # -> out, a, b
# ---------- py3_14: Python ----------
if material_data==1:
    a=1
    b=1
elif material_data==2:
    a=10
    b=10
elif material_data==3:
    a=10
    b=1
elif material_data==4:
    a=1
    b=10
# ---------- end py3_14 ----------
profile_4 = CreateProfile(
    Diameter_cm=py3_8.column_colum_col_D,
    catalogueIndex=-1,
    inclSS=False,
    lengthUnit="Centimeter",
    mode="Other",
    Profile_type="Circle",
    Measure="cm",
    typeIndex=-1)
section_3 = CreateSection(Profile=profile_3, Material=mat_4, Basic_Offset="Centroid")
support_5 = CreateSupport(Point=[move_9.Geometry, move_8.Geometry], Plane=PlaneXY(0, 0, 0), x=True, xx=False, y=True, yy=False, z=True, zz=False)
elem1dedit_2 = Edit1DElement(Element1D=elem1d, Type="10", Preview3dSection=False)  # -> Element1D, Number, Line, Property, Group, Type, Offset, StartRelease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
elem1d_2 = Create1DElement(Line=ln_3, Property=section_2, Preview3dSection=False)
elem1d_3 = Create1DElement(Line=ln_4, Property=section_2, Preview3dSection=False)
py3_15 = Python3Script(x=move_6.Geometry, y=move_7.Geometry)  # -> out, a; inputs x: list, y: list
# ---------- py3_15: Python ----------
a=[]
for i in range(len(x)):
    a.append(x[i])
    a.append(x[i])
for i in range(len(y)):
    a.append(y[i])
    a.append(y[i])
# ---------- end py3_15 ----------
py3_16 = Python3Script(x=move_8.Geometry, y=move_9.Geometry)  # -> out, a; inputs x: list, y: list
# ---------- py3_16: Python ----------
a=[]
a.append(x[0])
for i in range(int(len(x)-2)):
    a.append(x[i+1])
    a.append(x[i+1])
a.append(x[-1])

a.append(y[0])
for i in range(int(len(x)-2)):
    a.append(y[i+1])
    a.append(y[i+1])
a.append(y[-1])
# ---------- end py3_16 ----------
pt_6 = ConstructPoint(XCoordinate=pdecon.XComponent, YCoordinate=pdecon.YComponent, ZCoordinate=0)
pt_7 = ConstructPoint(XCoordinate=pdecon_2.XComponent, YCoordinate=pdecon_2.YComponent, ZCoordinate=0)
mat_6 = CreateMaterial(Material_type="Steel", Design_Code="EN 1993-1-1:2005", Grade="S355")
profile_5 = CreateProfile(
    Diameter_cm=py3_8.slanted_colum_col_D,
    catalogueIndex=-1,
    inclSS=False,
    lengthUnit="Centimeter",
    mode="Other",
    Profile_type="Circle",
    Measure="cm",
    typeIndex=-1)
section_4 = CreateSection(Profile=profile_4, Material=mat_5, Basic_Offset="Centroid")
support_6 = CreateSupport(Point=pt_6, Plane=PlaneXY(0, 0, 0), x=True, xx=True, y=True, yy=True, z=True, zz=True)
support_7 = CreateSupport(Point=pt_7, Plane=PlaneXY(0, 0, 0), x=True, xx=False, y=True, yy=False, z=True, zz=False)
ln_6 = Line(StartPoint=flatten([move_7.Geometry, move_6.Geometry]), EndPoint=flatten(pt_7))
ln_7 = Line(StartPoint=pt_6, EndPoint=py3_13.B)
ln_8 = Line(StartPoint=py3_15.a, EndPoint=py3_16.a)
section_5 = CreateSection(Profile=profile_5, Material=mat_6, Basic_Offset="Centroid")
elem1dedit_3 = Edit1DElement(Element1D=elem1d_2, Type=py3_14.a, Preview3dSection=False)  # -> Element1D, Number, Line, Property, Group, Type, Offset, StartRelease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
elem1dedit_4 = Edit1DElement(Element1D=elem1d_3, Type=py3_14.b, Preview3dSection=False)  # -> Element1D, Number, Line, Property, Group, Type, Offset, StartRelease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
elem1d_4 = Create1DElement(Line=ln_7, Property=section_4, Preview3dSection=False)
py3_17 = Python3Script(x=py3_8.slanted_column_material)  # -> out, a
# ---------- py3_17: Python ----------
if x == 5:
    a=1
else:
    a=10
# ---------- end py3_17 ----------
elem1d_5 = Create1DElement(Line=ln_6, Property=section_5, Preview3dSection=False)
elem1d_6 = Create1DElement(Line=ln, Property=section_3, Preview3dSection=False)
elem1d_7 = Create1DElement(Line=ln_5, Property=section_3, Preview3dSection=False)
elem1d_8 = Create1DElement(Line=ln_8, Property=section_3, Preview3dSection=False)
elem1dedit_5 = Edit1DElement(Element1D=flatten([elem1d_7, elem1d_8]), Type="10", Preview3dSection=False)  # -> Element1D, Number, Line, Property, Group, Type, Offset, StartRelease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
elem1dedit_6 = Edit1DElement(Element1D=elem1d_5, Type="1", Preview3dSection=False)  # -> Element1D, Number, Line, Property, Group, Type, Offset, StartRelease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
elem1dedit_7 = Edit1DElement(Element1D=elem1d_6, Type=py3_17.a, Preview3dSection=False)  # -> Element1D, Number, Line, Property, Group, Type, Offset, StartRelease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
gwa_4 = GWACommand(GSAModel=model, GWAString=flatten([spacer_properties.spacer_formatted, spacer_properties.spacer_main]))  # -> Model, ReturnedResult

# ---- group: Assigning Pre_stress
int_3 = Integer(merge_2)
py3_18 = Python3Script(Prestress_Data=int_3)  # -> out, prestress_2D, prestress_1D; inputs Prestress_Data: list
# ---------- py3_18: Python ----------
X_dir,Y_dir, Cable =Prestress_Data[0], Prestress_Data[1],Prestress_Data[2]
prestress_2D = "SOAP_STRESS_2D , 1 , 2D_prestress , {a} , {b}".format(a=X_dir,b=Y_dir)
X_dir,Y_dir, Cable =Prestress_Data[0], Prestress_Data[1],Prestress_Data[2]
prestress_1D = "SOAP_STRESS_1D , 1 , 1D_prestress , global , {c}".format(c=Cable)
print(prestress_2D)
print(prestress_1D)
# ---------- end py3_18 ----------

# ---- group: Creating Gravity Load
loadcase = CreateLoadCase(CaseID="1", Name="self_weight", Type="Dead")
gravityload = CreateGravityLoad(LoadCase=loadcase, LoadableObjects="all", Name="self_weight", GravityFactor=Vector(0, 0, -1))

# ---- group: Creating AnalysisTask
σa = CreateAnalysisCase(Name="Form", Description="L1")
σt = CreateAnalysisTask(TaskID="1", Name="form_finding", AnalysisCases=σa, casesParamIndex=2, Solver="Static")

# ----
model_2 = CreateModel(
    ModelSListsAndGridLines=gwa_4.Model,
    GSAGeometryIn_m=flatten([support_3, support_2]),
    ReMesh=True,
    Tolerance=0.01,
    Unit="m")
gwa_5 = GWACommand(GSAModel=model_2, GWAString=flatten([py3_18.prestress_2D, py3_18.prestress_1D]))  # -> Model, ReturnedResult
model_3 = CreateModel(
    ModelSListsAndGridLines=gwa_5.Model,
    Load=gravityload,
    AnalysisTasksCombinations=σt,
    ReMesh=True,
    Tolerance=0.01,
    Unit="m")
save = SaveGSAModel(GSAModel=model_3, Save=True)
getgeo = GetModelGeometry(GSAModel=model_3, Mode=1, Unit="m")  # -> NodesIn_m, _1DElementsIn_m, _2DElementsIn_m, _3DElementsIn_m, _1DMembersIn_m, _2DMembersIn_m, _3DMembersIn_m, Assemblies
