# Grasshopper definition Iteration_4_Grashopper.gh (Grasshopper 1.0.8)
# plug-ins: GSA

# ---- group: Geometry Data
lenght = Slider(300, range=0..1000)
width = Slider(120, range=0..1000)
distance_between_edge_and_columns = Slider(10, range=0..100)
number_of_columns = Slider(10, range=0..20)
height_of_columns = Slider(10, range=0..100)
hole_radius = Slider(3, range=0..10)
merge = Merge(
    Data1=lenght,
    Data2=width,
    Data3=distance_between_edge_and_columns,
    Data4=number_of_columns,
    Data5=height_of_columns,
    Data6=hole_radius)

# ---- group: Presstress
prestress_xdir_kn_m = Slider(30, range=0..500)
prestress_ydir_kn_m = Slider(30, range=0..500)
prestress_cables_kn = Slider(300, range=0..500)
merge_2 = Merge(Data1=prestress_xdir_kn_m, Data2=prestress_ydir_kn_m, Data3=prestress_cables_kn)

# ---- group: Fabric Properties
analysis_number = Panel("101")
material_number = Panel("11")
fabric_name = Panel("Fabric x")
warp_strenght_kn_m = Panel("1000")
weave_strenght_kn_m = Panel("500")
poisson_s_ratio = Panel("0.3")
shear_modulus_kn_m = Panel("40")
density_tonnes_m_2 = Panel("0.01")
limit_strain = Panel("1000")
merge_3 = Merge(
    Data1=analysis_number,
    Data2=material_number,
    Data3=fabric_name,
    Data4=warp_strenght_kn_m,
    Data5=weave_strenght_kn_m,
    Data6=poisson_s_ratio,
    Data7=shear_modulus_kn_m,
    Data8=density_tonnes_m_2,
    Data9=limit_strain)

# ---- group: Cable Data
diameter_m = Panel("0.1")

# ----
analysis_number_2 = Panel("101")
material_number_2 = Panel("11")
fabric_name_2 = Panel("Fabric x")
warp_strenght_kn_m_2 = Panel("1000")
weave_strenght_kn_m_2 = Panel("500")
poisson_s_ratio_2 = Panel("0.3")
shear_modulus_kn_m_2 = Panel("40")
density_tonnes_m_2_2 = Panel("0.01")
limit_strain_2 = Panel("1000")
merge_4 = Merge(
    Data1=analysis_number_2,
    Data2=material_number_2,
    Data3=fabric_name_2,
    Data4=warp_strenght_kn_m_2,
    Data5=weave_strenght_kn_m_2,
    Data6=poisson_s_ratio_2,
    Data7=shear_modulus_kn_m_2,
    Data8=density_tonnes_m_2_2,
    Data9=limit_strain_2)

material = CreateCustomMaterial(
    AnalysisPropertyNumber=material_number_2,
    MaterialName=fabric_name_2,
    ElasticModulus_MPa=warp_strenght_kn_m_2,
    PoissonsRatio=poisson_s_ratio_2,
    Density_kg_m³=density_tonnes_m_2_2,
    Material_Type="Fabric",
    Stress_Unit="MPa",
    Density_Unit="kg/m³",
    Temperature_Unit="°C")

# ---- group: Material Creation
txt = Text(merge_4)  # disabled
analysis_properties = Python3Script(fabric_data=txt)  # -> out, mat_anal; inputs fabric_data: list
# ---------- analysis_properties: Python ----------
Id,num,name,Ex,Ey,nu,G,rho,eps=fabric_data[0],fabric_data[1],fabric_data[2],fabric_data[3],fabric_data[2],fabric_data[5],fabric_data[6],fabric_data[7],fabric_data[8]
mat_anal="MAT_ANAL, {Id} , MAT_FABRIC , {name} , NO_RGB , 4 , {Ex} , {Ey} , {nu} , {G} , 1 , ".format(Id=Id,num=num,name=name, Ex=Ex, Ey=Ey,nu=nu,G=G,rho=rho,eps=eps)
print(mat_anal)
# ---------- end analysis_properties ----------
creating_material = Python3Script(fabric_data=txt)  # -> out, mat; inputs fabric_data: list
# ---------- creating_material: Python ----------
Id,num,name,Ex,Ey,nu,G,rho,eps=fabric_data[0],fabric_data[1],fabric_data[2],fabric_data[3],fabric_data[2],fabric_data[5],fabric_data[6],fabric_data[7],fabric_data[8]
mat="MAT.11 , {num} , {name} , {Ex} , {Ex} , {nu} , {G} , {rho} , 0 , {Id} , 0 (,  ,  ,  ,) 0 (,  ,  ,  ,) 0 (,  ,  ,  ,)  (,  ,  ,  ,) {eps} ,  ,  , 0 , FABRIC , FALSE , ".format(Id=Id,num=num,name=name, Ex=Ex, Ey=Ey,nu=nu,G=G,rho=rho,eps=eps)
print(mat)
# ---------- end creating_material ----------
gwa = GWACommand(GWAString=analysis_properties.mat_anal)  # -> Model, ReturnedResult
creating_material_2 = Python3Script(fabric_data=txt)  # -> out, mat_fabric; inputs fabric_data: list
# ---------- creating_material_2: Python ----------
Id,num,name,Ex,Ey,nu,G,rho,eps=fabric_data[0],fabric_data[1],fabric_data[2],fabric_data[3],fabric_data[2],fabric_data[5],fabric_data[6],fabric_data[7],fabric_data[8]
mat_fabric="SET, MAT_FABRIC , 1 , {num}".format(Id=Id,num=num,name=name, Ex=Ex, Ey=Ey,nu=nu,G=G,rho=rho,eps=eps)
print(mat_fabric)
# ---------- end creating_material_2 ----------
gwa_2 = GWACommand(GSAModel=gwa.Model, GWAString=creating_material.mat)  # -> Model, ReturnedResult
gwa_3 = GWACommand(GSAModel=gwa_2.Model, GWAString=creating_material_2.mat_fabric)  # -> Model, ReturnedResult
getmats = GetModelMaterials(GSAModel=gwa_3.Model)  # -> Steel, Concrete, PMat, Aluminium, Timber, Glass, Fabric, Custom

# ----
vec = VectorXYZ(XComponent="-10", YComponent=0, ZComponent="7.5")  # -> Vector, Length
vec_2 = VectorXYZ(XComponent="10", YComponent=0, ZComponent="7.5")  # -> Vector, Length

# ---- group: Assigning Pre_stress
int = Integer(merge_2)
py3 = Python3Script(Prestress_Data=int)  # -> out, prestress_2D, prestress_1D; inputs Prestress_Data: list
# ---------- py3: Python ----------
X_dir,Y_dir, Cable =Prestress_Data[0], Prestress_Data[1],Prestress_Data[2]
prestress_2D = "SOAP_STRESS_2D , 1 , 2D_prestress , {a} , {b}".format(a=X_dir,b=Y_dir)
X_dir,Y_dir, Cable =Prestress_Data[0], Prestress_Data[1],Prestress_Data[2]
prestress_1D = "SOAP_STRESS_1D , 1 , 1D_prestress , local , {c}".format(c=Cable)
print(prestress_2D)
print(prestress_1D)
# ---------- end py3 ----------

# ---- group: Creating Gravity Load
loadcase = CreateLoadCase(CaseID="1", Name="self_weight", Type="Dead")
gravityload = CreateGravityLoad(LoadCase=loadcase, LoadableObjects="all", Name="self_weight", GravityFactor=Vector(0, 0, -1))

# ---- group: Creating AnalysisTask
σa = CreateAnalysisCase(Name="Form", Description="L1")
σt = CreateAnalysisTask(TaskID="1", Name="form_finding", AnalysisCases=σa, casesParamIndex=2, Solver="Static")

# ----
int_2 = Integer(merge)
py3_2 = Python3Script(Geometric_Data=int_2)  # -> out, X, Y, x, y, Radius, Danger_zone, a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; inputs Geometric_Data: list
# ---------- py3_2: Python ----------
lenght,width,distance_col,number_col,height_col,Radius=int(Geometric_Data[0]),int(Geometric_Data[1]),Geometric_Data[2],Geometric_Data[3],Geometric_Data[4],Geometric_Data[5]+0.01
Danger_zone=Radius+0.5
nodes_side=number_col*2
Y=lenght
X=width
height=height_col
x,y=[],[]
for i in range(nodes_side+1):
    if i%2 ==0:
        nada=("nada")
    else:
        x.append(distance_col)
        y_point=(lenght/nodes_side)*i
        y.append(y_point)
for i in range(nodes_side+1):
    if i%2 ==0:
        nada=("nada")
    else:
        x.append(width-distance_col)
        y_point=(lenght/nodes_side)*i
        y.append(y_point)
a,b,c=[],[],[]
for i in range(nodes_side+1):
        a.append(0)
        y_point=(lenght/nodes_side)*i
        b.append(y_point)
        c.append(0)
for i in range(nodes_side+1):
        a.append(width)
        y_point=(lenght/nodes_side)*i
        b.append(y_point)
        c.append(0)
# ---------- end py3_2 ----------
py3_3 = Python3Script(x=py3_2.x, y=py3_2.y, R=py3_2.Radius)  # -> out, X, Y; inputs x: list, y: list
# ---------- py3_3: Python ----------
X,Y=[],[]
for i in range(len(x)):
    X.append("{} to {}".format(x[i]-R,x[i]+R))
    Y.append("{} to {}".format(y[i]-R,y[i]+R))
print(X)
# ---------- end py3_3 ----------
pt = ConstructPoint(XCoordinate=py3_2.a, YCoordinate=py3_2.b, ZCoordinate=py3_2.c)
planesrf = PlaneSurface(Plane=PlaneXY(0, 0, 0), XSize=py3_2.X, YSize=py3_2.Y)
rectangle = Rectangle(Plane=PlaneXY(0, 0, 0), XSize=py3_3.X, YSize=py3_3.Y, Radius=0)  # -> Rectangle, Length
sdiff = SolidDifference(BrepsA=planesrf, BrepsB=flatten(rectangle.Rectangle))
multiplication = Multiplication(A=py3_2.X, B="1")
multiplication_2 = Multiplication(A="1", B=py3_2.Y)
py3_4 = Python3Script(x=py3_2.x, y=py3_2.y, R=py3_2.Danger_zone)  # -> out, X, Y; inputs x: list, y: list; same code as py3_3
mesh_uv = MeshSurface(Surface=sdiff, UCount=multiplication, VCount=multiplication_2, Overhang=True, Equalize=False)
pt_2 = ConstructPoint(XCoordinate=py3_2.x, YCoordinate=py3_2.y, ZCoordinate=0)
vec_3 = VectorXYZ(XComponent=0, YComponent=0, ZComponent=py3_2.height)  # -> Vector, Length
demesh = DeconstructMesh(Mesh=mesh_uv)  # -> Vertices, Faces, Colours, Normals
circle = CircleCNR(Center=pt_2, Normal=Vector(0, 0, 1), Radius=py3_2.Radius)
rectangle_2 = Rectangle(Plane=PlaneXY(0, 0, 0), XSize=py3_4.X, YSize=py3_4.Y, Radius=0)  # -> Rectangle, Length
incurve = PointInCurve(Point=demesh.Vertices, Curve=graft(rectangle_2.Rectangle))  # -> Relationship, Point
py3_5 = Python3Script(R=incurve.Relationship)  # -> out, a; inputs R: tree
# ---------- py3_5: Python ----------
from Grasshopper import DataTree
from Grasshopper.Kernel.Data import GH_Path

# R = input tree
# Collect all branches
branches = [list(R.Branch(i)) for i in range(R.BranchCount)]

# Transpose: element-wise grouping across branches
transposed = zip(*branches)

result = []
for group in transposed:
    vals = set(group)
    if vals == {0}:
        result.append(0)
    elif 2 in vals:
        result.append(2)
    else:
        result.append(1)

a = result  # flat list output
print(a)
# ---------- end py3_5 ----------
py3_6 = Python3Script(R=py3_5.a, P=demesh.Vertices, C=circle)  # -> out, Pt, Seg; inputs R: list, P: list, C: list
# ---------- py3_6: Python ----------
Pt =[]
for i in range(len(R)):
    if R[i] in [1,2]:
        Pt.append(P[i])
print(Pt)
Seg=len(Pt)/len(C)
# ---------- end py3_6 ----------
divide = DivideCurve(Curve=circle, Count=py3_6.Seg, Kinks=False)  # -> flatten(Points), Tangents, Parameters
py3_7 = Python3Script(A=py3_6.Pt, B=divide.Points)  # -> out, ClosestB; inputs A: list of Point3d, B: list of Point3d
# ---------- py3_7: Python ----------
# requirements: numpy
# requirements: scipy

import Rhino.Geometry as rg
import numpy as np
from scipy.optimize import linear_sum_assignment

# Convert input points to Point3d
A_pts = [pt.Location if hasattr(pt, "Location") else pt for pt in A]
B_pts = [pt.Location if hasattr(pt, "Location") else pt for pt in B]

# Make distance matrix
dist_matrix = np.zeros((len(A_pts), len(B_pts)))
for i, a in enumerate(A_pts):
    for j, b in enumerate(B_pts):
        dist_matrix[i, j] = a.DistanceTo(b)

# Solve assignment problem
row_ind, col_ind = linear_sum_assignment(dist_matrix)

# Output corresponding B points
ClosestB = [B_pts[j] for j in col_ind]
# ---------- end py3_7 ----------
move = Move(Geometry=py3_7.ClosestB, Motion=vec_3.Vector)  # -> Geometry, Transform
mat = CreateMaterial(Material_type="Fabric", Grade="Taconic Solus 1410")
prop2d = Create2DProperty(Material=mat, Type="Fabric")

multiplication_3 = Multiplication(A=py3_2.Radius, B=-1)
py3_8 = Python3Script(x=py3_2.X, y=py3_2.Y, R="0.5")  # -> out, X, Y
# ---------- py3_8: Python ----------
X,Y=[],[]
R=float(R)
X.append("{} to {}".format(-R,x+R))
Y.append("{} to {}".format(-R,R))
X.append("{} to {}".format(-R,x+R))
Y.append("{} to {}".format(y-R,y+R))
print(X)
print(Y)
# ---------- end py3_8 ----------
vec_4 = VectorXYZ(XComponent=multiplication_3, YComponent=0, ZComponent=0)  # -> Vector, Length
vec_5 = VectorXYZ(XComponent=py3_2.Radius, YComponent=0, ZComponent=0)  # -> Vector, Length
move_2 = Move(Geometry=pt_2, Motion=vec_3.Vector)  # -> Geometry, Transform
rectangle_3 = Rectangle(Plane=PlaneXY(0, 0, 0), XSize=py3_8.X, YSize=py3_8.Y, Radius=0)  # -> Rectangle, Length
move_3 = Move(Geometry=move_2.Geometry, Motion=vec_5.Vector)  # -> Geometry, Transform
move_4 = Move(Geometry=move_2.Geometry, Motion=vec_4.Vector)  # -> Geometry, Transform
incurve_2 = PointInCurve(Point=demesh.Vertices, Curve=graft(rectangle_3.Rectangle))  # -> Relationship, Point
py3_9 = Python3Script(x=py3_2.X, y=py3_2.Y)  # -> out, a, b
# ---------- py3_9: Python ----------
import rhinoscriptsyntax as rs
a,b=[],[]
a.append(rs.CreatePoint(0, 0))
a.append(rs.CreatePoint(0, y))
b.append(rs.CreatePoint(x, 0))
b.append(rs.CreatePoint(x, y))
# ---------- end py3_9 ----------
py3_10 = Python3Script(R=incurve_2.Relationship)  # -> out, a; inputs R: tree; same code as py3_5
bzspan = BezierSpan(StartPoint=py3_9.a, StartTangent=vec_2.Vector, EndPoint=py3_9.b, EndTangent=vec.Vector)  # -> Curve, Length, Domain
py3_11 = Python3Script(R=py3_10.a, P=demesh.Vertices, C=bzspan.Curve)  # -> out, Pt, Seg; inputs R: list, P: list, C: list
# ---------- py3_11: Python ----------
Pt =[]
for i in range(len(R)):
    if R[i] in [1,2]:
        Pt.append(P[i])
print(Pt)
Seg=len(Pt)/len(C)-1
# ---------- end py3_11 ----------
divide_2 = DivideCurve(Curve=bzspan.Curve, Count=py3_11.Seg, Kinks=False)  # -> flatten(Points), Tangents, Parameters
py3_12 = Python3Script(A=py3_11.Pt, B=divide_2.Points)  # -> out, ClosestB; inputs A: list of Point3d, B: list of Point3d; same code as py3_7

py3_13 = Python3Script(R1=py3_5.a, P=demesh.Vertices, G1=move.Geometry, R2=py3_10.a, G2=py3_12.ClosestB)  # -> out, V; inputs R1: list, P: list, G1: list, R2: list, G2: list
# ---------- py3_13: Python ----------
V=[]
c=0
d=0
for i in range(len(P)):
    if R1[i] in [2,1]:
        V.append(G1[c])
        c=c+1
    elif R2[i] in [2,1]:
        V.append(G2[d])
        d=d+1
    else:
        V.append(P[i])

print(c)
print(d)
# ---------- end py3_13 ----------
conmesh = ConstructMesh(Vertices=py3_13.V, Faces=demesh.Faces)
msmooth = SmoothMesh(Mesh=conmesh, Strength=0.5, SkipNaked=True, Iterations="10000")
demesh_2 = DeconstructMesh(Mesh=msmooth)  # -> Vertices, Faces, Colours, Normals
support = CreateSupport(Point=demesh_2.Vertices, Plane=PlaneXY(0, 0, 0), x=False, xx=False, y=False, yy=False, z=False, zz=False)
elem2d = Create2DElement(Geometry=msmooth, Property2D=prop2d, Preview3dSection=False)

support_2 = CreateSupport(Point=flatten([pt, move.Geometry]), Plane=PlaneXY(0, 0, 0), x=True, xx=False, y=True, yy=False, z=True, zz=False)
support_3 = CreateSupport(Point=flatten(py3_12.ClosestB), Plane=PlaneXY(0, 0, 0), x=True, xx=False, y=True, yy=False, z=False, zz=False)
model = CreateModel(GSAGeometryIn_m=flatten([elem2d, support]), ReMesh=False, Tolerance=0.01, Unit="m")

pt_3 = Point(move.Geometry)
no = Node(support)
mesh = Mesh(msmooth)
demesh_3 = DeconstructMesh(Mesh=mesh)  # -> Vertices, Faces, Colours, Normals
cp = ClosestPoint(Point=pt_3, Cloud=demesh_3.Vertices)  # -> ClosestPoint, CPIndex, Distance
deface = DeconstructFace(Face=demesh_3.Faces)  # -> CornerA, CornerB, CornerC, CornerD
creata_points_for_polylines = Python3Script(V=demesh_3.Vertices, A=deface.CornerA, B=deface.CornerB, C=deface.CornerC, D=deface.CornerD, P=cp.CPIndex)  # -> out, u_count, v_count, V; inputs V: list, A: list, B: list, C: list, D: list, P: list
# ---------- creata_points_for_polylines: Python ----------
from Grasshopper import DataTree
from Grasshopper.Kernel.Data import GH_Path
from System import Object

def unique_preserve_order_iter(iterable):
    """Yield unique items from an iterable, preserving order."""
    seen = set()
    for item in iterable:
        if item not in seen:
            seen.add(item)
            yield item

def build_layer_paths(V, index_sets, P):
    """
    V: list of node values
    index_sets: list of tuples [(start_a, end_a, start_b, end_b), ...] for each layer
    P: list of indices -> segments where both start and end indices are in P will be removed
    
    Returns:
        all_paths: combined paths from all layers
        layer_counts: list of counts per layer
    """
    all_paths = []
    layer_counts = []

    for layer_num, (start_a, end_a, start_b, end_b) in enumerate(index_sets):
        # Merge start and end indices
        start_indices = start_a + start_b
        end_indices   = end_a + end_b

        # Build segments (indices) and filter out those where both ends are in P
        raw_segments = list(zip(start_indices, end_indices))
        segments = [(s, e) for s, e in raw_segments if not (s in P and e in P)]
        removed_segments = [seg for seg in raw_segments if seg not in segments]

        if removed_segments:
            print(f"Layer {layer_num+1} - removed segments (both ends in P): {removed_segments}")

        # Convert remaining segments to actual node values
        start = [V[i] for i, _ in segments]
        end   = [V[j] for _, j in segments]

        start_to_segment = {s: (s, e) for s, e in zip(start, end)}
        unvisited = set(start_to_segment.keys())
        layer_paths = []

        # Root nodes: start nodes not appearing as ends
        end_set = set(end)
        root_nodes = [s for s in start if s not in end_set]

        def traverse(root):
            path = []
            current = root
            while current in unvisited:
                if current not in start_to_segment:  # Segment removed → stop path
                    path.append(current)
                    break
                s, e = start_to_segment[current]
                path.append(s)
                unvisited.remove(current)
                current = e
                if current in path:  # Avoid cycles
                    path.append(current)
                    break
            if path and current not in path:
                path.append(current)
            return path

        # Traverse paths from roots
        for root in root_nodes:
            path = traverse(root)
            if path:
                layer_paths.append(path)

        # Traverse any remaining unvisited segments
        while unvisited:
            root = next(iter(unvisited))
            path = traverse(root)
            if path:
                layer_paths.append(path)

        all_paths.extend(layer_paths)
        layer_counts.append(len(layer_paths))  # Count for this layer

    return all_paths, layer_counts


# ----------------------------------------------------
# MAIN EXECUTION (Grasshopper inputs expected: V, A, B, C, D, P)
# ----------------------------------------------------

# Explicit segment assignments (indices)
# L1: C->B, D->A
# L2: D->C, A->B
layers = [
    (C, B, D, A),  # L1
    (D, C, A, B)   # L2
]

all_paths, layer_counts = build_layer_paths(V, layers, P)
u_count, v_count = layer_counts  # counts per layer

# Create Grasshopper DataTree
data_tree = DataTree[Object]()
for i, sublist in enumerate(all_paths):
    path = GH_Path(i)
    for item in sublist:
        data_tree.Add(item, path)

V = data_tree
# ---------- end creata_points_for_polylines ----------
pline = PolyLine(Vertices=creata_points_for_polylines.V, Closed=False)  # -> flatten(Polyline)
py3_14 = Python3Script(M_in=mesh, PL=pline)  # -> out, A, B, V, Vr; inputs PL: list
# ---------- py3_14: Python ----------
import Rhino
import Rhino.Geometry as rg
import scriptcontext as sc
from Grasshopper import DataTree
from Grasshopper.Kernel.Data import GH_Path

# Inputs
# M_in : Mesh object or GUID
# PL   : List of polylines

# --- Step 1: Ensure we have a Mesh object ---
if isinstance(M_in, rg.Mesh):
    M = M_in
else:
    obj = sc.doc.Objects.Find(M_in)
    if obj is not None:
        M = obj.Geometry
    else:
        M = None

# --- Step 2: Convert PL inputs to actual Polylines ---
polylines = []
for pl in PL:
    if isinstance(pl, rg.Polyline):
        polylines.append(pl)
    elif isinstance(pl, rg.PolylineCurve):
        polylines.append(pl.ToPolyline())
    else:
        obj = sc.doc.Objects.Find(pl)
        if obj is not None:
            geo = obj.Geometry
            if isinstance(geo, rg.Polyline):
                polylines.append(geo)
            elif isinstance(geo, rg.PolylineCurve):
                polylines.append(geo.ToPolyline())

# --- Step 3: Get naked edges of the mesh ---
naked_edges = []
if M:
    naked_edges = M.GetNakedEdges()

# --- Step 4: Filter polylines by checking all vertices ---
kept = []
removed = []
tolerance = 1e-6

for pl in polylines:
    all_on_boundary = True
    for i in range(pl.Count):
        pt = pl[i]
        if not any(pt.DistanceTo(naked_pt) < tolerance for edge in naked_edges for naked_pt in edge):
            all_on_boundary = False
            break
    if all_on_boundary:
        removed.append(pl)
    else:
        kept.append(pl)

# --- Step 5: Create the DataTree V ---
V = DataTree[object]()
for i, pl in enumerate(kept):
    path = GH_Path(i)
    for pt in pl:
        V.Add(pt, path)

# --- Step 5: Create the DataTree Vr ---
Vr = DataTree[object]()
for i, pl in enumerate(removed):
    path = GH_Path(i)
    for pt in pl:
        Vr.Add(pt, path)

# --- Outputs ---
A = kept      # Interior polylines
B = removed   # Boundary polylines
# ---------- end py3_14 ----------
mem1d = Create1DMember(
    Curve=py3_14.A,
    Preview3dSection=False,
    x1=False,
    x2=False,
    xx1=False,
    xx2=False,
    y1=False,
    y2=False,
    yy1=False,
    yy2=False,
    z1=False,
    z2=False,
    zz1=False,
    zz2=False)
elemfrommem = CreateElementsFromMembers(Nodes_m=no, _1DMembers_m=mem1d, Tolerance=0.001, Unit="m")  # -> Nodes, _1DElements, _2DElements, _3DElements, GSAModel
obtaining_id_for_each_of_the_sublines = Python3Script(F=demesh_3.Faces, E1D=elemfrommem._1DElements)  # -> out, ID, eT; inputs F: list, E1D: list
# ---------- obtaining_id_for_each_of_the_sublines: Python ----------
##ID
ID=[]
for i in range(len(E1D)):
    ID.append(i+1+len(F))
print(ID)
## eT from documentation
eT=19
print(eT)
# ---------- end obtaining_id_for_each_of_the_sublines ----------
elem1dedit = Edit1DElement(
    Element1D=elemfrommem._1DElements,
    Number=obtaining_id_for_each_of_the_sublines.ID,
    Type=obtaining_id_for_each_of_the_sublines.eT,
    Preview3dSection=False)  # -> Element1D, Number, Line, Property, Group, Type, Offset, StartRelease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
spacer_properties = Python3Script(
    u_count=creata_points_for_polylines.u_count,
    v_count=creata_points_for_polylines.v_count,
    V=py3_14.V,
    ID=elem1dedit.Number,
    Tp=elem1dedit.Topology)  # -> out, spacer_main, spacer_formatted; inputs V: tree, ID: list, Tp: tree
# ---------- spacer_properties: Python ----------
import math as math
from Grasshopper import DataTree
from Grasshopper.Kernel.Data import GH_Path

#spacer main
spacer_main=[]
u_count=int(u_count)
v_count=int(v_count)
series=list(range(1,u_count+v_count+1-4))
for i in series:
    text="PROP_SPACER.2,{series},Spacer prop.{series},NO_RGB,0,GEODESIC,RATIO,1,1".format(series=i)
    spacer_main.append(text)
print(spacer_main)



#spacer formatted
## Getting the unique id for each line
property_number=[]
branch_length=[]
for i in range(V.BranchCount):
    branch_length.append(len(V.Branch(i)))

for i in range(1,u_count+1+v_count-4):
    j=1
    while j <(branch_length[i-1]):
        property_number.append(i)
        j=j+1
print(property_number)

## Geting the start and end node for each subline 
node_start = []
node_end = []
for i in range(Tp.BranchCount):
    path = Tp.Paths[i]
    branch = Tp.Branches[i]
    node_start.append(branch[0])
    node_end.append(branch[1])

## Formating Text for GSA
spacer_formatted=[]

for i in range(len(ID)):
    text="SET,EL.4,{id},,NO_RGB,SPACER,{no},1,{st},{en},0,0,NO_RLS,0,0,0,0,,3".format(id=ID[i],no=property_number[i],st=node_start[i],en=node_end[i])
    spacer_formatted.append(text)
print(len(spacer_formatted))
print(len(ID))
# ---------- end spacer_properties ----------

relay = Relay([pt, move_3.Geometry, move_4.Geometry])

no_2 = Node(support)
pt_4 = Point(relay)
num = Number(diameter_m)
py3_15 = Python3Script(V=creata_points_for_polylines.V, Pt=pt_4)  # -> out, P; inputs V: tree of Point3d, Pt: list of Point3d
# ---------- py3_15: Python ----------
from Grasshopper import DataTree
from Grasshopper.Kernel.Data import GH_Path

# Create a new DataTree
P = DataTree[object]()

# Counter for the new tree path
branch_index = 0

for i in range(V.BranchCount):
    branch = V.Branch(i)
    start_node = branch[0]
    for j in range(len(branch)):
        if j+1 == len(branch):
            end_node=branch[j]

    # Check if start_node is in start list and end_node is in end list
    if any(start_node.DistanceTo(s) < 1e-6 for s in Pt) and any(end_node.DistanceTo(e) < 1e-6 for e in Pt):
        path = GH_Path(branch_index)  # Create a new branch path
        for pt in branch:
            P.Add(pt, path)      # Add each point to this path
        branch_index += 1             # Increment path index for next branch

# Output the tree
print(P)
# ---------- end py3_15 ----------
pline_2 = PolyLine(Vertices=py3_15.P, Closed=False)  # -> flatten(Polyline)
mem1d_2 = Create1DMember(
    Curve=flatten(pline_2),
    Preview3dSection=False,
    x1=False,
    x2=False,
    xx1=False,
    xx2=False,
    y1=False,
    y2=False,
    yy1=False,
    yy2=False,
    z1=False,
    z2=False,
    zz1=False,
    zz2=False)
profile = CreateProfile(
    Diameter_cm=num,
    catalogueIndex=-1,
    inclSS=False,
    lengthUnit="Centimeter",
    mode="Other",
    Profile_type="Circle",
    Measure="cm",
    typeIndex=-1)
mat_2 = CreateMaterial(Material_type="Steel", Design_Code="EN 1993-1-1:2005", Grade="S355")
elemfrommem_2 = CreateElementsFromMembers(Nodes_m=no_2, _1DMembers_m=mem1d_2, Tolerance=0.001, Unit="m")  # -> Nodes, _1DElements, _2DElements, _3DElements, GSAModel
section = CreateSection(Profile=profile, Material=mat_2, Basic_Offset="Centroid")
obtaining_id_for_each_of_the_sublines_2 = Python3Script(F=obtaining_id_for_each_of_the_sublines.ID, E1D=elemfrommem_2._1DElements)  # -> out, ID, eT; inputs F: list, E1D: list
# ---------- obtaining_id_for_each_of_the_sublines_2: Python ----------
##ID
ID=[]
for i in range(len(E1D)):
    ID.append(i+1+F[-1])
print(ID)
## eT from documentation
eT=21
print(eT)
# ---------- end obtaining_id_for_each_of_the_sublines_2 ----------
elem1dedit_2 = Edit1DElement(
    Element1D=elemfrommem_2._1DElements,
    Number=obtaining_id_for_each_of_the_sublines_2.ID,
    Property=section,
    Type=obtaining_id_for_each_of_the_sublines_2.eT,
    Preview3dSection=False)  # -> Element1D, Number, Line, Property, Group, Type, Offset, StartRelease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

gwa_4 = GWACommand(GSAModel=model, GWAString=flatten([spacer_properties.spacer_formatted, spacer_properties.spacer_main]))  # -> Model, ReturnedResult
relay_2 = Relay([support_2, support_3])
model_2 = CreateModel(
    ModelSListsAndGridLines=gwa_4.Model,
    GSAGeometryIn_m=flatten(elem1dedit_2.Element1D),
    ReMesh=True,
    Tolerance=0.01,
    Unit="m")
model_3 = CreateModel(ModelSListsAndGridLines=model_2, GSAGeometryIn_m=flatten(relay_2), ReMesh=True, Tolerance=0.01, Unit="m")
gwa_5 = GWACommand(GSAModel=model_3, GWAString=flatten([py3.prestress_2D, py3.prestress_1D]))  # -> Model, ReturnedResult
model_4 = CreateModel(
    ModelSListsAndGridLines=gwa_5.Model,
    Load=gravityload,
    AnalysisTasksCombinations=σt,
    ReMesh=True,
    Tolerance=0.01,
    Unit="m")
getgeo = GetModelGeometry(GSAModel=model_4, Mode=1, Unit="m")  # -> NodesIn_m, _1DElementsIn_m, _2DElementsIn_m, _3DElementsIn_m, _1DMembersIn_m, _2DMembersIn_m, _3DMembersIn_m, Assemblies
save = SaveGSAModel(GSAModel=model_4, Save=True)
