# Grasshopper definition Iteration_7_Grashopper.gh (Grasshopper 1.0.8)
# plug-ins: GSA

# ---- group: Geometry Data
lenght = Slider(300, range=0..1000)
width = Slider(130, range=0..1000)
number_of_columns = Slider(10, range=0..20)
height_of_columns = Slider(10, range=0..100)
hole_radius = Slider(3, range=0..10)
distance_between_edge_and_columns = Slider(10, range=0..100)
merge = Merge(
    Data1=lenght,
    Data2=width,
    Data3=distance_between_edge_and_columns,
    Data4=number_of_columns,
    Data5=height_of_columns,
    Data6=hole_radius)

# ---- group: Presstress
prestress_xdir_n_m = Slider(30, range=0..500)
prestress_ydir_n_m = Slider(30, range=0..500)
prestress_cables_kn = Slider(5, range=0..1000)
merge_2 = Merge(Data1=prestress_xdir_n_m, Data2=prestress_ydir_n_m, Data3=prestress_cables_kn)

# ---- group: Fabric Properties
material_number = Panel("1")
poisson_s_ratio = Panel("0.3")
fabric_name = Panel("Fabric x")
warp_strenght_kn_m = Panel("1000")
weave_strenght_kn_m = Panel("650")
shear_modulus_kn_m = Panel("40")
density_tonnes_m_2 = Panel("0.01")
merge_3 = Merge(
    Data1=material_number,
    Data2=fabric_name,
    Data3=warp_strenght_kn_m,
    Data4=weave_strenght_kn_m,
    Data5=poisson_s_ratio,
    Data6=shear_modulus_kn_m,
    Data7=density_tonnes_m_2)

# ----
young_modulus_n_m_2 = Panel("150000000000")
density_kg_m_2 = Panel("0.1")
diameter_m = Panel("0.1")
merge_4 = Merge(Data1=diameter_m, Data2=young_modulus_n_m_2, Data3=density_kg_m_2)

wind_vb_map_m_s = Panel("23")
wind_cez = Panel("2.8")
snow_loading_kn_m_2 = Panel("0.6")
wind_cet = Panel("1")
merge_5 = Merge(Data1=wind_vb_map_m_s, Data2=wind_cez, Data3=wind_cet, Data4=snow_loading_kn_m_2)

supension_cables = BooleanToggle(False)
cable_satyed_cables = BooleanToggle(True)
bottom_connection_ofset = Slider(30, range=0..50)
supports_on_ridge_cable = Slider(5, range=0..20)
height_over_roof = Slider(7, range=0..20)
diameter_m_2 = Panel("0.1")
young_modulus_n_m_2_2 = Panel("150000000000")
density_kg_m_2_2 = Panel("0.1")
merge_6 = Merge(
    Data1=supports_on_ridge_cable,
    Data2=supension_cables,
    Data3=cable_satyed_cables,
    Data4=height_over_roof,
    Data5=diameter_m_2,
    Data6=young_modulus_n_m_2_2,
    Data7=density_kg_m_2_2,
    Data8=bottom_connection_ofset)

roof_clearence = Slider(20, range=0..50)
bottom_taper = Slider(1, range=0..5)
top_taper = Slider(0.5, range=0..5)
thickness = Slider(0.05, range=0..1)
merge_7 = Merge(Data1=roof_clearence, Data2=bottom_taper, Data3=top_taper, Data4=thickness)

int = Integer(merge)
py3 = Python3Script(Geometric_Data=int)  # -> out, xdir_start, xdir_end, xdir_name, ydir_start, ydir_end, ydir_name; inputs Geometric_Data: list
# ---------- py3: Python ----------
import rhinoscriptsyntax as rs
import string

# Example: Geometric_Data = [length, width, distance_col, number_col, height_col, radius]
length, width, distance_col, number_col, height_col, radius = (
    int(Geometric_Data[0]),
    int(Geometric_Data[1]),
    Geometric_Data[2],
    Geometric_Data[3],
    Geometric_Data[4],
    Geometric_Data[5] + 0.01
)


def excel_labels(n):
    alphabet = string.ascii_uppercase  # Uppercase for grid names (A, B, C, ... AA)
    labels = []
    i = 0
    while len(labels) < n:
        temp = i
        s = ""
        while True:
            temp, r = divmod(temp, 26)
            s = alphabet[r] + s
            if temp == 0:
                break
            temp -= 1
        labels.append(s)
        i += 1
    return labels

# ------------------------
# X direction (columns)
# ------------------------
xdir_start = []
xdir_end = []
xdir_name = []

x_points = [0, distance_col, width/2, width - distance_col, width]

for x in x_points:
    xdir_start.append(rs.CreatePoint(x, -1, 0))
    xdir_end.append(rs.CreatePoint(x, length + 1, 0))

xdir_name = [str(i + 1) for i in range(len(x_points))]

# ------------------------
# Y direction (rows)
# ------------------------
nodes_side = number_col * 2
ydir_start = []
ydir_end = []
ydir_name = []

for i in range(nodes_side + 1):
    y = (length / nodes_side) * i
    ydir_start.append(rs.CreatePoint(-1, y, 0))
    ydir_end.append(rs.CreatePoint(width + 1, y, 0))

ydir_name = excel_labels(nodes_side + 1)


print("Grid generated successfully.")
# ---------- end py3 ----------
ln = Line(StartPoint=py3.xdir_start, EndPoint=py3.xdir_end)
ln_2 = Line(StartPoint=py3.ydir_start, EndPoint=py3.ydir_end)
creategridline = CreateGridLine(Curve=ln, Label=py3.xdir_name)
creategridline_2 = CreateGridLine(Curve=ln_2, Label=py3.ydir_name)

int_2 = Integer(merge)
mesh = Slider(1, range=0..10000)
py3_2 = Python3Script(Geometric_Data=int_2, Mesh=mesh)  # -> out, X, Y, x, y, edge_nodes_line, U, V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; inputs Geometric_Data: list, Mesh: Int32
# ---------- py3_2: Python ----------
import rhinoscriptsyntax as rs
lenght,width,distance_col,number_col,height_col,Radius=int(Geometric_Data[0]),int(Geometric_Data[1]),Geometric_Data[2],Geometric_Data[3],Geometric_Data[4],Geometric_Data[5]+0.01
Danger_zone=Radius+0.5
nodes_side=number_col*2
Y=lenght
X=width
U=X*Mesh
V=Y*Mesh
height=rs.CreateVector(0,0,height_col)
Mesh=1/Mesh

x,y=[],[]
for i in range(nodes_side+1):
    if i%2 ==0:
        nada=("nada")
    else:
        x.append("{} to {}".format(distance_col-(Radius+Mesh/2),distance_col+(Radius+Mesh/2)))
        y_point=(lenght/nodes_side)*i
        y.append("{} to {}".format(y_point-(Radius+Mesh/2),y_point+(Radius+Mesh/2)))
for i in range(nodes_side+1):
    if i%2 ==0:
        nada=("nada")
    else:
        x.append("{} to {}".format(width-distance_col-(Radius+Mesh/2),width-distance_col+(Radius+Mesh/2)))
        y_point=(lenght/nodes_side)*i
        y.append("{} to {}".format(y_point-(Radius+Mesh/2),y_point+(Radius+Mesh/2)))


edge_nodes,edge_nodes_line,centre_point_circle,circle_nodes=[],[],[],[]
for i in range(nodes_side+1):
    if i%2==0:
        edge_nodes.append(rs.CreatePoint(distance_col, (lenght/nodes_side)*i,0))
        edge_nodes_line.append(rs.CreatePoint(distance_col, (lenght/nodes_side)*i,0))
    else:
        edge_nodes.append(rs.CreatePoint(0, (lenght/nodes_side)*i,0))
        edge_nodes_line.append(rs.CreatePoint(0, (lenght/nodes_side)*i-Mesh,0))
        edge_nodes_line.append(rs.CreatePoint(0, (lenght/nodes_side)*i+Mesh,0))
        centre_point_circle.append(rs.CreatePoint(distance_col, (lenght/nodes_side)*i,0))
        circle_nodes.append(rs.CreatePoint(distance_col-Radius, (lenght/nodes_side)*i,height_col))
        circle_nodes.append(rs.CreatePoint(distance_col+Radius, (lenght/nodes_side)*i,height_col))
for i in range(nodes_side,-1,-1):
    if i%2==0:
        edge_nodes.append(rs.CreatePoint(width-distance_col, (lenght/nodes_side)*i,0))
        edge_nodes_line.append(rs.CreatePoint(width-distance_col, (lenght/nodes_side)*i,0))
    else:
        edge_nodes.append(rs.CreatePoint(width,(lenght/nodes_side)*i,0))
        edge_nodes_line.append(rs.CreatePoint(width,(lenght/nodes_side)*i+Mesh,0))
        edge_nodes_line.append(rs.CreatePoint(width,(lenght/nodes_side)*i-Mesh,0))
        centre_point_circle.append(rs.CreatePoint(width-distance_col, (lenght/nodes_side)*i,0))
        circle_nodes.append(rs.CreatePoint(width-distance_col-Radius, (lenght/nodes_side)*i,height_col))
        circle_nodes.append(rs.CreatePoint(width-distance_col+Radius, (lenght/nodes_side)*i,height_col))

A=[rs.CreatePoint(distance_col, 0,0),rs.CreatePoint(distance_col, lenght,0)]
B=[rs.CreatePoint(width-distance_col, 0,0),rs.CreatePoint(width-distance_col,lenght,0)]
At=rs.CreateVector((width-distance_col)/10,0,height_col/4)
Ab=rs.CreateVector(-(width-distance_col)/10,0,height_col/4)


SQ1,SQ2=[],[]
SQ1.append("{} to {}".format(-Mesh/2,X+Mesh/2))
SQ2.append("{} to {}".format(-Mesh/2,Mesh/2))
SQ1.append("{} to {}".format(-Mesh/2,X+Mesh/2))
SQ2.append("{} to {}".format(Y-Mesh/2,Y+Mesh/2))

edge_edge=[]
edge_edge.append(rs.CreatePoint(distance_col,0,0))
edge_edge.append(rs.CreatePoint(distance_col,lenght,0))
edge_edge.append(rs.CreatePoint(width-distance_col,0,0))
edge_edge.append(rs.CreatePoint(width-distance_col,lenght,0))
# ---------- end py3_2 ----------
pline = PolyLine(Vertices=py3_2.edge_nodes_line, Closed=True)
planesrf = PlaneSurface(Plane=PlaneXY(0, 0, 0), XSize=py3_2.X, YSize=py3_2.Y)
rectangle = Rectangle(Plane=PlaneXY(0, 0, 0), XSize=py3_2.x, YSize=py3_2.y, Radius=0)  # -> Rectangle, Length
relay = Relay([py3_2.edge_nodes, py3_2.circle_nodes])
sdiff = SolidDifference(BrepsA=planesrf, BrepsB=rectangle.Rectangle)
circle = CircleCNR(Center=py3_2.centre_point_circle, Normal=Vector(0, 0, 1), Radius=py3_2.Radius)
mesh_uv = MeshSurface(Surface=sdiff, UCount=py3_2.U, VCount=py3_2.V, Overhang=True, Equalize=False)
demesh = DeconstructMesh(Mesh=mesh_uv)  # -> Vertices, Faces, Colours, Normals
incurve = PointInCurve(Point=demesh.Vertices, Curve=pline)  # -> Relationship, Point
py3_3 = Python3Script(R=incurve.Relationship)  # -> out, a; inputs R: list
# ---------- py3_3: Python ----------
a=[]
for i in range(len(R)):
    if R[i]==0:
        a.append(i)
print(a)
# ---------- end py3_3 ----------
deletev = DeleteVertices(Mesh=mesh_uv, Indices=py3_3.a, Shrink=False)
demesh_2 = DeconstructMesh(Mesh=deletev)  # -> Vertices, Faces, Colours, Normals
rectangle_2 = Rectangle(Plane=PlaneXY(0, 0, 0), XSize=py3_2.SQ1, YSize=py3_2.SQ2, Radius=0)  # -> Rectangle, Length
incurve_2 = PointInCurve(Point=demesh_2.Vertices, Curve=graft(rectangle.Rectangle))  # -> Relationship, Point
incurve_3 = PointInCurve(Point=demesh_2.Vertices, Curve=graft(rectangle_2.Rectangle))  # -> Relationship, Point
bzspan = BezierSpan(StartPoint=py3_2.A, StartTangent=py3_2.At, EndPoint=py3_2.B, EndTangent=py3_2.Ab)  # -> Curve, Length, Domain
nv = NakedVertices(Mesh=deletev)  # -> ClothedIndex, NakedIndex, ClothedPts, NakedPts
py3_4 = Python3Script(R=incurve_2.Relationship)  # -> out, a; inputs R: tree
# ---------- py3_4: Python ----------
from Grasshopper import DataTree
from Grasshopper.Kernel.Data import GH_Path

# R = input tree
# Collect all branches
branches = [list(R.Branch(i)) for i in range(R.BranchCount)]

# Transpose: element-wise grouping across branches
transposed = zip(*branches)

result = []
for group in transposed:
    vals = set(group)
    if vals == {0}:
        result.append(0)
    elif 2 in vals:
        result.append(2)
    else:
        result.append(1)

a = result  # flat list output
print(a)
# ---------- end py3_4 ----------
py3_5 = Python3Script(R=incurve_3.Relationship)  # -> out, a; inputs R: tree; same code as py3_4
py3_6 = Python3Script(R1=py3_4.a, R2=py3_5.a, ID=nv.NakedIndex, Pt=nv.NakedPts)  # -> out, I, P; inputs R1: list, R2: list, ID: list, Pt: list
# ---------- py3_6: Python ----------
b=-1
I,P=[],[]
for i in range(len(R1)):
    if i in ID:
        b=b+1
        if R1[i] ==0 and R2[i]==0:
            print(i)
            I.append(ID[b])
            P.append(Pt[b])
# ---------- end py3_6 ----------
py3_7 = Python3Script(R=py3_4.a, P=demesh_2.Vertices, C=circle)  # -> out, Pt, Seg; inputs R: list, P: list, C: list
# ---------- py3_7: Python ----------
Pt =[]
for i in range(len(R)):
    if R[i] in [1,2]:
        Pt.append(P[i])
print(Pt)
Seg=len(Pt)/len(C)
# ---------- end py3_7 ----------
py3_8 = Python3Script(R=py3_5.a, P=demesh_2.Vertices, C=bzspan.Curve)  # -> out, Pt, Seg; inputs R: list, P: list, C: list
# ---------- py3_8: Python ----------
Pt =[]
for i in range(len(R)):
    if R[i] in [1,2]:
        Pt.append(P[i])
print(Pt)
Seg=len(Pt)/len(C)-1
# ---------- end py3_8 ----------
divide = DivideCurve(Curve=circle, Count=py3_7.Seg, Kinks=False)  # -> flatten(Points), Tangents, Parameters
divide_2 = DivideCurve(Curve=bzspan.Curve, Count=py3_8.Seg, Kinks=False)  # -> flatten(Points), Tangents, Parameters
py3_9 = Python3Script(A=py3_7.Pt, B=divide.Points)  # -> out, ClosestB; inputs A: list of Point3d, B: list of Point3d
# ---------- py3_9: Python ----------
# requirements: numpy
# requirements: scipy

import Rhino.Geometry as rg
import numpy as np
from scipy.optimize import linear_sum_assignment

# Convert input points to Point3d
A_pts = [pt.Location if hasattr(pt, "Location") else pt for pt in A]
B_pts = [pt.Location if hasattr(pt, "Location") else pt for pt in B]

# Make distance matrix
dist_matrix = np.zeros((len(A_pts), len(B_pts)))
for i, a in enumerate(A_pts):
    for j, b in enumerate(B_pts):
        dist_matrix[i, j] = a.DistanceTo(b)

# Solve assignment problem
row_ind, col_ind = linear_sum_assignment(dist_matrix)

# Output corresponding B points
ClosestB = [B_pts[j] for j in col_ind]
# ---------- end py3_9 ----------
py3_10 = Python3Script(A=py3_8.Pt, B=divide_2.Points)  # -> out, ClosestB; inputs A: list of Point3d, B: list of Point3d; same code as py3_9
py3_11 = Python3Script(x=py3_6.P, edge=py3_2.edge_edge)  # -> out, pt; inputs x: list, edge: list
# ---------- py3_11: Python ----------
import Grasshopper as gh

mid = (len(x) + 1) // 2
a = x[:mid]
a.insert(0,edge[0])
a.append(edge[1])
b = x[mid:]
b.insert(0,edge[2])
b.append(edge[3])

# Combine into a tree
tree = gh.DataTree[object]()
tree.AddRange(a, gh.Kernel.Data.GH_Path(0))
tree.AddRange(b, gh.Kernel.Data.GH_Path(1))

pt = tree
print(pt)
# ---------- end py3_11 ----------
py3_12 = Python3Script(x=py3_11.pt)  # -> out, sortedPts; inputs x: tree of Point3d
# ---------- py3_12: Python ----------
import Grasshopper as gh

# Output DataTree
sortedPts = gh.DataTree[object]()

tol = 1e-6  # tolerance for floating point comparison

for path in x.Paths:
    pts = list(x.Branch(path))
    
    # Step 1: Sort points by Y ascending
    pts_sorted_y = sorted(pts, key=lambda p: p.Y)
    
    # Step 2: Group points by Y (rows)
    rows = []
    current_row = []
    current_y = None
    for p in pts_sorted_y:
        if current_y is None or abs(p.Y - current_y) < tol:
            current_row.append(p)
            if current_y is None:
                current_y = p.Y
        else:
            rows.append(current_row)
            current_row = [p]
            current_y = p.Y
    if current_row:
        rows.append(current_row)
    
    # Step 3: Traverse each row, preferring same X as previous
    result = []
    prev_x = None
    for row in rows:
        remaining = row[:]
        row_ordered = []
        
        while remaining:
            if prev_x is not None:
                # Find node with same X as previous
                same_x_nodes = [p for p in remaining if abs(p.X - prev_x) < tol]
                if same_x_nodes:
                    p = same_x_nodes[0]
                else:
                    # Take the leftmost (smallest X)
                    p = min(remaining, key=lambda p: p.X)
            else:
                # First point in the first row → take leftmost X
                p = min(remaining, key=lambda p: p.X)
            
            row_ordered.append(p)
            prev_x = p.X
            remaining.remove(p)
        
        result.extend(row_ordered)
    
    sortedPts.AddRange(result, path)
# ---------- end py3_12 ----------
move = Move(Geometry=py3_9.ClosestB, Motion=py3_2.height)  # -> Geometry, Transform
py3_13 = Python3Script(R1=py3_4.a, P=demesh_2.Vertices, G1=move.Geometry, R2=py3_5.a, G2=py3_10.ClosestB)  # -> out, V; inputs R1: list, P: list, G1: list, R2: list, G2: list
# ---------- py3_13: Python ----------
V = []
c = d = e = 0

# Precompute lengths to avoid recomputing len(P)
for i, p_val in enumerate(P):
    if R1[i] in (1, 2):
        V.append(G1[c])
        c += 1
    elif R2[i] in (1, 2):
        V.append(G2[d])
        d += 1
    else:
        V.append(p_val)

print(c, d, e)
# ---------- end py3_13 ----------
relay_2 = Relay([move.Geometry, py3_6.P])
conmesh = ConstructMesh(Vertices=py3_13.V, Faces=demesh_2.Faces)
msmooth = SmoothMesh(Mesh=conmesh, Strength=0.5, SkipNaked=True, Iterations="1000")
mat = CreateMaterial(Material_type="Fabric", Grade="Taconic Solus 1410")
demesh_3 = DeconstructMesh(Mesh=msmooth)  # -> Vertices, Faces, Colours, Normals
prop2d = Create2DProperty(Material=mat, Type="Fabric")
support = CreateSupport(Point=demesh_3.Vertices, Plane=PlaneXY(0, 0, 0), x=False, xx=False, y=False, yy=False, z=False, zz=False)
elem2d = Create2DElement(Geometry=msmooth, Property2D=prop2d, Preview3dSection=False)

relay_3 = Relay([creategridline, creategridline_2])
support_2 = CreateSupport(Point=flatten(py3_10.ClosestB), Plane=PlaneXY(0, 0, 0), x=True, xx=False, y=True, yy=False, z=False, zz=False)
support_3 = CreateSupport(Point=flatten([move.Geometry, relay]), Plane=PlaneXY(0, 0, 0), x=True, xx=False, y=True, yy=False, z=True, zz=False)
model = CreateModel(Properties=mat, GSAGeometryIn_m=flatten([elem2d, support]), ReMesh=False, Tolerance=0.01, Unit="m")

no = Node(support)
mesh_2 = Mesh(msmooth)
pt = Point(relay_2)
demesh_4 = DeconstructMesh(Mesh=mesh_2)  # -> Vertices, Faces, Colours, Normals
cp = ClosestPoint(Point=flatten(pt), Cloud=demesh_4.Vertices)  # -> ClosestPoint, CPIndex, Distance
deface = DeconstructFace(Face=demesh_4.Faces)  # -> CornerA, CornerB, CornerC, CornerD
creata_points_for_polylines = Python3Script(V=demesh_4.Vertices, A=deface.CornerA, B=deface.CornerB, C=deface.CornerC, D=deface.CornerD, P=cp.CPIndex)  # -> out, u_count, v_count, V; inputs V: list, A: list, B: list, C: list, D: list, P: list
# ---------- creata_points_for_polylines: Python ----------
from Grasshopper import DataTree
from Grasshopper.Kernel.Data import GH_Path
from System import Object

def unique_preserve_order_iter(iterable):
    """Yield unique items from an iterable, preserving order."""
    seen = set()
    for item in iterable:
        if item not in seen:
            seen.add(item)
            yield item

def build_layer_paths(V, index_sets, P):
    """
    V: list of node values
    index_sets: list of tuples [(start_a, end_a, start_b, end_b), ...] for each layer
    P: list of indices -> segments where both start and end indices are in P will be removed
    
    Returns:
        all_paths: combined paths from all layers
        layer_counts: list of counts per layer
    """
    all_paths = []
    layer_counts = []

    for layer_num, (start_a, end_a, start_b, end_b) in enumerate(index_sets):
        # Merge start and end indices
        start_indices = start_a + start_b
        end_indices   = end_a + end_b

        # Build segments (indices) and filter out those where both ends are in P
        raw_segments = list(zip(start_indices, end_indices))
        segments = [(s, e) for s, e in raw_segments if not (s in P and e in P)]
        removed_segments = [seg for seg in raw_segments if seg not in segments]

        if removed_segments:
            print(f"Layer {layer_num+1} - removed segments (both ends in P): {removed_segments}")

        # Convert remaining segments to actual node values
        start = [V[i] for i, _ in segments]
        end   = [V[j] for _, j in segments]

        start_to_segment = {s: (s, e) for s, e in zip(start, end)}
        unvisited = set(start_to_segment.keys())
        layer_paths = []

        # Root nodes: start nodes not appearing as ends
        end_set = set(end)
        root_nodes = [s for s in start if s not in end_set]

        def traverse(root):
            path = []
            current = root
            while current in unvisited:
                if current not in start_to_segment:  # Segment removed → stop path
                    path.append(current)
                    break
                s, e = start_to_segment[current]
                path.append(s)
                unvisited.remove(current)
                current = e
                if current in path:  # Avoid cycles
                    path.append(current)
                    break
            if path and current not in path:
                path.append(current)
            return path

        # Traverse paths from roots
        for root in root_nodes:
            path = traverse(root)
            if path:
                layer_paths.append(path)

        # Traverse any remaining unvisited segments
        while unvisited:
            root = next(iter(unvisited))
            path = traverse(root)
            if path:
                layer_paths.append(path)

        all_paths.extend(layer_paths)
        layer_counts.append(len(layer_paths))  # Count for this layer

    return all_paths, layer_counts


# ----------------------------------------------------
# MAIN EXECUTION (Grasshopper inputs expected: V, A, B, C, D, P)
# ----------------------------------------------------

# Explicit segment assignments (indices)
# L1: C->B, D->A
# L2: D->C, A->B
layers = [
    (C, B, D, A),  # L1
    (D, C, A, B)   # L2
]

all_paths, layer_counts = build_layer_paths(V, layers, P)
u_count, v_count = layer_counts  # counts per layer

# Create Grasshopper DataTree
data_tree = DataTree[Object]()
for i, sublist in enumerate(all_paths):
    path = GH_Path(i)
    for item in sublist:
        data_tree.Add(item, path)

V = data_tree
# ---------- end creata_points_for_polylines ----------
pline_2 = PolyLine(Vertices=creata_points_for_polylines.V, Closed=False)  # -> flatten(Polyline)
py3_14 = Python3Script(M_in=mesh_2, PL=pline_2)  # -> out, A, B, V, Vr; inputs PL: list
# ---------- py3_14: Python ----------
import Rhino
import Rhino.Geometry as rg
import scriptcontext as sc
from Grasshopper import DataTree
from Grasshopper.Kernel.Data import GH_Path

# Inputs
# M_in : Mesh object or GUID
# PL   : List of polylines

# --- Step 1: Ensure we have a Mesh object ---
if isinstance(M_in, rg.Mesh):
    M = M_in
else:
    obj = sc.doc.Objects.Find(M_in)
    if obj is not None:
        M = obj.Geometry
    else:
        M = None

# --- Step 2: Convert PL inputs to actual Polylines ---
polylines = []
for pl in PL:
    if isinstance(pl, rg.Polyline):
        polylines.append(pl)
    elif isinstance(pl, rg.PolylineCurve):
        polylines.append(pl.ToPolyline())
    else:
        obj = sc.doc.Objects.Find(pl)
        if obj is not None:
            geo = obj.Geometry
            if isinstance(geo, rg.Polyline):
                polylines.append(geo)
            elif isinstance(geo, rg.PolylineCurve):
                polylines.append(geo.ToPolyline())

# --- Step 3: Get naked edges of the mesh ---
naked_edges = []
if M:
    naked_edges = M.GetNakedEdges()

# --- Step 4: Filter polylines by checking all vertices ---
kept = []
removed = []
tolerance = 1e-6

for pl in polylines:
    all_on_boundary = True
    for i in range(pl.Count):
        pt = pl[i]
        if not any(pt.DistanceTo(naked_pt) < tolerance for edge in naked_edges for naked_pt in edge):
            all_on_boundary = False
            break
    if all_on_boundary:
        removed.append(pl)
    else:
        kept.append(pl)

# --- Step 5: Create the DataTree V ---
V = DataTree[object]()
for i, pl in enumerate(kept):
    path = GH_Path(i)
    for pt in pl:
        V.Add(pt, path)

# --- Step 5: Create the DataTree Vr ---
Vr = DataTree[object]()
for i, pl in enumerate(removed):
    path = GH_Path(i)
    for pt in pl:
        Vr.Add(pt, path)

# --- Outputs ---
A = kept      # Interior polylines
B = removed   # Boundary polylines
# ---------- end py3_14 ----------
mem1d = Create1DMember(
    Curve=py3_14.A,
    Preview3dSection=False,
    x1=False,
    x2=False,
    xx1=False,
    xx2=False,
    y1=False,
    y2=False,
    yy1=False,
    yy2=False,
    z1=False,
    z2=False,
    zz1=False,
    zz2=False)
elemfrommem = CreateElementsFromMembers(Nodes_m=no, _1DMembers_m=mem1d, Tolerance=0.001, Unit="m")  # -> Nodes, _1DElements, _2DElements, _3DElements, GSAModel
obtaining_id_for_each_of_the_sublines = Python3Script(F=demesh_4.Faces, E1D=elemfrommem._1DElements)  # -> out, ID, eT; inputs F: list, E1D: list
# ---------- obtaining_id_for_each_of_the_sublines: Python ----------
##ID
ID=[]
for i in range(len(E1D)):
    ID.append(i+1+len(F))
print(ID)
## eT from documentation
eT=19
print(eT)
# ---------- end obtaining_id_for_each_of_the_sublines ----------
elem1dedit = Edit1DElement(
    Element1D=elemfrommem._1DElements,
    Number=obtaining_id_for_each_of_the_sublines.ID,
    Type=obtaining_id_for_each_of_the_sublines.eT,
    Preview3dSection=False)  # -> Element1D, Number, Line, Property, Group, Type, Offset, StartRelease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
spacer_properties = Python3Script(
    u_count=creata_points_for_polylines.u_count,
    v_count=creata_points_for_polylines.v_count,
    V=py3_14.V,
    B=py3_14.B,
    ID=elem1dedit.Number,
    Tp=elem1dedit.Topology)  # -> out, spacer_main, spacer_formatted; inputs V: tree, B: list, ID: list, Tp: tree
# ---------- spacer_properties: Python ----------
import math as math
from Grasshopper import DataTree
from Grasshopper.Kernel.Data import GH_Path

#spacer main
spacer_main=[]
u_count=int(u_count)
v_count=int(v_count)
series=list(range(1,u_count+v_count+1-len(B)))
for i in series:
    text="PROP_SPACER.2,{series},Spacer prop.{series},NO_RGB,0,GEODESIC,RATIO,1,1".format(series=i)
    spacer_main.append(text)
print(spacer_main)



#spacer formatted
## Getting the unique id for each line
property_number=[]
branch_length=[]
for i in range(V.BranchCount):
    branch_length.append(len(V.Branch(i)))

for i in range(1,u_count+1+v_count-len(B)):
    j=1
    while j <(branch_length[i-1]):
        property_number.append(i)
        j=j+1
print(property_number)

## Geting the start and end node for each subline 
node_start = []
node_end = []
for i in range(Tp.BranchCount):
    path = Tp.Paths[i]
    branch = Tp.Branches[i]
    node_start.append(branch[0])
    node_end.append(branch[1])

## Formating Text for GSA
spacer_formatted=[]

for i in range(len(ID)):
    text="SET,EL.4,{id},,NO_RGB,SPACER,{no},1,{st},{en},0,0,NO_RLS,0,0,0,0,,3".format(id=ID[i],no=property_number[i],st=node_start[i],en=node_end[i])
    spacer_formatted.append(text)
print(len(spacer_formatted))
print(len(ID))
# ---------- end spacer_properties ----------

relay_4 = Relay([support_2, support_3])
txt = Text(merge_3)
py3_15 = Python3Script(Fabric_data=txt)  # -> out, mat_fab, prop_2D; inputs Fabric_data: list
# ---------- py3_15: Python ----------
#mat_fab="SET,MAT_FABRIC.11,{grade},{name},{warp},{fill},{pois},{shear},{density},0,MAT_ANAL.1,,-268435456,MAT_FABRIC,5,,{grade},{name},{warp},{fill},{pois},{shear},1,0,0,0,0,0,0,0,MAT_CURVE_PARAM.3,,UNDEF,0,0,0,0,0,0,1,1,MAT_CURVE_PARAM.3,,UNDEF,0,0,0,0,0,0,1,1,0,Fabric,NO".format(grade=Fabric_data[0],name=Fabric_data[1],warp=Fabric_data[2],fill=Fabric_data[3],pois=Fabric_data[4],shear=Fabric_data[5],density=Fabric_data[6])
mat_fab="SET,MAT_FABRIC.11,1,Taconic Solus,1120,960700,371700,0.57,48035,1.1,0,MAT_ANAL.1,Fabric,-268435456	MAT_FABRIC,5,960700	371700,0.57,48035,1.1,1	0,0,0,0,0,0,0,MAT_CURVE_PARAM.3,,UNDEF,0,0,0,0,0,0,1,1,MAT_CURVE_PARAM.3,,UNDEF,0,0,0,0,0,0,1,1,0,Fabric,NO"
print(mat_fab)
prop_2D="SET,PROP_2D.8,1,2D prop. 1,NO_RGB,FABRIC,GLOBAL,0,FABRIC,{grade},0,(mm),CENTROID,0,0,100%,100%,100%,100%".format(grade=Fabric_data[0])
print(prop_2D)
# ---------- end py3_15 ----------

no_2 = Node(support)
pt_2 = Point(relay)
num = Number(merge_4)
pt_3 = Point(py3_12.sortedPts)
py3_16 = Python3Script(x=num)  # -> out, a; inputs x: list
# ---------- py3_16: Python ----------
a=x[0]
# ---------- end py3_16 ----------
py3_17 = Python3Script(V=creata_points_for_polylines.V, Pt=flatten(pt_2))  # -> out, P; inputs V: tree of Point3d, Pt: list of Point3d
# ---------- py3_17: Python ----------
from Grasshopper import DataTree
from Grasshopper.Kernel.Data import GH_Path

# Create a new DataTree
P = DataTree[object]()

# Counter for the new tree path
branch_index = 0

for i in range(V.BranchCount):
    branch = V.Branch(i)
    start_node = branch[0]
    for j in range(len(branch)):
        if j+1 == len(branch):
            end_node=branch[j]

    # Check if start_node is in start list and end_node is in end list
    if any(start_node.DistanceTo(s) < 1e-6 for s in Pt) and any(end_node.DistanceTo(e) < 1e-6 for e in Pt):
        path = GH_Path(branch_index)  # Create a new branch path
        for pt in branch:
            P.Add(pt, path)      # Add each point to this path
        branch_index += 1             # Increment path index for next branch

# Output the tree
print(P)
# ---------- end py3_17 ----------
py3_18 = Python3Script(treeA=pt_3, treeB=py3_17.P)  # -> out, V; inputs treeA: tree, treeB: tree
# ---------- py3_18: Python ----------
import Grasshopper as gh
from Grasshopper.Kernel.Data import GH_Path

# Create a new DataTree
merged_tree = gh.DataTree[object]()

# --- Add all branches from treeA ---
for i in range(treeA.BranchCount):
    pathA = treeA.Path(i)
    dataA = treeA.Branch(i)
    merged_tree.AddRange(dataA, pathA)

# --- Add all branches from treeB, offsetting their paths ---
offset = treeA.BranchCount  # start numbering after the last branch of A

for i in range(treeB.BranchCount):
    pathB = treeB.Path(i)
    dataB = treeB.Branch(i)
    
    # Create a new path that continues after treeA’s branches
    new_path = GH_Path(offset + i)
    
    merged_tree.AddRange(dataB, new_path)

# Output the concatenated DataTree
V = merged_tree
# ---------- end py3_18 ----------
pline_3 = PolyLine(Vertices=py3_18.V, Closed=False)  # -> flatten(Polyline)
profile = CreateProfile(
    Diameter_cm=py3_16.a,
    catalogueIndex=-1,
    inclSS=False,
    lengthUnit="Centimeter",
    mode="Other",
    Profile_type="Circle",
    Measure="cm",
    typeIndex=-1)
mem1d_2 = Create1DMember(
    Curve=flatten(pline_3),
    Preview3dSection=False,
    x1=False,
    x2=False,
    xx1=False,
    xx2=False,
    y1=False,
    y2=False,
    yy1=False,
    yy2=False,
    z1=True,
    z2=False,
    zz1=False,
    zz2=False)
mat_2 = CreateMaterial(Material_type="Steel", Design_Code="EN 1993-1-1:2005", Grade="S235")
elemfrommem_2 = CreateElementsFromMembers(Nodes_m=no_2, _1DMembers_m=mem1d_2, Tolerance=0.001, Unit="m")  # -> Nodes, _1DElements, _2DElements, _3DElements, GSAModel
section = CreateSection(Profile=profile, Material=mat_2, Basic_Offset="Centroid")
obtaining_id_for_each_of_the_sublines_2 = Python3Script(F=obtaining_id_for_each_of_the_sublines.ID, E1D=elemfrommem_2._1DElements)  # -> out, ID, eT; inputs F: list, E1D: list
# ---------- obtaining_id_for_each_of_the_sublines_2: Python ----------
##ID
ID=[]
for i in range(len(E1D)):
    ID.append(i+1+F[-1])
print(ID)
## eT from documentation
eT=21
print(eT)
# ---------- end obtaining_id_for_each_of_the_sublines_2 ----------
elem1dedit_2 = Edit1DElement(
    Element1D=elemfrommem_2._1DElements,
    Number=obtaining_id_for_each_of_the_sublines_2.ID,
    Property=section,
    Type=obtaining_id_for_each_of_the_sublines_2.eT,
    Preview3dSection=False)  # -> Element1D, Number, Line, Property, Group, Type, Offset, StartRelease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

relay_5 = Relay([py3_15.prop_2D, py3_15.mat_fab])
gwa = GWACommand(GSAModel=model, GWAString=flatten([spacer_properties.spacer_formatted, spacer_properties.spacer_main, relay_5]))  # -> Model, ReturnedResult
model_2 = CreateModel(
    ModelSListsAndGridLines=gwa.Model,
    GSAGeometryIn_m=flatten(elem1dedit_2.Element1D),
    ReMesh=True,
    Tolerance=0.01,
    Unit="m")

# ---- group: Assigning Pre_stress
int_3 = Integer(merge_2)
py3_19 = Python3Script(Prestress_Data=int_3)  # -> out, prestress_2D, prestress_1D; inputs Prestress_Data: list
# ---------- py3_19: Python ----------
X_dir,Y_dir, Cable =Prestress_Data[0], Prestress_Data[1],Prestress_Data[2]
prestress_2D = "SOAP_STRESS_2D , 1 , 2D_prestress , {a} , {b}".format(a=X_dir,b=Y_dir)
X_dir,Y_dir, Cable =Prestress_Data[0], Prestress_Data[1],Prestress_Data[2]
prestress_1D = "SOAP_STRESS_1D , 1 , 1D_prestress , local , {c}".format(c=Cable*1000)
print(prestress_2D)
print(prestress_1D)
# ---------- end py3_19 ----------

# ----
loadcase = CreateLoadCase(CaseID="1", Name="self_weight", Type="Dead")
gravityload = CreateGravityLoad(LoadCase=loadcase, LoadableObjects="all", Name="self_weight", GravityFactor=Vector(0, 0, -1))

σa = CreateAnalysisCase(Name="Form-finding", Description="L1")
σt = CreateAnalysisTask(TaskID="1", Name="Form-finding", AnalysisCases=σa, casesParamIndex=2, Solver="Static")

model_3 = CreateModel(ModelSListsAndGridLines=model_2, GSAGeometryIn_m=flatten(relay_4), ReMesh=True, Tolerance=0.01, Unit="m")
gwa_2 = GWACommand(GSAModel=model_3, GWAString=flatten([py3_19.prestress_2D, py3_19.prestress_1D]))  # -> Model, ReturnedResult
panel = Panel("SET,TASK.1,1,Form-finding,0,GSRELAX,FORM_FINDING,SOAP_FORM,1,BEAM_GEO_YES,SHELL_GEO_NO,0.1000000015,9.999999747e-05,0.1000000015,CYCLE,100000000000,REL,1.000000047,1.000000047,DISP_CTRL_YES,0,1,0.009999999776,LOAD_CTRL_NO,1,none,1,10,100,RESID_NOCONV,DAMP_VISCOUS,0,0,1,1,1,1,AUTO_MASS_YES,AUTO_DAMP_YES,FF_SAVE_ELEM_FORCE_YES,FF_SAVE_SPACER_FORCE_TO_ELEM,SHOW_PROGRESS_SUM,SHOW_GRAPHIC_YES,DRCEFNSBUT")
model_4 = CreateModel(
    ModelSListsAndGridLines=gwa_2.Model,
    Load=gravityload,
    AnalysisTasksCombinations=σt,
    ReMesh=True,
    Tolerance=0.01,
    Unit="m")
panel_2 = Panel("C:\Users\santi\OneDrive - University of Glasgow\Year 5 Enginering\Dissertation\Just playing around with Rhino\GSA Tutorial\Test_only_fabric_13.gwb")
gwa_3 = GWACommand(GSAModel=model_4, GWAString=flatten(panel))  # -> Model, ReturnedResult
save = SaveGSAModel(GSAModel=model_4, Save=True, FileAndPath=panel_2)
analyse = AnalyseModel(ModelSAndLists=gwa_3.Model, Analyse=True, ReMesh=True, Tolerance=0.01, Unit="m")  # -> Model, Errors, Warnings, Remarks, Logs
panel_3 = Panel(analyse.Logs)

getgeo = GetModelGeometry(GSAModel=analyse.Model, Mode=1, Unit="m")  # -> NodesIn_m, _1DElementsIn_m, _2DElementsIn_m, _3DElementsIn_m, _1DMembersIn_m, _2DMembersIn_m, _3DMembersIn_m, Assemblies
elem1dedit_3 = Edit1DElement(Element1D=getgeo._1DElementsIn_m, Preview3dSection=False)  # -> Element1D, Number, Line, Property, Group, Type, Offset, StartRelease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
py3_20 = Python3Script(
    E1D=elem1dedit_3.Element1D,
    ID=elem1dedit_3.Number,
    Tp=elem1dedit_3.Topology,
    ID_cable=elem1dedit_2.Number,
    V=py3_18.V,
    cable_data=merge_4)  # -> out, Cable_def, New_cable_el; inputs E1D: list, ID: list, Tp: tree, ID_cable: list, V: tree, cable_data: list
# ---------- py3_20: Python ----------
import math
New_cable_el=[]
Cable_def=[]
id_cable_set = set(ID_cable)
AE=float(cable_data[1])*(float(cable_data[0])/2)**2*math.pi
mass=float(cable_data[2])*(float(cable_data[0])/2)**2*math.pi
node_start = []
node_end = []
for i in range(1,V.BranchCount+1):
    text="SET,PROP_CABLE.5,{num},Cable prop. 1,NO_RGB,{stiff},{mass},SLIDING,0,1,NO_ENV".format(num=i,stiff=AE,mass=mass)
    Cable_def.append(text)

property_number=[]
branch_length=[]
for i in range(V.BranchCount):
    branch_length.append(len(V.Branch(i)))

for i in range(1,V.BranchCount+1):
    j=1
    while j <(branch_length[i-1]):
        property_number.append(i)
        j=j+1

for i in range(Tp.BranchCount):
    path = Tp.Paths[i]
    branch = Tp.Branches[i]
    node_start.append(branch[0])
    node_end.append(branch[1])
c=0
for i in range(len(ID)):
    if ID[i] in id_cable_set:
        text="SET,EL.4,{id},,NO_RGB,CABLE,{prop},1,{st},{en},0,0,NO_RLS,0,0,0,0,,".format(id=ID[i],prop=property_number[c],st=node_start[i],en=node_end[i])
        c=c+1
        New_cable_el.append(text)
# ---------- end py3_20 ----------

getgeo_2 = GetModelGeometry(GSAModel=analyse.Model, Mode=1, Unit="m")  # -> NodesIn_m, _1DElementsIn_m, _2DElementsIn_m, _3DElementsIn_m, _1DMembersIn_m, _2DMembersIn_m, _3DMembersIn_m, Assemblies
elem2dedit = Edit2DElement(Element2D=getgeo_2._2DElementsIn_m, Preview3dSection=False)  # -> Element2D, Number, Geometry, _2DProperty, Group, ElementType, Offset, OrientationAngle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
nodeedit = EditNode(Node=getgeo_2.NodesIn_m, Mode=1)  # -> Node, NodeNumber, NodePosition, NodeLocalAxis, NodeRestraints, DamperProperty, MassProperty, SpringProperty, NodeName, NodeColour
py3_21 = Python3Script(ID_nodes=nodeedit.NodeNumber, Pt_node=nodeedit.NodePosition, ID_quad=elem2dedit.Number, Tp=elem2dedit.Topology)  # -> out, Reentrant_Quad_IDs, NonReentrant_Nodes; inputs ID_nodes: list, Pt_node: list of Point3d, ID_quad: list, Tp: tree
# ---------- py3_21: Python ----------
import math
from Rhino.Geometry import Point3d, Vector3d
from Grasshopper import DataTree
from Grasshopper.Kernel.Data import GH_Path

Reentrant_Quad_IDs = []
NonReentrant_Nodes = DataTree[object]()

def angle_between(v1, v2):
    dot = v1 * v2
    return math.degrees(math.acos(max(-1.0, min(1.0, dot / (v1.Length * v2.Length)))))

branch_index = 0  # branch counter for NonReentrant_Nodes

for i, qid in enumerate(ID_quad):
    try:
        node_ids = Tp.Branch(i)
    except:
        node_ids = Tp[i]

    pts = []
    for nid in node_ids:
        if nid in ID_nodes:
            idx = ID_nodes.index(nid)
            pt = Pt_node[idx]
            if isinstance(pt, Point3d):
                pass
            elif hasattr(pt, "Location"):
                pt = pt.Location
            elif hasattr(pt, "Geometry"):
                pt = pt.Geometry.Location
            elif hasattr(pt, "__iter__") and len(pt) == 3:
                pt = Point3d(*pt)
            else:
                raise TypeError("Cannot convert Pt_node element to Point3d: {}".format(pt))
            pts.append(pt)

    if len(pts) < 4:
        continue

    reentrant_indices = []

    for j in range(len(pts)):
        prev_pt = pts[(j - 1) % len(pts)]
        curr_pt = pts[j]
        next_pt = pts[(j + 1) % len(pts)]

        v1 = Vector3d(curr_pt - prev_pt)
        v2 = Vector3d(next_pt - curr_pt)

        cross = Vector3d.CrossProduct(v1, v2)
        dot = v1 * v2
        ang = math.degrees(math.atan2(cross.Length, dot))

        if ang >= 180 or (cross.Z < 0):
            reentrant_indices.append(j)

    if reentrant_indices:
        # Quad has reentrant nodes → add to outputs
        Reentrant_Quad_IDs.append(qid)
        non_reentrant_nodes = [nid for k, nid in enumerate(node_ids) if k not in reentrant_indices]
        NonReentrant_Nodes.AddRange(non_reentrant_nodes, GH_Path(branch_index))
        branch_index += 1  # increment branch counter
# ---------- end py3_21 ----------
py3_22 = Python3Script(Node_Point=nodeedit.NodePosition, Geometric_Data=merge, Support_Data=merge_6)  # -> out, Fabric_Points; inputs Node_Point: list of Point3d, Geometric_Data: list, Support_Data: list
# ---------- py3_22: Python ----------
# requirements: numpy
# requirements: scipy

import rhinoscriptsyntax as rs
import numpy as np
from scipy.optimize import linear_sum_assignment

# --- Input unpacking ---
length, width, distance_col, number_col, height_col, radius = (
    float(Geometric_Data[0]),
    float(Geometric_Data[1]),
    float(Geometric_Data[2]),
    int(Geometric_Data[3]),
    float(Geometric_Data[4]),
    float(Geometric_Data[5]) + 0.01
)

supports = int(Support_Data[0]) + 1
nodes_side = number_col * 2
span = width - 2 * distance_col

# --- Create pinned nodes ---
Pinned_nodes = []
for i in range(nodes_side + 1):
    if i % 2 == 1:
        y = (length / nodes_side) * i
        for j in range(1, supports):
            x = distance_col + (span / supports) * j
            Pinned_nodes.append(rs.CreatePoint(x, y, 0))

# --- Distance matrix (XY only) ---
dist_matrix = np.zeros((len(Pinned_nodes), len(Node_Point)))
for i, a in enumerate(Pinned_nodes):
    for j, b in enumerate(Node_Point):
        dist_matrix[i, j] = ((a.X - b.X)**2 + (a.Y - b.Y)**2)**0.5

# --- Hungarian algorithm ---
row_ind, col_ind = linear_sum_assignment(dist_matrix)
Fabric_Points = [Node_Point[j] for j in col_ind]

# --- Output ---
print(Fabric_Points)
# ---------- end py3_22 ----------
py3_23 = Python3Script(ID=py3_21.Reentrant_Quad_IDs, Tp=py3_21.NonReentrant_Nodes)  # -> out, New_quad; inputs ID: list, Tp: tree
# ---------- py3_23: Python ----------
node_start=[]
node_mid=[]
node_end=[]
for i in range(Tp.BranchCount):
    path = Tp.Paths[i]
    branch = Tp.Branches[i]
    node_start.append(branch[0])
    node_mid.append(branch[1])
    node_end.append(branch[2])

New_quad=[]
for i in range(len(ID)):
    text="SET,EL.4,{IDs},,NO_RGB,TRI3,1,1,{st},{mid},{en},0,0,NO_RLS,0,0,0,0".format(IDs=ID[i],st=node_start[i],mid=node_mid[i],en=node_end[i])
    New_quad.append(text)
# ---------- end py3_23 ----------

relay_6 = Relay([py3_20.Cable_def, py3_20.New_cable_el])
py3_24 = Python3Script(ID=nodeedit.NodeNumber, Points_items=nodeedit.NodePosition, Fabric_points=py3_22.Fabric_Points)  # -> out, a, b; inputs ID: list, Points_items: list of Point3d, Fabric_points: list of Point3d
# ---------- py3_24: Python ----------
Fabric_points_set = set(Fabric_points)
a=[]
b=[]
for i, item in enumerate(Points_items):
    if item in Fabric_points_set:
           a.append(ID[i])
           b.append(item)
print(b)
# ---------- end py3_24 ----------
gwa_4 = GWACommand(GSAModel=analyse.Model, GWAString=flatten([py3_23.New_quad, relay_6]))  # -> Model, ReturnedResult

py3_25 = Python3Script(
    ID=py3_24.a,
    Points=py3_24.b,
    nodes_Id=nodeedit.NodeNumber,
    ID_elements=elem1dedit_2.Number,
    Cable_prop_all=py3_20.Cable_def,
    geometric_data=merge,
    cable_data=merge_6,
    col_data=merge_7)  # -> out, pinned_points, pinned_ID, Cables_con, ID_cables_elements, ID_cables_set, Cable_props, new_top_nodes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; inputs ID: list, Points: list of Point3d, nodes_Id: list, ID_elements: list, Cable_prop_all: list, geometric_data: list, cable_data: list, col_data: list
# ---------- py3_25: Python ----------
# requirements: numpy
# requirements: scipy


import rhinoscriptsyntax as rs
import Rhino.Geometry as rg
import numpy as np
from scipy.optimize import linear_sum_assignment
from collections import defaultdict


# --- Input parameters ---
length, width, distance_col, number_col, height_col, radius = (
    float(geometric_data[0]),
    float(geometric_data[1]),
    float(geometric_data[2]),
    int(geometric_data[3]),
    float(geometric_data[4]),
    float(geometric_data[5]) + 0.01
)

pinned_points = []
pinned_ID = []
bottom_points = []
new_top_nodes = []
new_bottom_nodes =[]
overhead_nodes=[]

if not cable_data[1] and not cable_data[2]:
    pinned_points = Points
    pinned_ID = ID

if cable_data[1] and not cable_data[2]:
    overhead_nodes.append("Null")
    if cable_data[0] % 2 == 0:
        bottom_points = Points
    else:
        val1 = int((cable_data[0] - 1) / 2 * number_col)
        val2 = int((cable_data[0] + 1) / 2 * number_col)
        indices_for_cable = list(range(val1, val2))

        for i in range(len(Points)):
            if i in indices_for_cable and cable_data[1]:
                # Duplicate point
                bottom_points.append(Points[i])
                bottom_points.append(Points[i])
            else:
                # Single point
                bottom_points.append(Points[i])

    nodes_side = number_col * 2

    for i in range(nodes_side + 1):
        if i % 2 == 1: 
            y = (length / nodes_side) * i
            new_top_nodes.append(rs.CreatePoint(distance_col, y, height_col + cable_data[3]))
            new_top_nodes.append(rs.CreatePoint(width - distance_col, y, height_col + cable_data[3]))

            new_bottom_nodes.append(rs.CreatePoint(-cable_data[7], y, -col_data[0]))
            new_bottom_nodes.append(rs.CreatePoint(width +cable_data[7], y, -col_data[0]))

            bottom_points.append(rs.CreatePoint(-cable_data[7], y, -col_data[0]))
            bottom_points.append(rs.CreatePoint(width +cable_data[7], y, -col_data[0]))
        
    if len(new_top_nodes) > 0:
        repeats = int(len(bottom_points) / len(new_top_nodes))
        extra = len(bottom_points) - repeats * len(new_top_nodes)
        top_points = []

        for idx, pt in enumerate(new_top_nodes):
            count = repeats + (1 if idx < extra else 0)
            top_points.extend([pt] * count)
    else:
        top_points = []

if not cable_data[1] and cable_data[2]:
    bottom_points = Points

    for pt in Points:
        move_vec = rg.Vector3d(0, 0, cable_data[3])
        overhead_nodes.append(pt + move_vec)

    nodes_side = number_col * 2

    for i in range(nodes_side + 1):
        if i % 2 == 1:
            y = (length / nodes_side) * i
            new_top_nodes.append(rs.CreatePoint(distance_col, y, height_col + cable_data[3]))
            new_top_nodes.append(rs.CreatePoint(width - distance_col, y, height_col + cable_data[3]))

            new_bottom_nodes.append(rs.CreatePoint(-cable_data[7], y, -col_data[0]))
            new_bottom_nodes.append(rs.CreatePoint(width +cable_data[7], y, -col_data[0]))

            bottom_points.append(rs.CreatePoint(-cable_data[7], y, -col_data[0]))
            bottom_points.append(rs.CreatePoint(width +cable_data[7], y, -col_data[0]))
            
    top_points=new_top_nodes+overhead_nodes

    tol = 1

    groups = defaultdict(list)
    for pt in top_points:
        y_key = round(pt.Y / tol) * tol
        groups[y_key].append(pt)

    top_cables = []
    total_segments_top_cables = 0
    for y_key, pts in groups.items():
        sorted_pts = sorted(pts, key=lambda p: p.X)
        polyline = rg.Polyline(sorted_pts)
        top_cables.append(polyline)
        
        total_segments_top_cables += max(len(sorted_pts) - 1, 0)

if cable_data[1] or cable_data[2]: 

    if bottom_points and top_points:
        dist_matrix = np.zeros((len(bottom_points), len(top_points)))

        for i, bottom in enumerate(bottom_points):
            for j, top in enumerate(top_points):
                dist_matrix[i, j] = ((bottom.X - top.X)**2 + (bottom.Y - top.Y)**2)**0.5

        row_ind, col_ind = linear_sum_assignment(dist_matrix)

        Cables_con = []
        for i, j in zip(row_ind, col_ind):
            Cables_con.append(rs.AddLine(bottom_points[i], top_points[j]))

    if ID_elements:
        start_id = ID_elements[-1] + 1
    else:
        start_id = 1  # default if list is empty

    ID_cables_elements = [start_id + i for i in range(len(Cables_con))]

    if ID_elements:
        start_id = len(Cable_prop_all) + 1
    else:
        start_id = 1  # default if list is empty

    ID_cables_set = [start_id + i for i in range(len(Cables_con))]
    Cable_props=[cable_data[4],cable_data[5],cable_data[6]]


    if ID_elements:
        start_id = len(nodes_Id) + 1
    else:
        start_id = 1  # default if list is empty

    Id_nodes = [start_id + i for i in range(len(new_top_nodes)+len(new_bottom_nodes)+len(overhead_nodes))]

if not cable_data[1] and cable_data[2]:
    if ID_elements:
        start_id = ID_cables_elements[-1] + 1
    else:
        start_id = 1  # default if list is empty

    ID_cables_elements_top = [start_id + i for i in range(total_segments_top_cables)]

    if ID_elements:
        start_id = ID_cables_set[-1] + 1
    else:
        start_id = 1  # default if list is empty

    ID_cables_set_top = [start_id + i for i in range(len(top_cables))]
# ---------- end py3_25 ----------
py3_26 = Python3Script(cable_data=merge_6)  # -> out, A, B, C; inputs cable_data: list
# ---------- py3_26: Python ----------
print(cable_data)
if cable_data[1] is True or cable_data[2] is True:
    A=True
else:
    A=False
B=cable_data[2]
if cable_data[1] is False and cable_data[2] is False:
    C=True
else:
    C=False
# ---------- end py3_26 ----------
support_4 = CreateSupport(Point=py3_25.pinned_points, Plane=PlaneXY(0, 0, 0), x=False, xx=False, y=False, yy=False, z=True, zz=False)
support_5 = CreateSupport(Point=py3_25.new_bottom_nodes, Plane=PlaneXY(0, 0, 0), x=True, xx=False, y=True, yy=False, z=True, zz=False)
support_6 = CreateSupport(Point=py3_25.new_top_nodes, Plane=PlaneXY(0, 0, 0), x=False, xx=False, y=False, yy=False, z=True, zz=False)
nodeedit_2 = EditNode(Node=support_4, NodeNumber=py3_25.pinned_ID, Mode=1)  # -> Node, NodeNumber, NodePosition, NodeLocalAxis, NodeRestraints, DamperProperty, MassProperty, SpringProperty, NodeName, NodeColour
mem1d_3 = Create1DMember(
    Curve=py3_25.Cables_con,
    Preview3dSection=False,
    x1=False,
    x2=False,
    xx1=False,
    xx2=False,
    y1=False,
    y2=False,
    yy1=False,
    yy2=False,
    z1=False,
    z2=False,
    zz1=False,
    zz2=False)
gate = StreamGate(Stream=nodeedit_2.Node, Gate=py3_26.C)  # -> Target0, Target1
model_5 = CreateModel(ModelSListsAndGridLines=gwa_4.Model, GSAGeometryIn_m=flatten(gate.Target1), ReMesh=True, Tolerance=0.01, Unit="m")
mem1d_4 = Create1DMember(
    Curve=py3_25.top_cables,
    Preview3dSection=False,
    x1=False,
    x2=False,
    xx1=False,
    xx2=False,
    y1=False,
    y2=False,
    yy1=False,
    yy2=False,
    z1=False,
    z2=False,
    zz1=False,
    zz2=False)

support_7 = CreateSupport(Point=py3_25.overhead_nodes, Plane=PlaneXY(0, 0, 0), x=False, xx=False, y=False, yy=False, z=False, zz=False)

nodeedit_3 = EditNode(Node=[support_6, support_5, support_7], NodeNumber=py3_25.Id_nodes, Mode=1)  # -> Node, NodeNumber, NodePosition, NodeLocalAxis, NodeRestraints, DamperProperty, MassProperty, SpringProperty, NodeName, NodeColour
elemfrommem_3 = CreateElementsFromMembers(Nodes_m=flatten([nodeedit_3.Node, nodeedit.Node]), _1DMembers_m=mem1d_3, Tolerance=0.001, Unit="m")  # -> Nodes, _1DElements, _2DElements, _3DElements, GSAModel
elem1dedit_4 = Edit1DElement(Element1D=elemfrommem_3._1DElements, Number=py3_25.ID_cables_elements, Preview3dSection=False)  # -> Element1D, Number, Line, Property, Group, Type, Offset, StartRelease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
py3_27 = Python3Script(ID=elem1dedit_4.Number, Tp=elem1dedit_4.Topology, Id_set=py3_25.ID_cables_set, cable_data=py3_25.Cable_props)  # -> out, Cable_def, New_cable_el; inputs ID: list, Tp: tree, Id_set: list, cable_data: list
# ---------- py3_27: Python ----------
import math

New_cable_el=[]
c=0
node_start=[]
node_end=[]

AE=float(cable_data[1])*(float(cable_data[0])/2)**2*math.pi
mass=float(cable_data[2])*(float(cable_data[0])/2)**2*math.pi

Cable_def=[]
for i in Id_set:
    text="SET,PROP_CABLE.5,{num},Cable prop. 1,NO_RGB,{stiff},{mass},SLIDING,0,1,NO_ENV".format(num=i,stiff=AE,mass=mass)
    Cable_def.append(text)


for i in range(Tp.BranchCount):
    path = Tp.Paths[i]
    branch = Tp.Branches[i]
    node_start.append(branch[0])
    node_end.append(branch[1])

for i in range(len(ID)):
    text="SET,EL.4,{id},,NO_RGB,CABLE,{prop},1,{st},{en},0,0,NO_RLS,0,0,0,0,,".format(id=ID[i],prop=Id_set[i],st=node_start[i],en=node_end[i])
    c=c+1
    New_cable_el.append(text)
# ---------- end py3_27 ----------
elemfrommem_4 = CreateElementsFromMembers(Nodes_m=flatten([nodeedit.Node, nodeedit_3.Node]), _1DMembers_m=mem1d_4, Tolerance=0.001, Unit="m")  # -> Nodes, _1DElements, _2DElements, _3DElements, GSAModel
gate_2 = StreamGate(Stream=flatten(nodeedit_3.Node), Gate=py3_26.A)  # -> Target0, Target1
gate_3 = StreamGate(Stream=flatten([py3_27.Cable_def, py3_27.New_cable_el]), Gate=py3_26.A)  # -> Target0, Target1
model_6 = CreateModel(ModelSListsAndGridLines=model_5, GSAGeometryIn_m=gate_2.Target1, ReMesh=True, Tolerance=0.01, Unit="m")
elem1dedit_5 = Edit1DElement(Element1D=elemfrommem_4._1DElements, Number=py3_25.ID_cables_elements_top, Preview3dSection=False)  # -> Element1D, Number, Line, Property, Group, Type, Offset, StartRelease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
py3_28 = Python3Script(ID=elem1dedit_5.Number, Tp=elem1dedit_5.Topology, Id_set=py3_25.ID_cables_set_top, cable_data=py3_25.Cable_props)  # -> out, Cable_def, New_cable_el; inputs ID: list, Tp: tree, Id_set: list, cable_data: list
# ---------- py3_28: Python ----------
import math

New_cable_el=[]
c=0
node_start=[]
node_end=[]

AE=float(cable_data[1])*(float(cable_data[0])/2)**2*math.pi
mass=float(cable_data[2])*(float(cable_data[0])/2)**2*math.pi

Cable_def=[]
for i in Id_set:
    text="SET,PROP_CABLE.5,{num},Cable prop. 1,NO_RGB,{stiff},{mass},SLIDING,0,1,NO_ENV".format(num=i,stiff=AE,mass=mass)
    Cable_def.append(text)

Total_el=len(ID)/len(Id_set)

if len(Id_set) > 0:
        repeats = int(len(ID)/len(Id_set))
        extra = len(ID) - repeats * len(Id_set)
        el_sorted = []

        for idx, pt in enumerate(Id_set):
            count = repeats + (1 if idx < extra else 0)
            el_sorted.extend([pt] * count)
else:
    el_sorted = []

for i in range(Tp.BranchCount):
    path = Tp.Paths[i]
    branch = Tp.Branches[i]
    node_start.append(branch[0])
    node_end.append(branch[1])

for i in range(len(ID)):
    text="SET,EL.4,{id},,NO_RGB,CABLE,{prop},1,{st},{en},0,0,NO_RLS,0,0,0,0,,".format(id=ID[i],prop=el_sorted[i],st=node_start[i],en=node_end[i])
    c=c+1
    New_cable_el.append(text)
# ---------- end py3_28 ----------
gate_4 = StreamGate(Stream=flatten([py3_28.Cable_def, py3_28.New_cable_el]), Gate=py3_26.B)  # -> Target0, Target1
gwa_5 = GWACommand(GSAModel=model_6, GWAString=flatten([gate_4.Target1, gate_3.Target1, "Null"]))  # -> Model, ReturnedResult

model_7 = CreateModel(ModelSListsAndGridLines=gwa_5.Model, ReMesh=True, Tolerance=0.01, Unit="m")
gwa_6 = GWACommand(GSAModel=model_7, GWAString=flatten("Null"))  # -> Model, ReturnedResult

py3_29 = Python3Script(Loading_data=merge_5, Pt=nodeedit.NodePosition)  # -> out, wedown, snow, weup; inputs Loading_data: list, Pt: list of Point3d
# ---------- py3_29: Python ----------
## Wind loading calcuations
v_map=float(Loading_data[0])
if Pt:
    z_values = [pt.Z for pt in Pt]
    height = max(z_values)
else:
    height = None
calt=1+0.001*height
v0=calt*v_map
qb=0.613*v0**2/1000
qp=qb*float(Loading_data[1])*float(Loading_data[2])
weup=qp*1.3
wedown=-qp*0.9



snow=-1*float(Loading_data[3])
# ---------- end py3_29 ----------
loadcase_2 = CreateLoadCase(CaseID="5", Name="snow", Type="Snow")
loadcase_3 = CreateLoadCase(CaseID="3", Name="wind_dw", Type="Wind")
loadcase_4 = CreateLoadCase(CaseID="4", Name="wind_up", Type="Wind")
faceload = CreateFaceLoad(
    LoadCase=loadcase_3,
    Loadable2DObjects="all",
    Name="wind_dw",
    Axis=-1,
    Direction="z",
    Projected=False,
    Value_kN_m²=py3_29.wedown,
    Type="Uniform",
    Unit="kN/m²")
faceload_2 = CreateFaceLoad(
    LoadCase=loadcase_4,
    Loadable2DObjects="all",
    Name="wind_up",
    Axis=-1,
    Direction="z",
    Projected=False,
    Value_kN_m²=py3_29.weup,
    Type="Uniform",
    Unit="kN/m²")
faceload_3 = CreateFaceLoad(
    LoadCase=loadcase_2,
    Loadable2DObjects="all",
    Name="snow",
    Axis=0,
    Direction="z",
    Projected=False,
    Value_kN_m²=py3_29.snow,
    Type="Uniform",
    Unit="kN/m²")
relay_7 = Relay([faceload, faceload_2])
σa_2 = CreateAnalysisCase(Name="sw+wind_dw", Description="L2+L3+L1")
σa_3 = CreateAnalysisCase(Name="sw+snow", Description="L2+L5+L1")
σa_4 = CreateAnalysisCase(Name="sw+wind_up", Description="L2+L4+L1")
σt_2 = CreateAnalysisTask(TaskID="2", Name="non_linear_analysis", AnalysisCases=flatten([σa_2, σa_3, σa_4]), casesParamIndex=2, Solver="Static")
relay_8 = Relay([relay_7, faceload_3])
model_8 = CreateModel(
    ModelSListsAndGridLines=gwa_6.Model,
    Load=flatten(relay_8),
    AnalysisTasksCombinations=σt_2,
    ReMesh=True,
    Tolerance=0.01,
    Unit="m")

model_9 = CreateModel(ModelSListsAndGridLines=gwa_6.Model, ReMesh=True, Tolerance=0.01, Unit="m")
save_2 = SaveGSAModel(GSAModel=model_8, Save=True)
getgeo_3 = GetModelGeometry(GSAModel=model_9, Mode=1, Unit="m")  # -> NodesIn_m, _1DElementsIn_m, _2DElementsIn_m, _3DElementsIn_m, _1DMembersIn_m, _2DMembersIn_m, _3DMembersIn_m, Assemblies
getprops = GetModelProperties(GSAModel=model_9)  # -> Sections, _2DProperties, _3DProperties, SpringProperties
preview3d = Preview3DSections(ElementMember1D2D=getgeo_3._1DElementsIn_m)  # -> AnalysisLayerMesh, AnalysisLayerOutlines, DesignLayerMesh, DesignLayerOutlines
