# Grasshopper definition Iteration_8_Grashopper.gh (Grasshopper 1.0.8)
# plug-ins: GSA

# ---- group: Geometry Data
lenght = Slider(300, range=0..1000)
width = Slider(130, range=0..1000)
number_of_columns = Slider(10, range=0..20)
height_of_columns = Slider(15, range=0..100)
hole_radius = Slider(3, range=0..10)
distance_between_edge_and_columns = Slider(15, range=0..100)
merge = Merge(
    Data1=lenght,
    Data2=width,
    Data3=distance_between_edge_and_columns,
    Data4=number_of_columns,
    Data5=height_of_columns,
    Data6=hole_radius)

# ---- group: Presstress
prestress_xdir_n_m = Slider(30, range=0..500)
prestress_ydir_n_m = Slider(30, range=0..500)
prestress_cables_kn = Slider(5, range=0..1000)
merge_2 = Merge(Data1=prestress_xdir_n_m, Data2=prestress_ydir_n_m, Data3=prestress_cables_kn)

# ---- group: Fabric Properties
material_number = Panel("1")
poisson_s_ratio = Panel("0.3")
fabric_name = Panel("Fabric x")
warp_strenght_kn_m = Panel("1000")
weave_strenght_kn_m = Panel("650")
shear_modulus_kn_m = Panel("40")
density_tonnes_m_2 = Panel("0.01")
merge_3 = Merge(
    Data1=material_number,
    Data2=fabric_name,
    Data3=warp_strenght_kn_m,
    Data4=weave_strenght_kn_m,
    Data5=poisson_s_ratio,
    Data6=shear_modulus_kn_m,
    Data7=density_tonnes_m_2)

# ----
young_modulus_n_m_2 = Panel("150000000000")
density_kg_m_2 = Panel("0.1")
diameter_m = Panel("0.1")
merge_4 = Merge(Data1=diameter_m, Data2=young_modulus_n_m_2, Data3=density_kg_m_2)

wind_vb_map_m_s = Panel("23")
wind_cez = Panel("2.8")
snow_loading_kn_m_2 = Panel("0.6")
wind_cet = Panel("1")
merge_5 = Merge(Data1=wind_vb_map_m_s, Data2=wind_cez, Data3=wind_cet, Data4=snow_loading_kn_m_2)

supension_cables = BooleanToggle(True)
cable_satyed_cables = BooleanToggle(False)
bottom_connection_ofset = Slider(30, range=0..50)
supports_on_ridge_cable = Slider(5, range=0..20)
height_over_roof = Slider(7, range=0..20)
diameter_m_2 = Panel("0.1")
young_modulus_n_m_2_2 = Panel("150000000000")
density_kg_m_2_2 = Panel("0.1")
merge_6 = Merge(
    Data1=supports_on_ridge_cable,
    Data2=supension_cables,
    Data3=cable_satyed_cables,
    Data4=height_over_roof,
    Data5=diameter_m_2,
    Data6=young_modulus_n_m_2_2,
    Data7=density_kg_m_2_2,
    Data8=bottom_connection_ofset)

roof_clearence = Slider(20, range=0..50)
bottom_taper = Slider(1, range=0..5)
top_taper = Slider(0.5, range=0..5)
connection_taper = Slider(0.25, range=0..5)
thickness = Slider(0.1, range=0..1)
merge_7 = Merge(Data1=roof_clearence, Data2=bottom_taper, Data3=top_taper, Data4=connection_taper, Data5=thickness)

int = Integer(merge)
py3 = Python3Script(Geometric_Data=int)  # -> out, xdir_start, xdir_end, xdir_name, ydir_start, ydir_end, ydir_name; inputs Geometric_Data: list
# ---------- py3: Python ----------
import rhinoscriptsyntax as rs
import string

# Example: Geometric_Data = [length, width, distance_col, number_col, height_col, radius]
length, width, distance_col, number_col, height_col, radius = (
    int(Geometric_Data[0]),
    int(Geometric_Data[1]),
    Geometric_Data[2],
    Geometric_Data[3],
    Geometric_Data[4],
    Geometric_Data[5] + 0.01
)


def excel_labels(n):
    alphabet = string.ascii_uppercase  # Uppercase for grid names (A, B, C, ... AA)
    labels = []
    i = 0
    while len(labels) < n:
        temp = i
        s = ""
        while True:
            temp, r = divmod(temp, 26)
            s = alphabet[r] + s
            if temp == 0:
                break
            temp -= 1
        labels.append(s)
        i += 1
    return labels

# ------------------------
# X direction (columns)
# ------------------------
xdir_start = []
xdir_end = []
xdir_name = []

x_points = [0, distance_col, width/2, width - distance_col, width]

for x in x_points:
    xdir_start.append(rs.CreatePoint(x, -1, 0))
    xdir_end.append(rs.CreatePoint(x, length + 1, 0))

xdir_name = [str(i + 1) for i in range(len(x_points))]

# ------------------------
# Y direction (rows)
# ------------------------
nodes_side = number_col * 2
ydir_start = []
ydir_end = []
ydir_name = []

for i in range(nodes_side + 1):
    y = (length / nodes_side) * i
    ydir_start.append(rs.CreatePoint(-1, y, 0))
    ydir_end.append(rs.CreatePoint(width + 1, y, 0))

ydir_name = excel_labels(nodes_side + 1)


print("Grid generated successfully.")
# ---------- end py3 ----------
ln = Line(StartPoint=py3.xdir_start, EndPoint=py3.xdir_end)
ln_2 = Line(StartPoint=py3.ydir_start, EndPoint=py3.ydir_end)
creategridline = CreateGridLine(Curve=ln, Label=py3.xdir_name)
creategridline_2 = CreateGridLine(Curve=ln_2, Label=py3.ydir_name)

int_2 = Integer(merge)
mesh = Slider(1, range=0..10000)
py3_2 = Python3Script(Geometric_Data=int_2, Mesh=mesh)  # -> out, X, Y, x, y, edge_nodes_line, U, V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; inputs Geometric_Data: list, Mesh: Int32
# ---------- py3_2: Python ----------
import rhinoscriptsyntax as rs
lenght,width,distance_col,number_col,height_col,Radius=int(Geometric_Data[0]),int(Geometric_Data[1]),Geometric_Data[2],Geometric_Data[3],Geometric_Data[4],Geometric_Data[5]+0.01
Danger_zone=Radius+0.5
nodes_side=number_col*2
Y=lenght
X=width
U=X*Mesh
V=Y*Mesh
height=rs.CreateVector(0,0,height_col)
Mesh=1/Mesh

x,y=[],[]
for i in range(nodes_side+1):
    if i%2 ==0:
        nada=("nada")
    else:
        x.append("{} to {}".format(distance_col-(Radius+Mesh/2),distance_col+(Radius+Mesh/2)))
        y_point=(lenght/nodes_side)*i
        y.append("{} to {}".format(y_point-(Radius+Mesh/2),y_point+(Radius+Mesh/2)))
for i in range(nodes_side+1):
    if i%2 ==0:
        nada=("nada")
    else:
        x.append("{} to {}".format(width-distance_col-(Radius+Mesh/2),width-distance_col+(Radius+Mesh/2)))
        y_point=(lenght/nodes_side)*i
        y.append("{} to {}".format(y_point-(Radius+Mesh/2),y_point+(Radius+Mesh/2)))


edge_nodes,edge_nodes_line,centre_point_circle,circle_nodes=[],[],[],[]
for i in range(nodes_side+1):
    if i%2==0:
        edge_nodes.append(rs.CreatePoint(distance_col, (lenght/nodes_side)*i,0))
        edge_nodes_line.append(rs.CreatePoint(distance_col, (lenght/nodes_side)*i,0))
    else:
        edge_nodes.append(rs.CreatePoint(0, (lenght/nodes_side)*i,0))
        edge_nodes_line.append(rs.CreatePoint(0, (lenght/nodes_side)*i-Mesh,0))
        edge_nodes_line.append(rs.CreatePoint(0, (lenght/nodes_side)*i+Mesh,0))
        centre_point_circle.append(rs.CreatePoint(distance_col, (lenght/nodes_side)*i,0))
        circle_nodes.append(rs.CreatePoint(distance_col-Radius, (lenght/nodes_side)*i,height_col))
        circle_nodes.append(rs.CreatePoint(distance_col+Radius, (lenght/nodes_side)*i,height_col))
for i in range(nodes_side,-1,-1):
    if i%2==0:
        edge_nodes.append(rs.CreatePoint(width-distance_col, (lenght/nodes_side)*i,0))
        edge_nodes_line.append(rs.CreatePoint(width-distance_col, (lenght/nodes_side)*i,0))
    else:
        edge_nodes.append(rs.CreatePoint(width,(lenght/nodes_side)*i,0))
        edge_nodes_line.append(rs.CreatePoint(width,(lenght/nodes_side)*i+Mesh,0))
        edge_nodes_line.append(rs.CreatePoint(width,(lenght/nodes_side)*i-Mesh,0))
        centre_point_circle.append(rs.CreatePoint(width-distance_col, (lenght/nodes_side)*i,0))
        circle_nodes.append(rs.CreatePoint(width-distance_col-Radius, (lenght/nodes_side)*i,height_col))
        circle_nodes.append(rs.CreatePoint(width-distance_col+Radius, (lenght/nodes_side)*i,height_col))

A=[rs.CreatePoint(distance_col, 0,0),rs.CreatePoint(distance_col, lenght,0)]
B=[rs.CreatePoint(width-distance_col, 0,0),rs.CreatePoint(width-distance_col,lenght,0)]
At=rs.CreateVector((width-distance_col)/10,0,height_col/4)
Ab=rs.CreateVector(-(width-distance_col)/10,0,height_col/4)


SQ1,SQ2=[],[]
SQ1.append("{} to {}".format(-Mesh/2,X+Mesh/2))
SQ2.append("{} to {}".format(-Mesh/2,Mesh/2))
SQ1.append("{} to {}".format(-Mesh/2,X+Mesh/2))
SQ2.append("{} to {}".format(Y-Mesh/2,Y+Mesh/2))

edge_edge=[]
edge_edge.append(rs.CreatePoint(distance_col,0,0))
edge_edge.append(rs.CreatePoint(distance_col,lenght,0))
edge_edge.append(rs.CreatePoint(width-distance_col,0,0))
edge_edge.append(rs.CreatePoint(width-distance_col,lenght,0))
# ---------- end py3_2 ----------
pline = PolyLine(Vertices=py3_2.edge_nodes_line, Closed=True)
planesrf = PlaneSurface(Plane=PlaneXY(0, 0, 0), XSize=py3_2.X, YSize=py3_2.Y)
rectangle = Rectangle(Plane=PlaneXY(0, 0, 0), XSize=py3_2.x, YSize=py3_2.y, Radius=0)  # -> Rectangle, Length
relay = Relay([py3_2.edge_nodes, py3_2.circle_nodes])
sdiff = SolidDifference(BrepsA=planesrf, BrepsB=rectangle.Rectangle)
circle = CircleCNR(Center=py3_2.centre_point_circle, Normal=Vector(0, 0, 1), Radius=py3_2.Radius)
mesh_uv = MeshSurface(Surface=sdiff, UCount=py3_2.U, VCount=py3_2.V, Overhang=True, Equalize=False)
demesh = DeconstructMesh(Mesh=mesh_uv)  # -> Vertices, Faces, Colours, Normals
incurve = PointInCurve(Point=demesh.Vertices, Curve=pline)  # -> Relationship, Point
py3_3 = Python3Script(R=incurve.Relationship)  # -> out, a; inputs R: list
# ---------- py3_3: Python ----------
a=[]
for i in range(len(R)):
    if R[i]==0:
        a.append(i)
print(a)
# ---------- end py3_3 ----------
deletev = DeleteVertices(Mesh=mesh_uv, Indices=py3_3.a, Shrink=False)
demesh_2 = DeconstructMesh(Mesh=deletev)  # -> Vertices, Faces, Colours, Normals
rectangle_2 = Rectangle(Plane=PlaneXY(0, 0, 0), XSize=py3_2.SQ1, YSize=py3_2.SQ2, Radius=0)  # -> Rectangle, Length
incurve_2 = PointInCurve(Point=demesh_2.Vertices, Curve=graft(rectangle.Rectangle))  # -> Relationship, Point
incurve_3 = PointInCurve(Point=demesh_2.Vertices, Curve=graft(rectangle_2.Rectangle))  # -> Relationship, Point
bzspan = BezierSpan(StartPoint=py3_2.A, StartTangent=py3_2.At, EndPoint=py3_2.B, EndTangent=py3_2.Ab)  # -> Curve, Length, Domain
nv = NakedVertices(Mesh=deletev)  # -> ClothedIndex, NakedIndex, ClothedPts, NakedPts
py3_4 = Python3Script(R=incurve_2.Relationship)  # -> out, a; inputs R: tree
# ---------- py3_4: Python ----------
from Grasshopper import DataTree
from Grasshopper.Kernel.Data import GH_Path

# R = input tree
# Collect all branches
branches = [list(R.Branch(i)) for i in range(R.BranchCount)]

# Transpose: element-wise grouping across branches
transposed = zip(*branches)

result = []
for group in transposed:
    vals = set(group)
    if vals == {0}:
        result.append(0)
    elif 2 in vals:
        result.append(2)
    else:
        result.append(1)

a = result  # flat list output
print(a)
# ---------- end py3_4 ----------
py3_5 = Python3Script(R=incurve_3.Relationship)  # -> out, a; inputs R: tree; same code as py3_4
py3_6 = Python3Script(R1=py3_4.a, R2=py3_5.a, ID=nv.NakedIndex, Pt=nv.NakedPts)  # -> out, I, P; inputs R1: list, R2: list, ID: list, Pt: list
# ---------- py3_6: Python ----------
b=-1
I,P=[],[]
for i in range(len(R1)):
    if i in ID:
        b=b+1
        if R1[i] ==0 and R2[i]==0:
            print(i)
            I.append(ID[b])
            P.append(Pt[b])
# ---------- end py3_6 ----------
py3_7 = Python3Script(R=py3_4.a, P=demesh_2.Vertices, C=circle)  # -> out, Pt, Seg; inputs R: list, P: list, C: list
# ---------- py3_7: Python ----------
Pt =[]
for i in range(len(R)):
    if R[i] in [1,2]:
        Pt.append(P[i])
print(Pt)
Seg=len(Pt)/len(C)
# ---------- end py3_7 ----------
py3_8 = Python3Script(R=py3_5.a, P=demesh_2.Vertices, C=bzspan.Curve)  # -> out, Pt, Seg; inputs R: list, P: list, C: list
# ---------- py3_8: Python ----------
Pt =[]
for i in range(len(R)):
    if R[i] in [1,2]:
        Pt.append(P[i])
print(Pt)
Seg=len(Pt)/len(C)-1
# ---------- end py3_8 ----------
divide = DivideCurve(Curve=bzspan.Curve, Count=py3_8.Seg, Kinks=False)  # -> flatten(Points), Tangents, Parameters
divide_2 = DivideCurve(Curve=circle, Count=py3_7.Seg, Kinks=False)  # -> Points, Tangents, Parameters
py3_9 = Python3Script(A=py3_7.Pt, B=flatten(divide_2.Points))  # -> out, ClosestB; inputs A: list of Point3d, B: list of Point3d
# ---------- py3_9: Python ----------
# requirements: numpy
# requirements: scipy

import Rhino.Geometry as rg
import numpy as np
from scipy.optimize import linear_sum_assignment

# Convert input points to Point3d
A_pts = [pt.Location if hasattr(pt, "Location") else pt for pt in A]
B_pts = [pt.Location if hasattr(pt, "Location") else pt for pt in B]

# Make distance matrix
dist_matrix = np.zeros((len(A_pts), len(B_pts)))
for i, a in enumerate(A_pts):
    for j, b in enumerate(B_pts):
        dist_matrix[i, j] = a.DistanceTo(b)

# Solve assignment problem
row_ind, col_ind = linear_sum_assignment(dist_matrix)

# Output corresponding B points
ClosestB = [B_pts[j] for j in col_ind]
# ---------- end py3_9 ----------
py3_10 = Python3Script(A=py3_8.Pt, B=divide.Points)  # -> out, ClosestB; inputs A: list of Point3d, B: list of Point3d; same code as py3_9
py3_11 = Python3Script(x=py3_6.P, edge=py3_2.edge_edge)  # -> out, pt; inputs x: list, edge: list
# ---------- py3_11: Python ----------
import Grasshopper as gh

mid = (len(x) + 1) // 2
a = x[:mid]
a.insert(0,edge[0])
a.append(edge[1])
b = x[mid:]
b.insert(0,edge[2])
b.append(edge[3])

# Combine into a tree
tree = gh.DataTree[object]()
tree.AddRange(a, gh.Kernel.Data.GH_Path(0))
tree.AddRange(b, gh.Kernel.Data.GH_Path(1))

pt = tree
print(pt)
# ---------- end py3_11 ----------
py3_12 = Python3Script(x=py3_10.ClosestB)  # -> out, groupedPts; inputs x: list of Point3d
# ---------- py3_12: Python ----------
import Rhino.Geometry as rg
import Grasshopper as gh

# Create output DataTree
groupedPts = gh.DataTree[object]()
tol = 1e-6  # tolerance for Y comparison

# Flatten all points into a list
try:
    all_pts = [pt for path in x.Paths for pt in x.Branch(path)]
except:
    all_pts = list(x)  # if input is just a flat list

# Sort by Y (ascending)
pts_sorted_y = sorted(all_pts, key=lambda p: p.Y)
# Group by Y
rows = []
current_row = []
current_y = None

for p in pts_sorted_y:
    if current_y is None or abs(p.Y - current_y) < tol:
        current_row.append(p)
        if current_y is None:
            current_y = p.Y
    else:
        rows.append(current_row)
        current_row = [p]
        current_y = p.Y
if current_row:
    rows.append(current_row)

# Sort each row by X and add to DataTree
for i, row in enumerate(rows):
    sorted_row = sorted(row, key=lambda p: p.X)
    path = gh.Kernel.Data.GH_Path(i)
    groupedPts.AddRange(sorted_row, path)
# ---------- end py3_12 ----------
py3_13 = Python3Script(x=py3_11.pt)  # -> out, sortedPts; inputs x: tree of Point3d
# ---------- py3_13: Python ----------
import Rhino.Geometry as rg
import Grasshopper as gh

sortedPts = gh.DataTree[object]()
tol = 1e-6  # tolerance for floating point comparison

for path in x.Paths:
    pts = list(x.Branch(path))
    
    # Step 1: Sort points by Y ascending
    pts_sorted_y = sorted(pts, key=lambda p: p.Y)
    
    # Step 2: Group by Y (rows)
    rows = []
    current_row = []
    current_y = None
    for p in pts_sorted_y:
        if current_y is None or abs(p.Y - current_y) < tol:
            current_row.append(p)
            if current_y is None:
                current_y = p.Y
        else:
            rows.append(current_row)
            current_row = [p]
            current_y = p.Y
    if current_row:
        rows.append(current_row)
    
    # Step 3: Traverse points preferring same-Y then closest distance
    result = []
    prev_pt = None
    remaining = [p for row in rows for p in row]
    
    while remaining:
        if prev_pt is None:
            # Start with the lowest-leftmost point
            p = min(remaining, key=lambda p: (p.Y, p.X))
        else:
            # Find candidates with same Y first
            same_y_candidates = [q for q in remaining if abs(q.Y - prev_pt.Y) < tol]
            if same_y_candidates:
                p = min(same_y_candidates, key=lambda q: prev_pt.DistanceTo(q))
            else:
                # Otherwise, choose the closest point overall
                p = min(remaining, key=lambda q: prev_pt.DistanceTo(q))
        
        result.append(p)
        remaining.remove(p)
        prev_pt = p
    
    sortedPts.AddRange(result, path)
# ---------- end py3_13 ----------
move = Move(Geometry=py3_9.ClosestB, Motion=py3_2.height)  # -> Geometry, Transform
py3_14 = Python3Script(R1=py3_4.a, P=demesh_2.Vertices, G1=move.Geometry, R2=py3_5.a, G2=py3_10.ClosestB)  # -> out, V; inputs R1: list, P: list, G1: list, R2: list, G2: list
# ---------- py3_14: Python ----------
V = []
c = d = e = 0

# Precompute lengths to avoid recomputing len(P)
for i, p_val in enumerate(P):
    if R1[i] in (1, 2):
        V.append(G1[c])
        c += 1
    elif R2[i] in (1, 2):
        V.append(G2[d])
        d += 1
    else:
        V.append(p_val)

print(c, d, e)
# ---------- end py3_14 ----------
conmesh = ConstructMesh(Vertices=py3_14.V, Faces=demesh_2.Faces)
msmooth = SmoothMesh(Mesh=conmesh, Strength=0.5, SkipNaked=True, Iterations="10000")
py3_15 = Python3Script(treeA=py3_12.groupedPts, treeB=py3_13.sortedPts)  # -> out, V; inputs treeA: tree, treeB: tree
# ---------- py3_15: Python ----------
import Grasshopper as gh
from Grasshopper.Kernel.Data import GH_Path

# Create a new DataTree
merged_tree = gh.DataTree[object]()

# --- Add all branches from treeA ---
for i in range(treeA.BranchCount):
    pathA = treeA.Path(i)
    dataA = treeA.Branch(i)
    merged_tree.AddRange(dataA, pathA)

# --- Add all branches from treeB, offsetting their paths ---
offset = treeA.BranchCount  # start numbering after the last branch of A

for i in range(treeB.BranchCount):
    pathB = treeB.Path(i)
    dataB = treeB.Branch(i)
    
    # Create a new path that continues after treeA’s branches
    new_path = GH_Path(offset + i)
    
    merged_tree.AddRange(dataB, new_path)

# Output the concatenated DataTree
V = merged_tree
# ---------- end py3_15 ----------
move_2 = Move(Geometry=divide_2.Points, Motion=py3_2.height)  # -> Geometry, Transform
mat = CreateMaterial(Material_type="Fabric", Grade="Taconic Solus 1410")
demesh_3 = DeconstructMesh(Mesh=msmooth)  # -> Vertices, Faces, Colours, Normals
prop2d = Create2DProperty(Material=mat, Type="Fabric")
support = CreateSupport(Point=demesh_3.Vertices, Plane=PlaneXY(0, 0, 0), x=False, xx=False, y=False, yy=False, z=False, zz=False)
elem2d = Create2DElement(Geometry=msmooth, Property2D=prop2d, Preview3dSection=False)

relay_2 = Relay([creategridline, creategridline_2])
support_2 = CreateSupport(Point=flatten(py3_10.ClosestB), Plane=PlaneXY(0, 0, 0), x=False, xx=False, y=False, yy=False, z=False, zz=False)
support_3 = CreateSupport(Point=flatten([move.Geometry, relay]), Plane=PlaneXY(0, 0, 0), x=True, xx=False, y=True, yy=False, z=True, zz=False)
model = CreateModel(Properties=mat, GSAGeometryIn_m=flatten([elem2d, support]), ReMesh=False, Tolerance=0.01, Unit="m")
relay_3 = Relay([support_2, support_3])
txt = Text(merge_3)
py3_16 = Python3Script(Fabric_data=txt)  # -> out, mat_fab, prop_2D; inputs Fabric_data: list
# ---------- py3_16: Python ----------
#mat_fab="SET,MAT_FABRIC.11,{grade},{name},{warp},{fill},{pois},{shear},{density},0,MAT_ANAL.1,,-268435456,MAT_FABRIC,5,,{grade},{name},{warp},{fill},{pois},{shear},1,0,0,0,0,0,0,0,MAT_CURVE_PARAM.3,,UNDEF,0,0,0,0,0,0,1,1,MAT_CURVE_PARAM.3,,UNDEF,0,0,0,0,0,0,1,1,0,Fabric,NO".format(grade=Fabric_data[0],name=Fabric_data[1],warp=Fabric_data[2],fill=Fabric_data[3],pois=Fabric_data[4],shear=Fabric_data[5],density=Fabric_data[6])
mat_fab="SET,MAT_FABRIC.11,1,Taconic Solus,1120,960700,371700,0.57,48035,1.1,0,MAT_ANAL.1,Fabric,-268435456	MAT_FABRIC,5,960700	371700,0.57,48035,1.1,1	0,0,0,0,0,0,0,MAT_CURVE_PARAM.3,,UNDEF,0,0,0,0,0,0,1,1,MAT_CURVE_PARAM.3,,UNDEF,0,0,0,0,0,0,1,1,0,Fabric,NO"
print(mat_fab)
prop_2D="SET,PROP_2D.8,1,2D prop. 1,NO_RGB,FABRIC,GLOBAL,0,FABRIC,{grade},0,(mm),CENTROID,0,0,100%,100%,100%,100%".format(grade=Fabric_data[0])
print(prop_2D)
# ---------- end py3_16 ----------
relay_4 = Relay([py3_16.prop_2D, py3_16.mat_fab])

# ---- group: Assigning Pre_stress
int_3 = Integer(merge_2)
py3_17 = Python3Script(Prestress_Data=int_3)  # -> out, prestress_2D, prestress_1D; inputs Prestress_Data: list
# ---------- py3_17: Python ----------
X_dir,Y_dir, Cable =Prestress_Data[0], Prestress_Data[1],Prestress_Data[2]
prestress_2D = "SOAP_STRESS_2D , 1 , 2D_prestress , {a} , {b}".format(a=X_dir,b=Y_dir)
X_dir,Y_dir, Cable =Prestress_Data[0], Prestress_Data[1],Prestress_Data[2]
prestress_1D = "SOAP_STRESS_1D , 1 , 1D_prestress , local , {c}".format(c=Cable*1000)
print(prestress_2D)
print(prestress_1D)
# ---------- end py3_17 ----------

# ----
loadcase = CreateLoadCase(CaseID="1", Name="self_weight", Type="Dead")
gravityload = CreateGravityLoad(LoadCase=loadcase, LoadableObjects="all", Name="self_weight", GravityFactor=Vector(0, 0, -1))

σa = CreateAnalysisCase(Name="Form-finding", Description="L1")
σt = CreateAnalysisTask(TaskID="1", Name="Form-finding", AnalysisCases=σa, casesParamIndex=2, Solver="Static")

panel = Panel("SET,TASK.1,1,Form-finding,0,GSRELAX,FORM_FINDING,SOAP_FORM,1,BEAM_GEO_YES,SHELL_GEO_NO,0.1000000015,9.999999747e-05,0.1000000015,CYCLE,10000000,REL,1.000000047,1.000000047,DISP_CTRL_YES,0,1,0.009999999776,LOAD_CTRL_NO,1,none,1,10,100,RESID_NOCONV,DAMP_VISCOUS,0,0,1,1,1,1,AUTO_MASS_YES,AUTO_DAMP_YES,FF_SAVE_ELEM_FORCE_YES,FF_SAVE_SPACER_FORCE_TO_ELEM,SHOW_PROGRESS_SUM,SHOW_GRAPHIC_YES,DRCEFNSBUT")
panel_2 = Panel("C:\Users\santi\OneDrive - University of Glasgow\Year 5 Enginering\Dissertation\Just playing around with Rhino\GSA Tutorial\Deliverables\Iteration_8_GSA.gwb")
open = OpenModel(FilenameAndPath=panel_2)
gsa = Model(open)

getgeo = GetModelGeometry(GSAModel=gsa, Mode=1, Unit="m")  # -> NodesIn_m, _1DElementsIn_m, _2DElementsIn_m, _3DElementsIn_m, _1DMembersIn_m, _2DMembersIn_m, _3DMembersIn_m, Assemblies
elem2dedit = Edit2DElement(Element2D=getgeo._2DElementsIn_m, Preview3dSection=False)  # -> Element2D, Number, Geometry, _2DProperty, Group, ElementType, Offset, OrientationAngle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
nodeedit = EditNode(Node=getgeo.NodesIn_m, Mode=1)  # -> Node, NodeNumber, NodePosition, NodeLocalAxis, NodeRestraints, DamperProperty, MassProperty, SpringProperty, NodeName, NodeColour
py3_18 = Python3Script(ID_nodes=nodeedit.NodeNumber, Pt_node=nodeedit.NodePosition, ID_quad=elem2dedit.Number, Tp=elem2dedit.Topology)  # -> out, Reentrant_Quad_IDs, NonReentrant_Nodes; inputs ID_nodes: list, Pt_node: list of Point3d, ID_quad: list, Tp: tree
# ---------- py3_18: Python ----------
"""
Detect reentrant (concave) quadrilaterals robustly — orientation-safe version.
"""

import math
from Rhino.Geometry import Point3d, Vector3d
from Grasshopper import DataTree
from Grasshopper.Kernel.Data import GH_Path


def ensure_point(pt):
    if isinstance(pt, Point3d):
        return pt
    if hasattr(pt, "Location"):
        return pt.Location
    if hasattr(pt, "Geometry"):
        return pt.Geometry.Location
    if hasattr(pt, "__iter__") and len(pt) == 3:
        return Point3d(*pt)
    raise TypeError(f"Cannot convert to Point3d: {pt}")


def face_normal(pts):
    """Compute best-fit face normal for a quad."""
    normals = []
    for i in range(len(pts)):
        v1 = Vector3d(pts[(i+1)%len(pts)] - pts[i])
        v2 = Vector3d(pts[(i+2)%len(pts)] - pts[(i+1)%len(pts)])
        n = Vector3d.CrossProduct(v1, v2)
        if n.Length > 1e-6:
            n.Unitize()
            normals.append(n)
    if normals:
        avg = Vector3d(sum([n.X for n in normals]), sum([n.Y for n in normals]), sum([n.Z for n in normals]))
        avg.Unitize()
        return avg
    return Vector3d.ZAxis


Reentrant_Quad_IDs = []
NonReentrant_Nodes = DataTree[object]()

for i, qid in enumerate(ID_quad):
    try:
        node_ids = list(Tp.Branch(i))
    except:
        node_ids = list(Tp[i])

    pts = []
    for nid in node_ids:
        if nid in ID_nodes:
            pts.append(ensure_point(Pt_node[ID_nodes.index(nid)]))
    if len(pts) < 4:
        continue

    # Determine face normal (handles flipped orientation)
    normal = face_normal(pts)

    reentrant_indices = []

    for j in range(len(pts)):
        prev_pt = pts[(j - 1) % len(pts)]
        curr_pt = pts[j]
        next_pt = pts[(j + 1) % len(pts)]

        v1 = Vector3d(curr_pt - prev_pt)
        v2 = Vector3d(next_pt - curr_pt)

        v1.Unitize()
        v2.Unitize()

        # Angle via atan2 for signed sense
        cross = Vector3d.CrossProduct(v1, v2)
        dot = v1 * v2
        ang = math.degrees(math.atan2(cross.Length, dot))

        # If cross points opposite the face normal, the corner is concave
        if Vector3d.Multiply(cross, normal) < 0:
            ang = 360 - ang  # reflex angle

        # Mark as reentrant if angle > 180°
        if ang > 180:
            reentrant_indices.append(j)

    if reentrant_indices:
        Reentrant_Quad_IDs.append(qid)
        non_reentrant_nodes = [nid for k, nid in enumerate(node_ids) if k not in reentrant_indices]
        NonReentrant_Nodes.AddRange(non_reentrant_nodes, GH_Path(i))
# ---------- end py3_18 ----------
py3_19 = Python3Script(Node_Point=nodeedit.NodePosition, Geometric_Data=merge, Support_Data=merge_6)  # -> out, Fabric_Points; inputs Node_Point: list of Point3d, Geometric_Data: list, Support_Data: list
# ---------- py3_19: Python ----------
# requirements: numpy
# requirements: scipy

import rhinoscriptsyntax as rs
import numpy as np
from scipy.optimize import linear_sum_assignment

# --- Input unpacking ---
length, width, distance_col, number_col, height_col, radius = (
    float(Geometric_Data[0]),
    float(Geometric_Data[1]),
    float(Geometric_Data[2]),
    int(Geometric_Data[3]),
    float(Geometric_Data[4]),
    float(Geometric_Data[5]) + 0.01
)

supports = int(Support_Data[0]) + 1
nodes_side = number_col * 2
span = width - 2 * distance_col

# --- Create pinned nodes ---
Pinned_nodes = []
for i in range(nodes_side + 1):
    if i % 2 == 1:
        y = (length / nodes_side) * i
        for j in range(1, supports):
            x = distance_col + (span / supports) * j
            Pinned_nodes.append(rs.CreatePoint(x, y, 0))

# --- Distance matrix (XY only) ---
dist_matrix = np.zeros((len(Pinned_nodes), len(Node_Point)))
for i, a in enumerate(Pinned_nodes):
    for j, b in enumerate(Node_Point):
        dist_matrix[i, j] = ((a.X - b.X)**2 + (a.Y - b.Y)**2)**0.5

# --- Hungarian algorithm ---
row_ind, col_ind = linear_sum_assignment(dist_matrix)
Fabric_Points = [Node_Point[j] for j in col_ind]

# --- Output ---
print(Fabric_Points)
# ---------- end py3_19 ----------
py3_20 = Python3Script(ID=py3_18.Reentrant_Quad_IDs, Tp=py3_18.NonReentrant_Nodes)  # -> out, New_quad; inputs ID: list, Tp: tree
# ---------- py3_20: Python ----------
node_start=[]
node_mid=[]
node_end=[]

for i in range(Tp.BranchCount):
    branch = Tp.Branches[i]
    node_start.append(branch[0])
    node_mid.append(branch[1])
    node_end.append(branch[2])

New_quad=[]
for i in range(len(ID)):
    text="SET,EL.4,{IDs},,NO_RGB,TRI3,1,1,{st},{mid},{en},0,0,NO_RLS,0,0,0,0".format(IDs=ID[i],st=node_start[i],mid=node_mid[i],en=node_end[i])
    New_quad.append(text)
# ---------- end py3_20 ----------

py3_21 = Python3Script(ID=nodeedit.NodeNumber, Points_items=nodeedit.NodePosition, Fabric_points=py3_19.Fabric_Points)  # -> out, a, b; inputs ID: list, Points_items: list of Point3d, Fabric_points: list of Point3d
# ---------- py3_21: Python ----------
Fabric_points_set = set(Fabric_points)
a=[]
b=[]
for i, item in enumerate(Points_items):
    if item in Fabric_points_set:
           a.append(ID[i])
           b.append(item)
print(b)
# ---------- end py3_21 ----------

py3_22 = Python3Script(cable_data=merge_6)  # -> out, A; inputs cable_data: list
# ---------- py3_22: Python ----------
print(cable_data)
if cable_data[1] is True or cable_data[2] is True:
    A=True
else:
    A=False
# ---------- end py3_22 ----------
getgeo_2 = GetModelGeometry(GSAModel=gsa, Mode=1, Unit="m")  # -> NodesIn_m, _1DElementsIn_m, _2DElementsIn_m, _3DElementsIn_m, _1DMembersIn_m, _2DMembersIn_m, _3DMembersIn_m, Assemblies
nodeedit_2 = EditNode(Node=getgeo_2.NodesIn_m, NodeRestraints="free", Mode=1)  # -> Node, NodeNumber, NodePosition, NodeLocalAxis, NodeRestraints, DamperProperty, MassProperty, SpringProperty, NodeName, NodeColour
gate = StreamGate(Stream=flatten(nodeedit_2.Node), Gate=py3_22.A)  # -> Target0, Target1

no = Node(support)
mesh_2 = Mesh(msmooth)
demesh_4 = DeconstructMesh(Mesh=mesh_2)  # -> Vertices, Faces, Colours, Normals
deface = DeconstructFace(Face=demesh_4.Faces)  # -> CornerA, CornerB, CornerC, CornerD

nv_2 = NakedVertices(Mesh=mesh_2)  # -> ClothedIndex, NakedIndex, ClothedPts, NakedPts

cp = ClosestPoint(Point=flatten(nv_2.NakedPts), Cloud=demesh_4.Vertices)  # -> ClosestPoint, CPIndex, Distance
creata_points_for_polylines = Python3Script(V=demesh_4.Vertices, A=deface.CornerA, B=deface.CornerB, C=deface.CornerC, D=deface.CornerD, P=cp.CPIndex)  # -> out, u_count, v_count, V; inputs V: list, A: list, B: list, C: list, D: list, P: list
# ---------- creata_points_for_polylines: Python ----------
from Grasshopper import DataTree
from Grasshopper.Kernel.Data import GH_Path
from System import Object

def unique_preserve_order_iter(iterable):
    """Yield unique items from an iterable, preserving order."""
    seen = set()
    for item in iterable:
        if item not in seen:
            seen.add(item)
            yield item

def build_layer_paths(V, index_sets, P):
    """
    V: list of node values
    index_sets: list of tuples [(start_a, end_a, start_b, end_b), ...] for each layer
    P: list of indices -> segments where both start and end indices are in P will be removed
    
    Returns:
        all_paths: combined paths from all layers
        layer_counts: list of counts per layer
    """
    all_paths = []
    layer_counts = []

    for layer_num, (start_a, end_a, start_b, end_b) in enumerate(index_sets):
        # Merge start and end indices
        start_indices = start_a + start_b
        end_indices   = end_a + end_b

        # Build segments (indices) and filter out those where both ends are in P
        raw_segments = list(zip(start_indices, end_indices))
        segments = [(s, e) for s, e in raw_segments if not (s in P and e in P)]
        removed_segments = [seg for seg in raw_segments if seg not in segments]

        if removed_segments:
            print(f"Layer {layer_num+1} - removed segments (both ends in P): {removed_segments}")

        # Convert remaining segments to actual node values
        start = [V[i] for i, _ in segments]
        end   = [V[j] for _, j in segments]

        start_to_segment = {s: (s, e) for s, e in zip(start, end)}
        unvisited = set(start_to_segment.keys())
        layer_paths = []

        # Root nodes: start nodes not appearing as ends
        end_set = set(end)
        root_nodes = [s for s in start if s not in end_set]

        def traverse(root):
            path = []
            current = root
            while current in unvisited:
                if current not in start_to_segment:  # Segment removed → stop path
                    path.append(current)
                    break
                s, e = start_to_segment[current]
                path.append(s)
                unvisited.remove(current)
                current = e
                if current in path:  # Avoid cycles
                    path.append(current)
                    break
            if path and current not in path:
                path.append(current)
            return path

        # Traverse paths from roots
        for root in root_nodes:
            path = traverse(root)
            if path:
                layer_paths.append(path)

        # Traverse any remaining unvisited segments
        while unvisited:
            root = next(iter(unvisited))
            path = traverse(root)
            if path:
                layer_paths.append(path)

        all_paths.extend(layer_paths)
        layer_counts.append(len(layer_paths))  # Count for this layer

    return all_paths, layer_counts


# ----------------------------------------------------
# MAIN EXECUTION (Grasshopper inputs expected: V, A, B, C, D, P)
# ----------------------------------------------------

# Explicit segment assignments (indices)
# L1: C->B, D->A
# L2: D->C, A->B
layers = [
    (C, B, D, A),  # L1
    (D, C, A, B)   # L2
]

all_paths, layer_counts = build_layer_paths(V, layers, P)
u_count, v_count = layer_counts  # counts per layer

# Create Grasshopper DataTree
data_tree = DataTree[Object]()
for i, sublist in enumerate(all_paths):
    path = GH_Path(i)
    for item in sublist:
        data_tree.Add(item, path)

V = data_tree
# ---------- end creata_points_for_polylines ----------
pline_2 = PolyLine(Vertices=creata_points_for_polylines.V, Closed=False)  # -> flatten(Polyline)
py3_23 = Python3Script(M_in=mesh_2, PL=pline_2)  # -> out, A, B, V, Vr; inputs PL: list
# ---------- py3_23: Python ----------
import Rhino
import Rhino.Geometry as rg
import scriptcontext as sc
from Grasshopper import DataTree
from Grasshopper.Kernel.Data import GH_Path

# Inputs
# M_in : Mesh object or GUID
# PL   : List of polylines

# --- Step 1: Ensure we have a Mesh object ---
if isinstance(M_in, rg.Mesh):
    M = M_in
else:
    obj = sc.doc.Objects.Find(M_in)
    if obj is not None:
        M = obj.Geometry
    else:
        M = None

# --- Step 2: Convert PL inputs to actual Polylines ---
polylines = []
for pl in PL:
    if isinstance(pl, rg.Polyline):
        polylines.append(pl)
    elif isinstance(pl, rg.PolylineCurve):
        polylines.append(pl.ToPolyline())
    else:
        obj = sc.doc.Objects.Find(pl)
        if obj is not None:
            geo = obj.Geometry
            if isinstance(geo, rg.Polyline):
                polylines.append(geo)
            elif isinstance(geo, rg.PolylineCurve):
                polylines.append(geo.ToPolyline())

# --- Step 3: Get naked edges of the mesh ---
naked_edges = []
if M:
    naked_edges = M.GetNakedEdges()

# --- Step 4: Filter polylines by checking all vertices ---
kept = []
removed = []
tolerance = 1e-6

for pl in polylines:
    all_on_boundary = True
    for i in range(pl.Count):
        pt = pl[i]
        if not any(pt.DistanceTo(naked_pt) < tolerance for edge in naked_edges for naked_pt in edge):
            all_on_boundary = False
            break
    if all_on_boundary:
        removed.append(pl)
    else:
        kept.append(pl)

# --- Step 5: Create the DataTree V ---
V = DataTree[object]()
for i, pl in enumerate(kept):
    path = GH_Path(i)
    for pt in pl:
        V.Add(pt, path)

# --- Step 5: Create the DataTree Vr ---
Vr = DataTree[object]()
for i, pl in enumerate(removed):
    path = GH_Path(i)
    for pt in pl:
        Vr.Add(pt, path)

# --- Outputs ---
A = kept      # Interior polylines
B = removed   # Boundary polylines
# ---------- end py3_23 ----------
mem1d = Create1DMember(
    Curve=py3_23.A,
    Preview3dSection=False,
    x1=False,
    x2=False,
    xx1=False,
    xx2=False,
    y1=False,
    y2=False,
    yy1=False,
    yy2=False,
    z1=False,
    z2=False,
    zz1=False,
    zz2=False)
elemfrommem = CreateElementsFromMembers(Nodes_m=no, _1DMembers_m=mem1d, Tolerance=0.001, Unit="m")  # -> Nodes, _1DElements, _2DElements, _3DElements, GSAModel
obtaining_id_for_each_of_the_sublines = Python3Script(F=demesh_4.Faces, E1D=elemfrommem._1DElements)  # -> out, ID, eT; inputs F: list, E1D: list
# ---------- obtaining_id_for_each_of_the_sublines: Python ----------
##ID
ID=[]
for i in range(len(E1D)):
    ID.append(i+1+len(F))
print(ID)
## eT from documentation
eT=19
print(eT)
# ---------- end obtaining_id_for_each_of_the_sublines ----------
elem1dedit = Edit1DElement(
    Element1D=elemfrommem._1DElements,
    Number=obtaining_id_for_each_of_the_sublines.ID,
    Type=obtaining_id_for_each_of_the_sublines.eT,
    Preview3dSection=False)  # -> Element1D, Number, Line, Property, Group, Type, Offset, StartRelease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
spacer_properties = Python3Script(
    u_count=creata_points_for_polylines.u_count,
    v_count=creata_points_for_polylines.v_count,
    V=py3_23.V,
    B=py3_23.B,
    ID=elem1dedit.Number,
    Tp=elem1dedit.Topology)  # -> out, spacer_main, spacer_formatted; inputs V: tree, B: list, ID: list, Tp: tree
# ---------- spacer_properties: Python ----------
import math as math
from Grasshopper import DataTree
from Grasshopper.Kernel.Data import GH_Path

#spacer main
spacer_main=[]
u_count=int(u_count)
v_count=int(v_count)
series=list(range(1,u_count+v_count+1-len(B)))
for i in series:
    text="PROP_SPACER.2,{series},Spacer prop.{series},NO_RGB,0,GEODESIC,RATIO,1,1".format(series=i)
    spacer_main.append(text)
print(spacer_main)



#spacer formatted
## Getting the unique id for each line
property_number=[]
branch_length=[]
for i in range(V.BranchCount):
    branch_length.append(len(V.Branch(i)))

for i in range(1,u_count+1+v_count-len(B)):
    j=1
    while j <(branch_length[i-1]):
        property_number.append(i)
        j=j+1
print(property_number)

## Geting the start and end node for each subline 
node_start = []
node_end = []
for i in range(Tp.BranchCount):
    path = Tp.Paths[i]
    branch = Tp.Branches[i]
    node_start.append(branch[0])
    node_end.append(branch[1])

## Formating Text for GSA
spacer_formatted=[]

for i in range(len(ID)):
    text="SET,EL.4,{id},,NO_RGB,SPACER,{no},1,{st},{en},0,0,NO_RLS,0,0,0,0,,3".format(id=ID[i],no=property_number[i],st=node_start[i],en=node_end[i])
    spacer_formatted.append(text)
print(len(spacer_formatted))
print(len(ID))
# ---------- end spacer_properties ----------

no_2 = Node(support)
pt = Point(relay)
num = Number(merge_4)
pt_2 = Point(py3_15.V)
py3_24 = Python3Script(x=num)  # -> out, a; inputs x: list
# ---------- py3_24: Python ----------
a=x[0]
# ---------- end py3_24 ----------
py3_25 = Python3Script(V=creata_points_for_polylines.V, Pt=flatten(pt))  # -> out, P; inputs V: tree of Point3d, Pt: list of Point3d
# ---------- py3_25: Python ----------
from Grasshopper import DataTree
from Grasshopper.Kernel.Data import GH_Path

# Create a new DataTree
P = DataTree[object]()

# Counter for the new tree path
branch_index = 0

for i in range(V.BranchCount):
    branch = V.Branch(i)
    start_node = branch[0]
    for j in range(len(branch)):
        if j+1 == len(branch):
            end_node=branch[j]

    # Check if start_node is in start list and end_node is in end list
    if any(start_node.DistanceTo(s) < 1e-6 for s in Pt) and any(end_node.DistanceTo(e) < 1e-6 for e in Pt):
        path = GH_Path(branch_index)  # Create a new branch path
        for pt in branch:
            P.Add(pt, path)      # Add each point to this path
        branch_index += 1             # Increment path index for next branch

# Output the tree
print(P)
# ---------- end py3_25 ----------
py3_26 = Python3Script(treeA=pt_2, treeB=py3_25.P)  # -> out, V; inputs treeA: tree, treeB: tree; same code as py3_15
pline_3 = PolyLine(Vertices=py3_26.V, Closed=False)  # -> flatten(Polyline)
profile = CreateProfile(
    Diameter_cm=py3_24.a,
    catalogueIndex=-1,
    inclSS=False,
    lengthUnit="Centimeter",
    mode="Other",
    Profile_type="Circle",
    Measure="cm",
    typeIndex=-1)
mem1d_2 = Create1DMember(
    Curve=flatten(pline_3),
    Preview3dSection=False,
    x1=False,
    x2=False,
    xx1=False,
    xx2=False,
    y1=False,
    y2=False,
    yy1=False,
    yy2=False,
    z1=True,
    z2=False,
    zz1=False,
    zz2=False)
mat_2 = CreateMaterial(Material_type="Steel", Design_Code="EN 1993-1-1:2005", Grade="S235")
elemfrommem_2 = CreateElementsFromMembers(Nodes_m=no_2, _1DMembers_m=mem1d_2, Tolerance=0.001, Unit="m")  # -> Nodes, _1DElements, _2DElements, _3DElements, GSAModel
section = CreateSection(Profile=profile, Material=mat_2, Basic_Offset="Centroid")
obtaining_id_for_each_of_the_sublines_2 = Python3Script(F=obtaining_id_for_each_of_the_sublines.ID, E1D=elemfrommem_2._1DElements)  # -> out, ID, eT; inputs F: list, E1D: list
# ---------- obtaining_id_for_each_of_the_sublines_2: Python ----------
##ID
ID=[]
for i in range(len(E1D)):
    ID.append(i+1+F[-1])
print(ID)
## eT from documentation
eT=21
print(eT)
# ---------- end obtaining_id_for_each_of_the_sublines_2 ----------
elem1dedit_2 = Edit1DElement(
    Element1D=elemfrommem_2._1DElements,
    Number=obtaining_id_for_each_of_the_sublines_2.ID,
    Property=section,
    Type=obtaining_id_for_each_of_the_sublines_2.eT,
    Preview3dSection=False)  # -> Element1D, Number, Line, Property, Group, Type, Offset, StartRelease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

gwa = GWACommand(GSAModel=model, GWAString=flatten([spacer_properties.spacer_formatted, spacer_properties.spacer_main, relay_4]))  # -> Model, ReturnedResult
model_2 = CreateModel(
    ModelSListsAndGridLines=gwa.Model,
    GSAGeometryIn_m=flatten(elem1dedit_2.Element1D),
    ReMesh=True,
    Tolerance=0.01,
    Unit="m")
model_3 = CreateModel(ModelSListsAndGridLines=model_2, GSAGeometryIn_m=flatten(relay_3), ReMesh=True, Tolerance=0.01, Unit="m")
gwa_2 = GWACommand(GSAModel=model_3, GWAString=flatten([py3_17.prestress_2D, py3_17.prestress_1D]))  # -> Model, ReturnedResult
model_4 = CreateModel(
    ModelSListsAndGridLines=gwa_2.Model,
    Load=gravityload,
    AnalysisTasksCombinations=σt,
    ReMesh=True,
    Tolerance=0.01,
    Unit="m")
gwa_3 = GWACommand(GSAModel=model_4, GWAString=flatten(panel))  # -> Model, ReturnedResult
analyse = AnalyseModel(ModelSAndLists=gwa_3.Model, Analyse=True, ReMesh=True, Tolerance=0.01, Unit="m")  # -> Model, Errors, Warnings, Remarks, Logs; disabled
save = SaveGSAModel(GSAModel=gwa_3.Model, Save=True)

getgeo_3 = GetModelGeometry(GSAModel=gsa, Mode=1, Unit="m")  # -> NodesIn_m, _1DElementsIn_m, _2DElementsIn_m, _3DElementsIn_m, _1DMembersIn_m, _2DMembersIn_m, _3DMembersIn_m, Assemblies
elem1dedit_3 = Edit1DElement(Element1D=getgeo_3._1DElementsIn_m, Preview3dSection=False)  # -> Element1D, Number, Line, Property, Group, Type, Offset, StartRelease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
py3_27 = Python3Script(
    E1D=elem1dedit_3.Element1D,
    ID=elem1dedit_3.Number,
    Tp=elem1dedit_3.Topology,
    ID_cable=elem1dedit_2.Number,
    V=py3_26.V,
    cable_data=merge_4)  # -> out, Cable_def, New_cable_el; inputs E1D: list, ID: list, Tp: tree, ID_cable: list, V: tree, cable_data: list
# ---------- py3_27: Python ----------
import math
New_cable_el=[]
Cable_def=[]
id_cable_set = set(ID_cable)
AE=float(cable_data[1])*(float(cable_data[0])/2)**2*math.pi
mass=float(cable_data[2])*(float(cable_data[0])/2)**2*math.pi
node_start = []
node_end = []
for i in range(1,V.BranchCount+1):
    text="SET,PROP_CABLE.5,{num},Cable prop. 1,NO_RGB,{stiff},{mass},SLIDING,0,1,NO_ENV".format(num=i,stiff=AE,mass=mass)
    Cable_def.append(text)

property_number=[]
branch_length=[]
for i in range(V.BranchCount):
    branch_length.append(len(V.Branch(i)))

for i in range(1,V.BranchCount+1):
    j=1
    while j <(branch_length[i-1]):
        property_number.append(i)
        j=j+1

for i in range(Tp.BranchCount):
    path = Tp.Paths[i]
    branch = Tp.Branches[i]
    node_start.append(branch[0])
    node_end.append(branch[1])
c=0
for i in range(len(ID)):
    if ID[i] in id_cable_set:
        text="SET,EL.4,{id},,NO_RGB,CABLE,{prop},1,{st},{en},0,0,NO_RLS,0,0,0,0,,".format(id=ID[i],prop=property_number[c],st=node_start[i],en=node_end[i])
        c=c+1
        New_cable_el.append(text)
# ---------- end py3_27 ----------

relay_5 = Relay([py3_27.Cable_def, py3_27.New_cable_el])
gwa_4 = GWACommand(GSAModel=gsa, GWAString=flatten([py3_20.New_quad, relay_5]))  # -> Model, ReturnedResult
model_5 = CreateModel(ModelSListsAndGridLines=gwa_4.Model, GSAGeometryIn_m=gate.Target1, ReMesh=True, Tolerance=0.01, Unit="m")

py3_28 = Python3Script(
    ID=py3_21.a,
    Points=py3_21.b,
    nodes_Id=nodeedit.NodeNumber,
    ID_elements=elem1dedit_2.Number,
    Cable_prop_all=py3_27.Cable_def,
    geometric_data=merge,
    cable_data=merge_6,
    col_data=merge_7)  # -> out, pinned_points, pinned_ID, Cables_con, ID_cables_elements, ID_cables_set, Cable_props, new_top_nodes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; inputs ID: list, Points: list of Point3d, nodes_Id: list, ID_elements: list, Cable_prop_all: list, geometric_data: list, cable_data: list, col_data: list
# ---------- py3_28: Python ----------
# requirements: numpy
# requirements: scipy


import rhinoscriptsyntax as rs
import Rhino.Geometry as rg
import numpy as np
from scipy.optimize import linear_sum_assignment
from collections import defaultdict


# --- Input parameters ---
length, width, distance_col, number_col, height_col, radius = (
    float(geometric_data[0]),
    float(geometric_data[1]),
    float(geometric_data[2]),
    int(geometric_data[3]),
    float(geometric_data[4]),
    float(geometric_data[5]) + 0.01
)

pinned_points = []
pinned_ID = []
bottom_points = []
new_top_nodes = []
new_bottom_nodes =[]

if not cable_data[1] and not cable_data[2]:
    pinned_points = Points
    pinned_ID = ID

if cable_data[1] and not cable_data[2]:
    if cable_data[0] % 2 == 0:
        bottom_points = Points
    else:
        val1 = int((cable_data[0] - 1) / 2 * number_col)
        val2 = int((cable_data[0] + 1) / 2 * number_col)
        indices_for_cable = list(range(val1, val2))

        for i in range(len(Points)):
            if i in indices_for_cable and cable_data[1]:
                # Duplicate point
                bottom_points.append(Points[i])
                bottom_points.append(Points[i])
            else:
                # Single point
                bottom_points.append(Points[i])

    nodes_side = number_col * 2

    for i in range(nodes_side + 1):
        if i % 2 == 1: 
            y = (length / nodes_side) * i
            new_top_nodes.append(rs.CreatePoint(distance_col, y, height_col + cable_data[3]))
            new_top_nodes.append(rs.CreatePoint(width - distance_col, y, height_col + cable_data[3]))

            new_bottom_nodes.append(rs.CreatePoint(-cable_data[7], y, -col_data[0]))
            new_bottom_nodes.append(rs.CreatePoint(width +cable_data[7], y, -col_data[0]))

            bottom_points.append(rs.CreatePoint(-cable_data[7], y, -col_data[0]))
            bottom_points.append(rs.CreatePoint(width +cable_data[7], y, -col_data[0]))
        
    if len(new_top_nodes) > 0:
        repeats = int(len(bottom_points) / len(new_top_nodes))
        extra = len(bottom_points) - repeats * len(new_top_nodes)
        top_points = []

        for idx, pt in enumerate(new_top_nodes):
            count = repeats + (1 if idx < extra else 0)
            top_points.extend([pt] * count)
    else:
        top_points = []

if not cable_data[1] and cable_data[2]:
    bottom_points = Points

    for pt in Points:
        move_vec = rg.Vector3d(0, 0, cable_data[3])
        new_top_nodes.append(pt + move_vec)

    nodes_side = number_col * 2

    for i in range(nodes_side + 1):
        if i % 2 == 1:
            y = (length / nodes_side) * i
            new_top_nodes.append(rs.CreatePoint(distance_col, y, height_col + cable_data[3]))
            new_top_nodes.append(rs.CreatePoint(width - distance_col, y, height_col + cable_data[3]))

            new_bottom_nodes.append(rs.CreatePoint(-cable_data[7], y, -col_data[0]))
            new_bottom_nodes.append(rs.CreatePoint(width +cable_data[7], y, -col_data[0]))

            bottom_points.append(rs.CreatePoint(-cable_data[7], y, -col_data[0]))
            bottom_points.append(rs.CreatePoint(width +cable_data[7], y, -col_data[0]))
            
    top_points=new_top_nodes

    tol = 1

    groups = defaultdict(list)
    for pt in new_top_nodes:
        y_key = round(pt.Y / tol) * tol
        groups[y_key].append(pt)

    top_cables = []
    total_segments_top_cables = 0
    for y_key, pts in groups.items():
        sorted_pts = sorted(pts, key=lambda p: p.X)
        polyline = rg.Polyline(sorted_pts)
        top_cables.append(polyline)
        
        total_segments_top_cables += max(len(sorted_pts) - 1, 0)

if cable_data[1] or cable_data[2]: 

    if bottom_points and top_points:
        dist_matrix = np.zeros((len(bottom_points), len(top_points)))

        for i, bottom in enumerate(bottom_points):
            for j, top in enumerate(top_points):
                dist_matrix[i, j] = ((bottom.X - top.X)**2 + (bottom.Y - top.Y)**2)**0.5

        row_ind, col_ind = linear_sum_assignment(dist_matrix)

        Cables_con = []
        for i, j in zip(row_ind, col_ind):
            Cables_con.append(rs.AddLine(bottom_points[i], top_points[j]))

    new_bottom_nodes.append(rs.CreatePoint(-cable_data[7], -(length / nodes_side), -col_data[0]))
    new_bottom_nodes.append(rs.CreatePoint(width +cable_data[7], -(length / nodes_side), -col_data[0]))
    new_bottom_nodes.append(rs.CreatePoint(-cable_data[7], length+(length / nodes_side), -col_data[0]))
    new_bottom_nodes.append(rs.CreatePoint(width +cable_data[7], length+(length / nodes_side), -col_data[0]))

    for i in range(nodes_side + 1):
        y = (length / nodes_side) * i
        if i % 2 == 1:
            Cables_con.append(rs.AddLine(rs.CreatePoint(0, y, 0),rs.CreatePoint(-cable_data[7], y, -col_data[0])))
            Cables_con.append(rs.AddLine(rs.CreatePoint(width, y, 0),rs.CreatePoint(width+cable_data[7], y, -col_data[0])))

            Cables_con.append(rs.AddLine(rs.CreatePoint(distance_col+radius, y, height_col),rs.CreatePoint(distance_col, y, height_col + cable_data[3])))
            Cables_con.append(rs.AddLine(rs.CreatePoint(width-distance_col+radius, y, height_col),rs.CreatePoint(width-distance_col, y, height_col + cable_data[3])))
            Cables_con.append(rs.AddLine(rs.CreatePoint(distance_col-radius, y, height_col),rs.CreatePoint(distance_col, y, height_col + cable_data[3])))
            Cables_con.append(rs.AddLine(rs.CreatePoint(width-distance_col-radius, y, height_col),rs.CreatePoint(width-distance_col, y, height_col + cable_data[3])))
            Cables_con.append(rs.AddLine(rs.CreatePoint(distance_col, y+radius, height_col),rs.CreatePoint(distance_col, y, height_col + cable_data[3])))
            Cables_con.append(rs.AddLine(rs.CreatePoint(width-distance_col, y+radius, height_col),rs.CreatePoint(width-distance_col, y, height_col + cable_data[3])))
            Cables_con.append(rs.AddLine(rs.CreatePoint(distance_col, y-radius, height_col),rs.CreatePoint(distance_col, y, height_col + cable_data[3])))
            Cables_con.append(rs.AddLine(rs.CreatePoint(width-distance_col, y-radius, height_col),rs.CreatePoint(width-distance_col, y, height_col + cable_data[3])))
        else:
            Cables_con.append(rs.AddLine(rs.CreatePoint(distance_col, y, 0),rs.CreatePoint(-cable_data[7], y-(length / nodes_side), -col_data[0])))
            Cables_con.append(rs.AddLine(rs.CreatePoint(width-distance_col, y, 0),rs.CreatePoint(width+cable_data[7], y-(length / nodes_side), -col_data[0])))
            Cables_con.append(rs.AddLine(rs.CreatePoint(distance_col, y, 0),rs.CreatePoint(-cable_data[7], y+(length / nodes_side), -col_data[0])))
            Cables_con.append(rs.AddLine(rs.CreatePoint(width-distance_col, y, 0),rs.CreatePoint(width+cable_data[7], y+(length / nodes_side), -col_data[0])))
    if ID_elements:
        start_id = ID_elements[-1] + 1
    else:
        start_id = 1  # default if list is empty

    ID_cables_elements = [start_id + i for i in range(len(Cables_con))]

    if ID_elements:
        start_id = len(Cable_prop_all) + 1
    else:
        start_id = 1  # default if list is empty

    ID_cables_set = [start_id + i for i in range(len(Cables_con))]
    Cable_props=[cable_data[4],cable_data[5],cable_data[6]]


    if ID_elements:
        start_id = len(nodes_Id) + 1
    else:
        start_id = 1  # default if list is empty

    Id_nodes = [start_id + i for i in range(len(new_top_nodes)+len(new_bottom_nodes))]

if not cable_data[1] and cable_data[2]:
    if ID_elements:
        start_id = ID_cables_elements[-1] + 1
    else:
        start_id = 1  # default if list is empty

    ID_cables_elements_top = [start_id + i for i in range(total_segments_top_cables)]

    if ID_elements:
        start_id = ID_cables_set[-1] + 1
    else:
        start_id = 1  # default if list is empty

    ID_cables_set_top = [start_id + i for i in range(len(top_cables))]
# ---------- end py3_28 ----------
py3_29 = Python3Script(cable_data=merge_6)  # -> out, A, B, C; inputs cable_data: list
# ---------- py3_29: Python ----------
print(cable_data)
if cable_data[1] is True or cable_data[2] is True:
    A=True
else:
    A=False
B=cable_data[2]
if cable_data[1] is False and cable_data[2] is False:
    C=True
else:
    C=False
# ---------- end py3_29 ----------
support_4 = CreateSupport(Point=py3_28.pinned_points, Plane=PlaneXY(0, 0, 0), x=False, xx=False, y=False, yy=False, z=True, zz=False)
support_5 = CreateSupport(Point=py3_28.new_bottom_nodes, Plane=PlaneXY(0, 0, 0), x=True, xx=False, y=True, yy=False, z=True, zz=False)
support_6 = CreateSupport(Point=py3_28.new_top_nodes, Plane=PlaneXY(0, 0, 0), x=False, xx=False, y=False, yy=False, z=False, zz=False)
nodeedit_3 = EditNode(Node=support_4, NodeNumber=py3_28.pinned_ID, Mode=1)  # -> Node, NodeNumber, NodePosition, NodeLocalAxis, NodeRestraints, DamperProperty, MassProperty, SpringProperty, NodeName, NodeColour
mem1d_3 = Create1DMember(
    Curve=py3_28.Cables_con,
    Preview3dSection=False,
    x1=False,
    x2=False,
    xx1=False,
    xx2=False,
    y1=False,
    y2=False,
    yy1=False,
    yy2=False,
    z1=False,
    z2=False,
    zz1=False,
    zz2=False)
nodeedit_4 = EditNode(Node=[support_6, support_5], NodeNumber=py3_28.Id_nodes, Mode=1)  # -> Node, NodeNumber, NodePosition, NodeLocalAxis, NodeRestraints, DamperProperty, MassProperty, SpringProperty, NodeName, NodeColour
gate_2 = StreamGate(Stream=nodeedit_3.Node, Gate=py3_29.C)  # -> Target0, Target1
elemfrommem_3 = CreateElementsFromMembers(Nodes_m=flatten([nodeedit_4.Node, nodeedit.Node]), _1DMembers_m=mem1d_3, Tolerance=0.001, Unit="m")  # -> Nodes, _1DElements, _2DElements, _3DElements, GSAModel
elem1dedit_4 = Edit1DElement(Element1D=elemfrommem_3._1DElements, Number=py3_28.ID_cables_elements, Preview3dSection=False)  # -> Element1D, Number, Line, Property, Group, Type, Offset, StartRelease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
py3_30 = Python3Script(ID=elem1dedit_4.Number, Tp=elem1dedit_4.Topology, Id_set=py3_28.ID_cables_set, cable_data=py3_28.Cable_props)  # -> out, Cable_def, New_cable_el; inputs ID: list, Tp: tree, Id_set: list, cable_data: list
# ---------- py3_30: Python ----------
import math

New_cable_el=[]
c=0
node_start=[]
node_end=[]

AE=float(cable_data[1])*(float(cable_data[0])/2)**2*math.pi
mass=float(cable_data[2])*(float(cable_data[0])/2)**2*math.pi

Cable_def=[]
for i in Id_set:
    text="SET,PROP_CABLE.5,{num},Cable prop. 1,NO_RGB,{stiff},{mass},SLIDING,0,1,NO_ENV".format(num=i,stiff=AE,mass=mass)
    Cable_def.append(text)


for i in range(Tp.BranchCount):
    path = Tp.Paths[i]
    branch = Tp.Branches[i]
    node_start.append(branch[0])
    node_end.append(branch[1])

for i in range(len(ID)):
    text="SET,EL.4,{id},,NO_RGB,CABLE,{prop},1,{st},{en},0,0,NO_RLS,0,0,0,0,,".format(id=ID[i],prop=Id_set[i],st=node_start[i],en=node_end[i])
    c=c+1
    New_cable_el.append(text)
# ---------- end py3_30 ----------
model_6 = CreateModel(ModelSListsAndGridLines=model_5, GSAGeometryIn_m=flatten(gate_2.Target1), ReMesh=True, Tolerance=0.01, Unit="m")
mem1d_4 = Create1DMember(
    Curve=py3_28.top_cables,
    Preview3dSection=False,
    x1=False,
    x2=False,
    xx1=False,
    xx2=False,
    y1=False,
    y2=False,
    yy1=False,
    yy2=False,
    z1=False,
    z2=False,
    zz1=False,
    zz2=False)
elemfrommem_4 = CreateElementsFromMembers(Nodes_m=flatten([nodeedit.Node, nodeedit_4.Node]), _1DMembers_m=mem1d_4, Tolerance=0.001, Unit="m")  # -> Nodes, _1DElements, _2DElements, _3DElements, GSAModel
gate_3 = StreamGate(Stream=flatten(nodeedit_4.Node), Gate=py3_29.A)  # -> Target0, Target1
gate_4 = StreamGate(Stream=flatten([py3_30.Cable_def, py3_30.New_cable_el]), Gate=py3_29.A)  # -> Target0, Target1
model_7 = CreateModel(ModelSListsAndGridLines=model_6, GSAGeometryIn_m=gate_3.Target1, ReMesh=True, Tolerance=0.01, Unit="m")
elem1dedit_5 = Edit1DElement(Element1D=elemfrommem_4._1DElements, Number=py3_28.ID_cables_elements_top, Preview3dSection=False)  # -> Element1D, Number, Line, Property, Group, Type, Offset, StartRelease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
py3_31 = Python3Script(ID=elem1dedit_5.Number, Tp=elem1dedit_5.Topology, Id_set=py3_28.ID_cables_set_top, cable_data=py3_28.Cable_props)  # -> out, Cable_def, New_cable_el; inputs ID: list, Tp: tree, Id_set: list, cable_data: list
# ---------- py3_31: Python ----------
import math

New_cable_el=[]
c=0
node_start=[]
node_end=[]

AE=float(cable_data[1])*(float(cable_data[0])/2)**2*math.pi
mass=float(cable_data[2])*(float(cable_data[0])/2)**2*math.pi

Cable_def=[]
for i in Id_set:
    text="SET,PROP_CABLE.5,{num},Cable prop. 1,NO_RGB,{stiff},{mass},SLIDING,0,1,NO_ENV".format(num=i,stiff=AE,mass=mass)
    Cable_def.append(text)

Total_el=len(ID)/len(Id_set)

if len(Id_set) > 0:
        repeats = int(len(ID)/len(Id_set))
        extra = len(ID) - repeats * len(Id_set)
        el_sorted = []

        for idx, pt in enumerate(Id_set):
            count = repeats + (1 if idx < extra else 0)
            el_sorted.extend([pt] * count)
else:
    el_sorted = []

for i in range(Tp.BranchCount):
    path = Tp.Paths[i]
    branch = Tp.Branches[i]
    node_start.append(branch[0])
    node_end.append(branch[1])

for i in range(len(ID)):
    text="SET,EL.4,{id},,NO_RGB,CABLE,{prop},1,{st},{en},0,0,NO_RLS,0,0,0,0,,".format(id=ID[i],prop=el_sorted[i],st=node_start[i],en=node_end[i])
    c=c+1
    New_cable_el.append(text)
# ---------- end py3_31 ----------
gate_5 = StreamGate(Stream=flatten([py3_31.Cable_def, py3_31.New_cable_el]), Gate=py3_29.B)  # -> Target0, Target1
gwa_5 = GWACommand(GSAModel=model_7, GWAString=flatten([gate_5.Target1, gate_4.Target1, "Null"]))  # -> Model, ReturnedResult

py3_32 = Python3Script(x=py3_28.ID_cables_elements_top, y=py3_28.ID_cables_elements)  # -> out, a; inputs x: list, y: list
# ---------- py3_32: Python ----------
if x and x[0] is None: 
    a = y
else:
    a = x
# ---------- end py3_32 ----------

py3_33 = Python3Script(ID=py3_28.Id_nodes, Geometric_Data=merge, Support_Data=merge_6, Column_data=merge_7, P=move_2.Geometry)  # -> out, boolean, Slanted_columns, Top_columns, Horizontal_lines, Hor_lin, Taperd_columns, Circle_lines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; inputs ID: list, Geometric_Data: list, Support_Data: list, Column_data: list, P: tree
# ---------- py3_33: Python ----------
import rhinoscriptsyntax as rs
import Rhino.Geometry as rg

if Support_Data[1] is True or Support_Data[2] is True:
    boolean=True
    # --- Input unpacking ---
    length, width, distance_col, number_col, height_col, radius = (
        float(Geometric_Data[0]),
        float(Geometric_Data[1]),
        float(Geometric_Data[2]),
        int(Geometric_Data[3]),
        float(Geometric_Data[4]),
        float(Geometric_Data[5]) + 0.01
    )

    supports = int(Support_Data[0]) + 1
    nodes_side = number_col * 2
    span = width - 2 * distance_col

    # --- Create pinned nodes ---
    Con_nodes = []
    Mid_nodes = []
    Top_nodes = []
    Side_bot_nodes = []
    Side_top_nodes = []
    Low_nodes=[]
    Long_1=[]
    Long_2=[]
    Horizontal_lines=[]
    Top_elements=[]
    for i in range(nodes_side + 1):
        y = (length / nodes_side) * i
        Long_1.append(rs.CreatePoint(distance_col, y, 0))
        Long_2.append(rs.CreatePoint(width-distance_col, y, 0))
        if i % 2 == 1:
            Mid_nodes.append(rs.CreatePoint(distance_col, y, height_col))
            Mid_nodes.append(rs.CreatePoint(width-distance_col, y, height_col))

            Top_nodes.append(rs.CreatePoint(distance_col, y, height_col+Support_Data[3]))
            Top_nodes.append(rs.CreatePoint(width-distance_col, y, height_col+Support_Data[3]))

            Con_nodes.append(rs.CreatePoint(distance_col, y, -Column_data[0]))
            Con_nodes.append(rs.CreatePoint(width-distance_col, y, -Column_data[0]))

            Side_bot_nodes.append(rs.CreatePoint(width-distance_col, y, -Column_data[0]))
            Side_bot_nodes.append(rs.CreatePoint(distance_col, y, -Column_data[0]))

            Side_top_nodes.append(rs.CreatePoint(width, y, 0))
            Side_top_nodes.append(rs.CreatePoint(0, y, 0))

            Low_nodes.append(rs.CreatePoint(distance_col, y, 0))
            Low_nodes.append(rs.CreatePoint(width-distance_col, y,0))

            Horizontal_lines.append(rs.AddLine(rs.CreatePoint(distance_col, y, 0),rs.CreatePoint(0, y, 0)))
            Horizontal_lines.append(rs.AddLine(rs.CreatePoint(width-distance_col, y, 0),rs.CreatePoint(width, y, 0)))

            Top_elements.append(rs.AddLine(rs.CreatePoint(distance_col, y, height_col),rs.CreatePoint(distance_col, y-radius, height_col)))
            Top_elements.append(rs.AddLine(rs.CreatePoint(width-distance_col, y, height_col),rs.CreatePoint(width-distance_col, y-radius, height_col)))
            Top_elements.append(rs.AddLine(rs.CreatePoint(distance_col, y, height_col),rs.CreatePoint(distance_col, y+radius, height_col)))
            Top_elements.append(rs.AddLine(rs.CreatePoint(width-distance_col, y, height_col),rs.CreatePoint(width-distance_col, y+radius, height_col)))
            Top_elements.append(rs.AddLine(rs.CreatePoint(distance_col, y, height_col),rs.CreatePoint(distance_col-radius, y, height_col)))
            Top_elements.append(rs.AddLine(rs.CreatePoint(width-distance_col, y, height_col),rs.CreatePoint(width-distance_col-radius, y, height_col)))
            Top_elements.append(rs.AddLine(rs.CreatePoint(distance_col, y, height_col),rs.CreatePoint(distance_col+radius, y, height_col)))
            Top_elements.append(rs.AddLine(rs.CreatePoint(width-distance_col, y, height_col),rs.CreatePoint(width-distance_col+radius, y, height_col)))

        else:
            if i>0:
                Side_bot_nodes.append(rs.CreatePoint(width-distance_col, y-(length / nodes_side), -Column_data[0]))
                Side_bot_nodes.append(rs.CreatePoint(distance_col, y-(length / nodes_side), -Column_data[0]))

                Side_top_nodes.append(rs.CreatePoint(width-distance_col, y, 0))
                Side_top_nodes.append(rs.CreatePoint(distance_col, y, 0))
            
            if i<nodes_side:
                Side_bot_nodes.append(rs.CreatePoint(width-distance_col, y+(length / nodes_side), -Column_data[0]))
                Side_bot_nodes.append(rs.CreatePoint(distance_col, y+(length / nodes_side), -Column_data[0]))

                Side_top_nodes.append(rs.CreatePoint(width-distance_col, y, 0))
                Side_top_nodes.append(rs.CreatePoint(distance_col, y, 0))
    Slanted_columns=[]
    Top_columns=[]
    Taperd_columns=[]
    for i in range(len(Side_bot_nodes)):
        Slanted_columns.append(rs.AddLine(Side_bot_nodes[i],Side_top_nodes[i]))
    for i in range(len(Con_nodes)):
        Top_columns.append(rs.AddLine(Top_nodes[i],Mid_nodes[i]))
        Top_columns.append(rs.AddLine(Mid_nodes[i],Low_nodes[i]))
        Taperd_columns.append(rs.AddLine(Low_nodes[i],Con_nodes[i]))

    Hor_lin=[rg.Polyline(Long_1),rg.Polyline(Long_2)]

    if ID:
        start_id = ID[-1] + 1
    else:
        start_id = 1  # default if list is empty

    ID_nodes = [start_id + i for i in range(len(Mid_nodes)+len(Con_nodes)+len(Low_nodes))]

    Top_taper=Column_data[1]
    Bottom_taper=Column_data[2]
    Connection_taper=Column_data[3]
    thickness=Column_data[4]
    Circle_lines=P
else:
    boolean=False
# ---------- end py3_33 ----------
support_7 = CreateSupport(
    Point=[py3_33.Mid_nodes, py3_33.Low_nodes],
    Plane=PlaneXY(0, 0, 0),
    x=False,
    xx=False,
    y=False,
    yy=False,
    z=False,
    zz=False)
support_8 = CreateSupport(Point=py3_33.Con_nodes, Plane=PlaneXY(0, 0, 0), x=True, xx=False, y=True, yy=False, z=True, zz=False)
nodeedit_5 = EditNode(Node=[support_8, support_7], NodeNumber=py3_33.ID_nodes, Mode=1)  # -> Node, NodeNumber, NodePosition, NodeLocalAxis, NodeRestraints, DamperProperty, MassProperty, SpringProperty, NodeName, NodeColour
profile_2 = CreateProfile(
    Diameter_m=py3_33.Bottom_taper,
    Thickness_m=py3_33.thickness,
    catalogueIndex=-1,
    inclSS=False,
    lengthUnit="Meter",
    mode="Other",
    Profile_type="Circle Hollow",
    Measure="m",
    typeIndex=-1)
profile_3 = CreateProfile(
    Diameter_m=py3_33.Top_taper,
    Thickness_m=py3_33.thickness,
    catalogueIndex=-1,
    inclSS=False,
    lengthUnit="Meter",
    mode="Other",
    Profile_type="Circle Hollow",
    Measure="m",
    typeIndex=-1)
profile_4 = CreateProfile(
    Diameter_m=py3_33.Connection_taper,
    Thickness_m=py3_33.thickness,
    catalogueIndex=-1,
    inclSS=False,
    lengthUnit="Meter",
    mode="Other",
    Profile_type="Circle Hollow",
    Measure="m",
    typeIndex=-1)
relay_6 = Relay([py3_33.Slanted_columns, py3_33.Hor_lin, py3_33.Horizontal_lines])
relay_7 = Relay([py3_33.Top_columns, py3_33.Taperd_columns])
mat_3 = CreateMaterial(Material_type="Steel", Design_Code="EN 1993-1-1:2005", Grade="S355")
section_2 = CreateSection(Profile=profile_2, Material=mat_3, Basic_Offset="Centroid")
section_3 = CreateSection(Profile=profile_3, Material=mat_3, Basic_Offset="Centroid")
section_4 = CreateSection(Profile=profile_4, Material=mat_3, Basic_Offset="Centroid")
py3_34 = Python3Script(x=py3_33.Circle_lines)  # -> out, a; inputs x: tree of Point3d
# ---------- py3_34: Python ----------
import Rhino.Geometry as rg
from Grasshopper import DataTree
from Grasshopper.Kernel.Data import GH_Path

# Assume x is your input DataTree of points
lines = DataTree[rg.Line]()  # Output tree of lines

for path in x.Paths:
    branch = x.Branch(path)
    if len(branch) >= 2:  # Need at least 2 points
        l=len(branch)-1
        first_point = branch[0]
        last_point = branch[l]
        line = rg.Line(first_point, last_point)
        lines.Add(line, path)  # Keep the same path

a = lines  # Output lines
# ---------- end py3_34 ----------
pline_4 = PolyLine(Vertices=py3_33.Circle_lines, Closed=False)
mem1d_5 = Create1DMember(
    Curve=flatten(relay_6),
    Property=section_2,
    Preview3dSection=False,
    x1=False,
    x2=False,
    xx1=True,
    xx2=True,
    y1=False,
    y2=False,
    yy1=True,
    yy2=True,
    z1=False,
    z2=False,
    zz1=True,
    zz2=True)
mem1d_6 = Create1DMember(
    Curve=flatten(relay_7),
    Property=section_3,
    Preview3dSection=False,
    x1=False,
    x2=False,
    xx1=False,
    xx2=False,
    y1=False,
    y2=False,
    yy1=False,
    yy2=False,
    z1=False,
    z2=False,
    zz1=False,
    zz2=False)
mem1d_7 = Create1DMember(
    Curve=flatten([pline_4, py3_34.a, py3_33.Top_elements]),
    Property=section_4,
    Preview3dSection=False,
    x1=False,
    x2=False,
    xx1=True,
    xx2=True,
    y1=False,
    y2=False,
    yy1=True,
    yy2=True,
    z1=False,
    z2=False,
    zz1=True,
    zz2=True)
elemfrommem_5 = CreateElementsFromMembers(
    Nodes_m=flatten([nodeedit_4.Node, nodeedit_5.Node, nodeedit.Node]),
    _1DMembers_m=flatten([mem1d_5, mem1d_6, mem1d_7]),
    Tolerance=0.001,
    Unit="m")  # -> Nodes, _1DElements, _2DElements, _3DElements, GSAModel
editpb = EditSection(Section=section_3, SectionNumber="2")  # -> Section, SectionNumber, SectionProfile, Material, BasicOffset, AddOffsetY_cm, AddOffsetZ_cm, SectionModifier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
editpb_2 = EditSection(Section=section_2, SectionNumber="1")  # -> Section, SectionNumber, SectionProfile, Material, BasicOffset, AddOffsetY_cm, AddOffsetZ_cm, SectionModifier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
editpb_3 = EditSection(Section=section_4, SectionNumber="3")  # -> Section, SectionNumber, SectionProfile, Material, BasicOffset, AddOffsetY_cm, AddOffsetZ_cm, SectionModifier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
elem1dedit_6 = Edit1DElement(Element1D=elemfrommem_5._1DElements, Preview3dSection=False)  # -> Element1D, Number, Line, Property, Group, Type, Offset, StartRelease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
py3_35 = Python3Script(
    ID=py3_32.a,
    PB=elem1dedit_6.Property,
    Tp=elem1dedit_6.Topology,
    a=editpb_2.Section,
    b=editpb.Section,
    c=editpb_3.Section)  # -> out, Beam_el; inputs ID: list, PB: list, Tp: tree
# ---------- py3_35: Python ----------
Beam_el=[]
node_start=[]
node_end=[]
if ID:
    start_id = ID[-1] + 1
else:
    start_id = 1  # default if list is empty

ID_nodes = [start_id + i for i in range(len(PB))]
pb=[]
for i in PB:
    if str(i)==str(a):
        pb.append(1)
    elif str(i)==str(b):
        pb.append(2)
    elif str(i)==str(c):
        pb.append(3)
    else:
        print("hello")
        print(str(i))
        print(str(c))

for i in range(Tp.BranchCount):
    path = Tp.Paths[i]
    branch = Tp.Branches[i]
    node_start.append(branch[0])
    node_end.append(branch[1])
for i in range(len(ID_nodes)):
    text="SET,EL.4,{id},,NO_RGB,BEAM,{prop},1,{st},{en},0,0,NO_RLS,0,0,0,0,,".format(id=ID_nodes[i],prop=pb[i],st=node_start[i],en=node_end[i])
    Beam_el.append(text)
# ---------- end py3_35 ----------
gate_6 = StreamGate(Stream=flatten(nodeedit_5.Node), Gate=py3_33.boolean)  # -> Target0, Target1
gate_7 = StreamGate(Stream=flatten(py3_35.Beam_el), Gate=py3_33.boolean)  # -> Target0, Target1
gate_8 = StreamGate(Stream=flatten([editpb_2.Section, editpb.Section, editpb_3.Section]), Gate=py3_33.boolean)  # -> Target0, Target1

model_8 = CreateModel(
    ModelSListsAndGridLines=gwa_5.Model,
    Properties=flatten(gate_8.Target1),
    GSAGeometryIn_m=flatten(gate_6.Target1),
    ReMesh=True,
    Tolerance=0.01,
    Unit="m")
gwa_6 = GWACommand(GSAModel=model_8, GWAString=flatten([gate_7.Target1, "Null"]))  # -> Model, ReturnedResult

py3_36 = Python3Script(Loading_data=merge_5, Pt=nodeedit.NodePosition)  # -> out, wedown, snow, weup; inputs Loading_data: list, Pt: list of Point3d
# ---------- py3_36: Python ----------
## Wind loading calcuations
v_map=float(Loading_data[0])
if Pt:
    z_values = [pt.Z for pt in Pt]
    height = max(z_values)
else:
    height = None
calt=1+0.001*height
v0=calt*v_map
qb=0.613*v0**2/1000
qp=qb*float(Loading_data[1])*float(Loading_data[2])
weup=qp*1.3
wedown=-qp*0.9



snow=-1*float(Loading_data[3])
# ---------- end py3_36 ----------
loadcase_2 = CreateLoadCase(CaseID="5", Name="snow", Type="Snow")
loadcase_3 = CreateLoadCase(CaseID="3", Name="wind_dw", Type="Wind")
loadcase_4 = CreateLoadCase(CaseID="4", Name="wind_up", Type="Wind")
faceload = CreateFaceLoad(
    LoadCase=loadcase_3,
    Loadable2DObjects="all",
    Name="wind_dw",
    Axis=-1,
    Direction="z",
    Projected=False,
    Value_kN_m²=py3_36.wedown,
    Type="Uniform",
    Unit="kN/m²")
faceload_2 = CreateFaceLoad(
    LoadCase=loadcase_4,
    Loadable2DObjects="all",
    Name="wind_up",
    Axis=-1,
    Direction="z",
    Projected=False,
    Value_kN_m²=py3_36.weup,
    Type="Uniform",
    Unit="kN/m²")
faceload_3 = CreateFaceLoad(
    LoadCase=loadcase_2,
    Loadable2DObjects="all",
    Name="snow",
    Axis=0,
    Direction="z",
    Projected=False,
    Value_kN_m²=py3_36.snow,
    Type="Uniform",
    Unit="kN/m²")
relay_8 = Relay([faceload, faceload_2])
σa_2 = CreateAnalysisCase(Name="sw+wind_dw", Description="L2+L3+L1")
σa_3 = CreateAnalysisCase(Name="sw+snow", Description="L2+L5+L1")
σa_4 = CreateAnalysisCase(Name="sw+wind_up", Description="L2+L4+L1")
σt_2 = CreateAnalysisTask(TaskID="2", Name="non_linear_analysis", AnalysisCases=flatten([σa_2, σa_3, σa_4]), casesParamIndex=2, Solver="Static")
relay_9 = Relay([relay_8, faceload_3])
model_9 = CreateModel(
    ModelSListsAndGridLines=gwa_6.Model,
    Load=flatten(relay_9),
    AnalysisTasksCombinations=σt_2,
    ReMesh=True,
    Tolerance=0.01,
    Unit="m")

getgeo_4 = GetModelGeometry(GSAModel=model_8, Mode=1, Unit="m")  # -> NodesIn_m, _1DElementsIn_m, _2DElementsIn_m, _3DElementsIn_m, _1DMembersIn_m, _2DMembersIn_m, _3DMembersIn_m, Assemblies
elem2dedit_2 = Edit2DElement(Element2D=getgeo_4._2DElementsIn_m, Preview3dSection=False)  # -> Element2D, Number, Geometry, _2DProperty, Group, ElementType, Offset, OrientationAngle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
py3_37 = Python3Script(nodes=nodeedit.NodePosition, Id=elem2dedit_2.Number, Tp=elem2dedit_2.Topology, Geometric_Data=merge)  # -> out, flatten(branch_ids_tree); inputs nodes: list of Point3d, Id: list, Tp: tree, Geometric_Data: list
# ---------- py3_37: Python ----------
import Rhino.Geometry as rg
from Grasshopper import DataTree
from Grasshopper.Kernel.Data import GH_Path

length = float(Geometric_Data[0])
width = float(Geometric_Data[1])
distance_col = float(Geometric_Data[2])
number_col = int(Geometric_Data[3])
height_col = float(Geometric_Data[4])
radius = float(Geometric_Data[5]) + 0.01

# --- Generate Y-limits ---
nodes_side = number_col * 2
y_lim = [(length / nodes_side) * i for i in range(nodes_side + 1)]
y_pairs = [(y_lim[i], y_lim[i+1]) for i in range(0, len(y_lim)-1, 2)]

# --- Prepare output DataTrees ---
hits_tree = DataTree[bool]()
inside_nodes_tree = DataTree[object]()
branch_ids_tree = DataTree[object]()

# --- Loop over Tp branches ---
for branch_idx, path in enumerate(Tp.Paths):
    branch_indices = Tp.Branch(path)
    branch_hit = False

    for idx in branch_indices:
        pt = nodes[idx]
        y = pt.Y
        if any(min(a,b) <= y <= max(a,b) for a,b in y_pairs):
            branch_hit = True
            inside_nodes_tree.Add(pt, path)

    hits_tree.Add(branch_hit, path)

    # If branch hit, output its corresponding Id
    if branch_hit:
        branch_ids_tree.Add(Id[branch_idx], path)
# ---------- end py3_37 ----------

py3_38 = Python3Script(Loading_data=merge_5, Pt=nodeedit.NodePosition)  # -> out, wedown, snow, weup; inputs Loading_data: list, Pt: list of Point3d; same code as py3_36
loadcase_5 = CreateLoadCase(CaseID="8", Name="snow_pat", Type="Snow")
loadcase_6 = CreateLoadCase(CaseID="6", Name="wind_dw_pat", Type="Wind")
loadcase_7 = CreateLoadCase(CaseID="7", Name="wind_up_pat", Type="Wind")
faceload_4 = CreateFaceLoad(
    LoadCase=loadcase_6,
    Loadable2DObjects=py3_37.branch_ids_tree,
    Name="wind_dw",
    Axis=-1,
    Direction="z",
    Projected=False,
    Value_kN_m²=py3_38.wedown,
    Type="Uniform",
    Unit="kN/m²")
faceload_5 = CreateFaceLoad(
    LoadCase=loadcase_7,
    Loadable2DObjects=py3_37.branch_ids_tree,
    Name="wind_up",
    Axis=-1,
    Direction="z",
    Projected=False,
    Value_kN_m²=py3_38.weup,
    Type="Uniform",
    Unit="kN/m²")
faceload_6 = CreateFaceLoad(
    LoadCase=loadcase_5,
    Loadable2DObjects=py3_37.branch_ids_tree,
    Name="snow",
    Axis=0,
    Direction="z",
    Projected=False,
    Value_kN_m²=py3_38.snow,
    Type="Uniform",
    Unit="kN/m²")
relay_10 = Relay([faceload_4, faceload_5])
σa_5 = CreateAnalysisCase(Name="sw+wind_dw", Description="L2+L6+L1")
σa_6 = CreateAnalysisCase(Name="sw+snow", Description="L2+L8+L1")
σa_7 = CreateAnalysisCase(Name="sw+wind_up", Description="L2+L7+L1")
σt_3 = CreateAnalysisTask(
    TaskID="3",
    Name="non_linear_analysis_patterning",
    AnalysisCases=flatten([σa_5, σa_6, σa_7]),
    casesParamIndex=2,
    Solver="Static")
relay_11 = Relay([relay_10, faceload_6])

model_10 = CreateModel(ModelSListsAndGridLines=model_9, Load=relay_11, AnalysisTasksCombinations=σt_3, ReMesh=True, Tolerance=0.01, Unit="m")
# C:\Users\santi\OneDrive - University of Glasgow\Year 5 Enginering\Dissertation\Just playing around with Rhino\GSA Tutorial\Deliverables\Iteration_8a_GSA.gwb
save_2 = SaveGSAModel(GSAModel=model_10, Save=True)
model_11 = CreateModel(ModelSListsAndGridLines=model_10, ReMesh=True, Tolerance=0.01, Unit="m")
getgeo_5 = GetModelGeometry(GSAModel=model_11, Mode=1, Unit="m")  # -> NodesIn_m, _1DElementsIn_m, _2DElementsIn_m, _3DElementsIn_m, _1DMembersIn_m, _2DMembersIn_m, _3DMembersIn_m, Assemblies
e2d = Element2D(getgeo_5._2DElementsIn_m)
elem1dedit_7 = Edit1DElement(Element1D=getgeo_5._1DElementsIn_m, Preview3dSection=False)  # -> Element1D, Number, Line, Property, Group, Type, Offset, StartRelease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
py3_39 = Python3Script(y=elem1dedit_7.Type)  # -> out, a; inputs y: list
# ---------- py3_39: Python ----------
a=[]
for i in range(len(y)):
    if y[i] =="Cable":
        a.append(i)
# ---------- end py3_39 ----------
preview3d = Preview3DSections(ElementMember1D2D=elem1dedit_7.Element1D)  # -> AnalysisLayerMesh, AnalysisLayerOutlines, DesignLayerMesh, DesignLayerOutlines
item = ListItem(List=elem1dedit_7.Element1D, Index=py3_39.a, Wrap=True)
mesh_3 = Mesh(preview3d.AnalysisLayerMesh)
pipe = Pipe(Curve=item, Radius="0.1", Caps=0)
